# Grasshopper definition 251030_pandas_basic.gh (Grasshopper 1.0.8)
# plug-ins: RhinoCodePluginGH

path = FilePath("C:\Users\msi\Desktop\KH\JAH_PythonCircle\gps_to_upm.py")
path_2 = FilePath("C:\Users\msi\Desktop\KH\JAH_PythonCircle\api_to_df.py")
gps_to_upm = Python3Script(script=path, vworld_key="F68777C0-65F3-37BD-8633-408133B8F572")  # -> out, a; unedited script template
py3 = Python3Script(script=path_2, URL="http://openapi.seoul.go.kr:8088", api_key="707372594162726936364c44614e78", service="ppsLocalResd")  # -> out, pop_data, male_pop; unedited script template
panel = Panel(py3.male_pop)
panel_2 = Panel(py3.out)
