# Grasshopper definition api_to_df_sample.gh (Grasshopper 1.0.8)
# plug-ins: Bifocals, LadybugGrasshopper

# ----
# 주의!
# 0. 가급적 Rhino 8 추천 (Rhino 7의 내장 파이썬 버전은 python2.7.xx. python2로는 해당 스크립트를 그대로 실행시킬 수 없다)
# 1. 반드시 Rhino가 internet에 연결된 상태여야 함.
# 2. 각 스크립트 최상단에 기입한
# ```
# #! python3
# # venv: JAH(자유롭게 설정)
# # r: requests, pandas
# ```
# 는 각각
# - 구동 언어
# - 스크립트를 실행할 가상환경(virtual environment)
# - 실행에 필요한 외부 라이브러리
# 를 의미한다.
# 
# 가상환경 설정과 외부 라이브러리 다운로드는 처음 해보면 이런저런 이유로 빌드가 꼬일 수도 있다.
# (대표적으로 인터넷이 연결되어있지 않은 경우)
# 그럴 땐 당황하지 말고
# C:\Users\{user_name}\.rhinocode\py39-rh8\site-envs 위치에 존재하는 모든 폴더를 지우고 라이노를 재시작하자.
# 
# 가상환경 설정이 정 귀찮으면 # venv: JAH를 지워도 당장은 괜찮다.
# 그리하면 가상환경 없이 전역 환경에 외부 라이브러리가 설치되고, 전역 환경에서 스크립트가 실행될 것이다.
# DataSeoulOpenAPIParser
panel = Panel("data seoul 개인 api key")
dataseoulopenapiparser = Python3Script(api_key=panel)  # -> out, data_seoul_parser
# ---------- dataseoulopenapiparser: Python ----------
#! python3
# venv: JAH
# r: requests, pandas

import requests
import pandas as pd
import xml.etree.ElementTree as ET
from typing import Optional, List, Dict, Any

class DataSeoulOpenAPIParser:
    """
    XML -> pd.DataFrame
    with data.seoul.go.kr OPEN API
    """

    def __init__(self, api_key: str, base_url: str = "http://openapi.seoul.go.kr:8088"):
        self.api_key = api_key
        self.base_url = base_url

    def _build_url(self, service_name: str, start: int, end: int) -> str:
        return f"{self.base_url}/{self.api_key}/xml/{service_name}/{start}/{end}/"

    def _fetch_xml_root(self, url: str) -> ET.Element:
        """
        url -> XML
        """
        resp = requests.get(url, timeout=15)
        resp.raise_for_status()
        root = ET.fromstring(resp.content)

        # API 응답 내 에러 처리 (RESULT 코드 확인)
        result = root.find(".//RESULT")
        if result is not None:
            code = (result.findtext("CODE") or "").strip()
            msg  = (result.findtext("MESSAGE") or "").strip()
            # INFO-000 = 정상, 그 외에도 "정상 처리되었습니다" 메시지면 통과
            if code and code != "INFO-000" and "정상" not in msg:
                raise RuntimeError(f"API 오류: {code} - {msg}")
        return root

    def _xml_to_records(self, root: ET.Element) -> List[Dict[str, Any]]:
        """
        <row> -> list[dict[col, val]]
        """
        records = []
        for row in root.iter("row"):
            rec = {child.tag: (child.text or "").strip() for child in row}
            records.append(rec)
        return records

    def _get_list_total_count(self, root: ET.Element) -> Optional[int]:
        """응답 트리 어딘가의 <list_total_count> 추출 (없으면 None)"""
        node = root.find(".//list_total_count")
        if node is None or (node.text is None):
            return None
        txt = node.text.strip()
        return int(txt) if txt.isdigit() else None

    def to_dataframe(self, service_name: str, start: int = 1, end: int = 100) -> pd.DataFrame:
        """단일 구간 호출 -> DataFrame"""
        url = self._build_url(service_name, start, end)
        root = self._fetch_xml_root(url)
        records = self._xml_to_records(root)
        return pd.DataFrame(records)

    def to_dataframe_full(
        self,
        service_name: str,
        page_size: int = 1000,
        start: int = 1,
        end: Optional[int] = None,
        max_rows: Optional[int] = None,
        verbose: bool = False,
    ) -> pd.DataFrame:
        """
        자동 페이지네이션으로 전체(또는 지정량) 수집.

        Parameters
        ----------
        service_name : str
            API 서비스명
        page_size : int, default 1000
            요청당 레코드 수(서울열린데이터는 보통 1000까지 허용)
        start : int, default 1
            시작 인덱스(1-based)
        end : Optional[int]
            끝 인덱스(포함). 지정하면 해당 구간까지만 수집
        max_rows : Optional[int]
            전체 수집 상한(예: 샘플만 뽑고 싶을 때)
        pause_sec : float, default 0.0
            페이지간 대기(레이트 리밋 회피용)
        verbose : bool, default False
            진행상황 출력 여부
        """
        if page_size <= 0:
            raise ValueError("page_size는 양의 정수여야 합니다.")

        # 1페이지 먼저 호출하여 total_count 파악
        first_end = start + page_size - 1 if end is None else min(end, start + page_size - 1)
        url = self._build_url(service_name, start, first_end)
        root = self._fetch_xml_root(url)

        total_count = self._get_list_total_count(root)  # 없을 수도 있음
        first_batch = self._xml_to_records(root)
        records: List[Dict[str, Any]] = []
        records.extend(first_batch)

        # 전체 목표량 계산
        if end is not None:
            target_total = end - start + 1
        elif total_count is not None:
            target_total = max(total_count - (start - 1), 0)
        else:
            # total_count가 없다면, 계속 긁되 '빈 페이지' 나오면 종료
            target_total = None

        if verbose:
            if total_count is not None:
                print(f"[INFO] list_total_count = {total_count}")
            print(f"[INFO] fetched {len(first_batch)} rows (start={start} ~ end={first_end})")

        # 다음 페이지부터 루프
        fetched = len(first_batch)
        next_start = first_end + 1

        while True:
            # 종료 조건 1: target_total(알고 있는 총량)에 도달
            if target_total is not None and fetched >= target_total:
                break

            # 종료 조건 2: end(명시된 구간 끝)에 도달
            if end is not None and next_start > end:
                break

            next_end = next_start + page_size - 1
            if end is not None:
                next_end = min(next_end, end)

            url = self._build_url(service_name, next_start, next_end)
            root = self._fetch_xml_root(url)
            batch = self._xml_to_records(root)

            if verbose:
                print(f"[INFO] fetched {len(batch)} rows (start={next_start} ~ end={next_end})")

            # 종료 조건 3: 더 이상 데이터가 안 나옴 (total_count를 못 얻은 경우 유용)
            if not batch:
                break

            records.extend(batch)
            fetched += len(batch)

            # 종료 조건 4: max_rows 상한
            if max_rows is not None and fetched >= max_rows:
                if verbose:
                    print(f"[INFO] reached max_rows={max_rows}, stop.")
                break

            # 다음 루프 준비
            next_start = next_end + 1

        # max_rows로 잘라내기
        if max_rows is not None and len(records) > max_rows:
            records = records[:max_rows]

        return pd.DataFrame(records)

data_seoul_parser = DataSeoulOpenAPIParser(api_key)
# ---------- end dataseoulopenapiparser ----------

# ----
# VworldOpenAPIParser
gpstoutm = Python3Script()  # -> out, gps_to_utm
# ---------- gpstoutm: Python ----------
from math import sin, cos, tan, pi, sqrt


RADIANS_PER_DEGREE = pi/180.0
DEGREES_PER_RADIAN = 180.0/pi

WGS84_A =  6378137.0
WGS84_B =  6356752.31424518
WGS84_F =  0.0033528107
WGS84_E =  0.0818191908
WGS84_EP = 0.0820944379

UTM_K0 =   0.9996
UTM_FE =   500000.0
UTM_FN_N = 0.0
UTM_FN_S = 10000000.0
UTM_E2 =   (WGS84_E*WGS84_E)
UTM_E4 =   (UTM_E2*UTM_E2)
UTM_E6 =   (UTM_E4*UTM_E2)
UTM_EP2 =  (UTM_E2/(1-UTM_E2))

class GPStoUTM(object):
    def __init__(self, **kwargs):
        pass

    def UTM(self, lat, lon):
        '''
        Gets the UTM coordinate without the letter and number.
        '''
        self.m0 = (1 - UTM_E2/4 - 3*UTM_E4/64 - 5*UTM_E6/256)
        self.m1 = -(3*UTM_E2/8 + 3*UTM_E4/32 + 45*UTM_E6/1024)
        self.m2 = (15*UTM_E4/256 + 45*UTM_E6/1024)
        self.m3 = -(35*UTM_E6/3072)

        if lon > 0:
            self.cm = int(lon) - (int(lon) % 6) + 3
        else:
            self.cm = int(lon) - (int(lon) % 6) - 3

        self.rlat = lat * RADIANS_PER_DEGREE
        self.rlon = lon * RADIANS_PER_DEGREE
        self.rlon0 = self.cm * RADIANS_PER_DEGREE

        self.slat = sin(self.rlat)
        self.clat = cos(self.rlat)
        self.tlat = tan(self.rlat)

        if lat > 0:
            self.fn = UTM_FN_N
        else:
            self.fn = UTM_FN_S

        self.T = self.tlat*self.tlat
        self.C = UTM_EP2 * self.clat * self.clat
        self.A = (self.rlon - self.rlon0) * self.clat
        self.M = WGS84_A * (self.m0*self.rlat + self.m1*sin(2*self.rlat) + \
            self.m2*sin(4*self.rlat) + self.m3*sin(6*self.rlat))
        self.V = WGS84_A / sqrt(1 - UTM_E2 * self.slat * self.slat)

        self.x = UTM_FE + UTM_K0 * self.V * (self.A + (1-self.T+self.C)\
            *pow(self.A, 3)/6 +(5-18*self.T+self.T*self.T+72*self.C-58*UTM_EP2)\
            *pow(self.A, 5)/120)

        self.y = self.fn + UTM_K0 * (self.M + self.V * self.tlat * \
            (self.A*self.A/2 + (5-self.T+9*self.C+4*self.C*self.C)* \
            pow(self.A, 4)/24 + ((61-58*self.T+self.T*self.T+600*self.C-\
            330*UTM_EP2) * pow(self.A, 6)/720)))

        return (self.x, self.y)

    def UTMLetterDesignator(self, Lat):
        '''
        Gets the UTM letter only.
        '''
        self.LetterDesignator = 'Z'
        if ((84 >= Lat) and (Lat >= 72)):
            self.LetterDesignator = 'X'
        elif ((72 > Lat) and (Lat >= 64)):
            self.LetterDesignator = 'W'
        elif ((64 > Lat) and (Lat >= 56)):
            self.LetterDesignator = 'V'
        elif ((56 > Lat) and (Lat >= 48)):
            self.LetterDesignator = 'U'
        elif ((48 > Lat) and (Lat >= 40)):
            self.LetterDesignator = 'T'
        elif ((40 > Lat) and (Lat >= 32)):
            self.LetterDesignator = 'S'
        elif ((32 > Lat) and (Lat >= 24)):
            self.LetterDesignator = 'R'
        elif ((24 > Lat) and (Lat >= 16)):
            self.LetterDesignator = 'Q'
        elif ((16 > Lat) and (Lat >= 8)):
            self.LetterDesignator = 'P'
        elif (( 8 > Lat) and (Lat >= 0)):
            self.LetterDesignator = 'N'
        elif (( 0 > Lat) and (Lat >= -8)):
            self.LetterDesignator = 'M'
        elif ((-8 > Lat) and (Lat >= -16)):
            self.LetterDesignator = 'L'
        elif ((-16 > Lat) and (Lat >= -24)):
            self.LetterDesignator = 'K'
        elif ((-24 > Lat) and (Lat >= -32)):
            self.LetterDesignator = 'J'
        elif ((-32 > Lat) and (Lat >= -40)):
            self.LetterDesignator = 'H'
        elif ((-40 > Lat) and (Lat >= -48)):
            self.LetterDesignator = 'G'
        elif ((-48 > Lat) and (Lat >= -56)):
            self.LetterDesignator = 'F'
        elif ((-56 > Lat) and (Lat >= -64)):
            self.LetterDesignator = 'E'
        elif ((-64 > Lat) and (Lat >= -72)):
            self.LetterDesignator = 'D'
        elif ((-72 > Lat) and (Lat >= -80)):
            self.LetterDesignator = 'C'
        return self.LetterDesignator

    def LLtoUTM(self, Lat, Long):
        '''
        Gets the UTM coordinate with the letter and number as inputs also.
        '''
        self.a = WGS84_A;
        self.eccSquared = UTM_E2;
        self.k0 = UTM_K0;

        self.LongTemp = (Long+180)-int((Long+180)/360)*360-180

        self.LatRad = Lat * RADIANS_PER_DEGREE
        self.LongRad = self.LongTemp * RADIANS_PER_DEGREE

        self.ZoneNumber = int((self.LongTemp+180)/6) + 1

        self.LongOrigin = (self.ZoneNumber-1)*6 - 180 + 3
        self.LongOriginRad = self.LongOrigin * RADIANS_PER_DEGREE

        self.eccPrimeSquared = (self.eccSquared)/(1-self.eccSquared);

        self.N = self.a/sqrt(1-self.eccSquared*sin(self.LatRad)*\
            sin(self.LatRad));
        self.T = tan(self.LatRad)*tan(self.LatRad);
        self.C = self.eccPrimeSquared*cos(self.LatRad)*cos(self.LatRad);
        self.A = cos(self.LatRad)*(self.LongRad-self.LongOriginRad);

        self.M = self.a*((1 - self.eccSquared/4 -\
            3*self.eccSquared*self.eccSquared/64 -\
            5*self.eccSquared*self.eccSquared*self.eccSquared/256) * \
            self.LatRad - (3*self.eccSquared/8 + 3*self.eccSquared*\
            self.eccSquared/32 +45*self.eccSquared*self.eccSquared*\
            self.eccSquared/1024)*sin(2*self.LatRad) + (15*self.eccSquared*\
            self.eccSquared/256 + 45*self.eccSquared*self.eccSquared*\
            self.eccSquared/1024)*sin(4*self.LatRad) - (35*self.eccSquared*\
            self.eccSquared*self.eccSquared/3072)*sin(6*self.LatRad))

        self.UTMEasting = float(self.k0*self.N*(self.A+(1-self.T+self.C)*\
            self.A**3/6 + (5-18*self.T+self.T*self.T+72*self.C-58*\
            self.eccPrimeSquared)*self.A**4/120) + 500000.0)

        self.UTMNorthing = float(self.k0*(self.M+self.N*tan(self.LatRad)\
            *(self.A**2/2+(5-self.T+9*self.C+4*self.C**2)*self.A**4/24 + (61-58\
            *self.T+self.T**2+600*self.C-330*self.eccPrimeSquared)\
            *self.A**6/720)))

        if (Lat < 0):
            self.UTMNorthing += 10000000.0

        return (self.UTMEasting, self.UTMNorthing)

    def UTMtoLL(self, UTMNorthing, UTMEasting, UTMNumber, UTMLetter):
        '''
        Gets the latitude and longitude with the UTM letter and number.
        '''
        self.ZoneNumber = int(UTMNumber)
        self.ZoneLetter = UTMLetter

        self.k0 = UTM_K0
        self.a = WGS84_A
        self.eccSquared = UTM_E2
        self.e1 = (1-sqrt(1-self.eccSquared))/(1+sqrt(1-self.eccSquared))

        self.x = UTMEasting - 500000.0
        self.y = UTMNorthing

        if self.ZoneLetter < 'N':
            self.y -= 10000000.0

        self.LongOrigin = (self.ZoneNumber - 1)*6 - 180 + 3
        self.eccPrimeSquared = (self.eccSquared)/(1-self.eccSquared)

        self.M = self.y/self.k0;
        self.mu = self.M/(self.a*(1-self.eccSquared/4-3*self.eccSquared**2/64\
            -5*self.eccSquared**3/256))

        self.phi1Rad = self.mu + ((3*self.e1/2-27*self.e1**3/32)*sin(2*self.mu)\
            + (21*self.e1**2/16-55*self.e1**4/32)*sin(4*self.mu)\
            + (151*self.e1**3/96)*sin(6*self.mu))

        self.N1 = self.a/sqrt(1-self.eccSquared*sin(self.phi1Rad)**2)
        self.T1 = tan(self.phi1Rad)**2
        self.C1 = self.eccPrimeSquared*cos(self.phi1Rad)**2
        self.R1 = self.a*(1-self.eccSquared)/pow(1-self.eccSquared*sin(self.phi1Rad)**2, 1.5)
        self.D = self.x/(self.N1*self.k0)

        self.Lat = self.phi1Rad - ((self.N1*tan(self.phi1Rad)/self.R1)\
            *(self.D**2/2-(5+3*self.T1+10*self.C1-4*self.C1**2-9\
            *self.eccPrimeSquared)*self.D**4/24+(61+90*self.T1+298*self.C1\
            +45*self.T1**2-252*self.eccPrimeSquared-3*self.C1**2)\
            *self.D**6/720))

        self.Lat = self.Lat * DEGREES_PER_RADIAN

        self.Long = ((self.D-(1+2*self.T1+self.C1)*self.D**3/6+(5-2*self.C1\
            +28*self.T1-3*self.C1**2+8*self.eccPrimeSquared+24*self.T1**2)\
            *self.D**5/120)/cos(self.phi1Rad))

        self.Long = self.LongOrigin + self.Long * DEGREES_PER_RADIAN

        return (self.Lat, self.Long)

gps_to_utm = GPStoUTM()
# ---------- end gpstoutm ----------
vworldopenapiparser = Python3Script(api_key="vworld 개인 api key", gps_to_utm=gpstoutm.gps_to_utm)  # -> out, vworld_parser
# ---------- vworldopenapiparser: Python ----------
#! python3
# venv: JAH
# r: requests, pandas

import requests
import pandas as pd
from typing import Optional
import Rhino.Geometry as rg

class VworldOpenAPIParser:
    """
    JSON -> pd.DataFrame
    with vworld.kr OPEN API
    """
    def __init__(self, api_key: str):
        self.api_key = api_key
        self.wfs_url = "https://api.vworld.kr/req/wfs?key="
        self.geocoder_url = "https://api.vworld.kr/req/address"
        self.wfs_params = {
            "SERVICE": "WFS",
            "REQUEST": "GetFeature",
            "TYPENAME": "lt_c_ademd_info",
            "BBOX": f"{0},{0},{1},{1}",
            "VERSION": "2.0.0",
            "COUNT": "1000",
            "STARTINDEX": "0",
            "SRSNAME": "EPSG:4326",
            "OUTPUT": "application/json",
            "EXCEPTIONS": "text/xml",
            "KEY": self.api_key
        }
        self.geocoder_params = {
            "service" : "address",
            "request" : "getcoord",
            "crs" : "EPSG:4326",
            "address": None,
            "format" : "json",
            "type" : "road",
            "key" : self.api_key
        }

    def get_legal_district_by_addresses(self, address1: str, address2: str)-> pd.DataFrame:
        res = []
        data = self._get_full_row_data(address1=address1, address2=address2)
        for datum in data:
            for feature in datum["features"]:
                coords = feature["geometry"]["coordinates"]
                feat_name = feature["properties"]["full_nm"]
                if "서울"in feat_name:
                    points = []
                    for coord in coords[0][0]:
                        x, y = gps_to_utm.LLtoUTM(coord[1], coord[0])
                        try:
                            pt = rg.Point3d(x, y, 0)
                            points.append(pt)
                        except:
                            ValueError("Coordinate conversion error")
                    try:
                        polyline = rg.Polyline(points)
                        if not polyline.IsClosed:
                            polyline.Add(polyline[0])
                        polyline_curve = rg.PolylineCurve(polyline)
                        amp = rg.AreaMassProperties.Compute(polyline_curve)
                        row = {
                            "legald_cd": feature["properties"]["emd_cd"],
                            "name": feat_name,
                            "geometry": polyline_curve,
                            "area": amp.Area,
                            "centroid": amp.Centroid,
                            }
                        res.append(row)
                    except:
                        ValueError("Geometry creation error")
        return pd.DataFrame(res)

    def _get_wfs_url(self, params: dict):
        query_string = "&".join([f"{key}={value}" for key, value in params.items()])
        full_url = f"{self.wfs_url}?{query_string}"
        return full_url

    def _get_geocoder_url(self, params: dict):
        query_string = "&".join([f"{key}={value}" for key, value in params.items()])
        full_url = f"{self.geocoder_url}?{query_string}"
        return full_url

    def _fetch_json(self, url: str):
        response = requests.get(url)
        if response.status_code != 200:
            raise ValueError(f"HTTP Error {response.status_code} for URL: {url}")

        # JSON이 아닐 경우 대비
        try:
            return response.json()
        except ValueError:
            print("===== RAW RESPONSE =====")
            print(response.text[:500])
            raise ValueError("Invalid JSON returned from server")

    def _address_to_coord(self, address: str):
        params = self.geocoder_params.copy()
        params["address"] = address
        url = self._get_geocoder_url(params)
        data = self._fetch_json(url)
        x_coord = data['response']['result']['point']['x']
        y_coord = data['response']['result']['point']['y']
        return tuple(map(float, [x_coord, y_coord]))

    def _get_district_boundary_data(self, start_index, count, ymin, xmin, ymax, xmax):
        params = self.wfs_params.copy()
        params["STARTINDEX"] = str(start_index)
        params["COUNT"] = str(count)
        params["BBOX"] = f"{xmin},{ymin},{xmax},{ymax}"
        url = self._get_wfs_url(params)
        data = self._fetch_json(url)
        return data

    def _get_full_row_data(
        self,
        address1: str,
        address2: str,
        batch_size: int = 1000,
        start: int = 0,
        end: Optional[int] = 1000,
        max_rows: Optional[int] = None,
        verbose: bool = False,
    ):
        first_end = start + batch_size - 1 if end is None else min(end, start + batch_size - 1)
        xmin, ymin = self._address_to_coord(address1)
        xmax, ymax = self._address_to_coord(address2)
        first_batch = self._get_district_boundary_data(start, batch_size, ymin, xmin, ymax, xmax)
        records = []
        records.append(first_batch)

        if verbose:
            print(f"[INFO] fetched {len(first_batch)} rows (start={start} ~ end={first_end})")

        # 다음 페이지부터 루프
        fetched = len(first_batch)
        next_start = first_end + 1

        while True:
            # 종료 조건 1: end(명시된 구간 끝)에 도달
            if end is not None and next_start > end:
                break

            next_end = next_start + batch_size - 1
            if end is not None:
                next_end = min(next_end, end)

            batch = self._get_district_boundary_data(next_start, batch_size, ymin, xmin, ymax, xmax)

            if verbose:
                print(f"[INFO] fetched {len(batch)} rows (start={next_start} ~ end={next_end})")

            # 종료 조건 2: 더 이상 데이터가 안 나옴 (total_count를 못 얻은 경우 유용)
            if not batch:
                break

            records.append(batch)
            fetched += len(batch)

            # 종료 조건 3: max_rows 상한
            if max_rows is not None and fetched >= max_rows:
                if verbose:
                    print(f"[INFO] reached max_rows={max_rows}, stop.")
                break

            # 다음 루프 준비
            next_start = next_end + 1
        return records

vworld_parser = VworldOpenAPIParser(api_key)
# ---------- end vworldopenapiparser ----------

falsestart = LBFalseStartToggle(False)

# ----
# Solver
solver = Python3Script(
    Run=falsestart,
    data_seoul_parser=dataseoulopenapiparser.data_seoul_parser,
    vworld_parser=vworldopenapiparser.vworld_parser,
    file_path="KIKmix.20240201 파일 위치")  # -> out, geometries, centroids, avg_incomes
# ---------- solver: Python ----------
#! python3
# venv: JAH
# r: pandas, openpyxl

import pandas as pd
import openpyxl

# 유틸 함수
def get_mapping_df(file_path) -> pd.DataFrame:
    """행정동 코드를 법정동 코드로 매핑하는 데이터프레임 반환"""
    df = pd.read_excel(file_path, engine='openpyxl')
    df = df[df["시도명"].str.startswith("서울", na=False)]
    mapping = {"행정동코드": "adstrd_cd", "법정동코드": "legald_cd"}
    df_grouped = df[list(mapping.keys())]
    df_renamed = df_grouped.rename(columns=mapping)
    cols = list(mapping.values())
    df_renamed[cols] = df_renamed[cols].astype(str).apply(lambda col: col.str[:-2])
    return df_renamed

# 1. API 키 설정

# 2. Parser 준비

# 3. 데이터 불러오기
if Run:
    # legal district (기준 df)
    address1 = "인천 남동구 도림동"
    address2 = "경기 남양주시 해밀예당1로 272"

    legald_df = vworld_parser.get_legal_district_by_addresses(address1, address2)
    legald_df = legald_df[legald_df["area"] > 100]
    print("법정동 데이터프레임:")
    print(legald_df.head())

    # avg_income
    avg_income_df = data_seoul_parser.to_dataframe_full("VwsmAdstrdNcmCnsmpW")
    print("평균 소득 데이터프레임:")
    avg_income_df.columns = (
        avg_income_df.columns.str.strip().str.lower()
    )
    print(avg_income_df.head())
    avg_income_df["mt_avrg_income_amt"] = pd.to_numeric(
        avg_income_df["mt_avrg_income_amt"],
        errors="coerce"
    )
    mean = avg_income_df["mt_avrg_income_amt"].mean()
    avg_income_by_adstrd = avg_income_df.groupby("adstrd_cd")["mt_avrg_income_amt"].mean().reset_index()
    avg_income_by_adstrd["mt_avrg_income_amt"].fillna(mean, inplace=True)

    # 4. legal - avg_income 매핑 준비
    mapping_df = get_mapping_df(file_path)
    print("매핑 데이터프레임:")
    print(mapping_df.head())

    # 5. mapping_df에 avg_income 붙이기 (adstrd_cd 기준)
    mapping_with_income = mapping_df.merge(
        avg_income_by_adstrd,
        on="adstrd_cd",
        how="left",
    )
    print("매핑된 평균 소득 데이터프레임:")
    print(mapping_with_income.head())

    # 6. legald_cd 기준으로 평균 내기
    avg_income_by_legald = (
        mapping_with_income
        .groupby("legald_cd", as_index=False)["mt_avrg_income_amt"]
        .mean()
    )
    print("법정동 코드별 평균 소득 데이터프레임:")
    print(avg_income_by_legald.head())

    # 7. legal df에 avg_income 붙이기
    legald_with_avg_income = legald_df.merge(
        avg_income_by_legald,
        on="legald_cd",
        how="left",
    )
    legald_with_avg_income["mt_avrg_income_amt"].fillna(mean, inplace=True)

    print("법정동 데이터프레임에 평균 소득 추가:")
    print(legald_with_avg_income)

    # 8. 결과 활용
    geometries = legald_with_avg_income["geometry"].to_list()
    centroids = legald_with_avg_income["centroid"].to_list()
    avg_incomes = legald_with_avg_income["mt_avrg_income_amt"].to_list()
# ---------- end solver ----------

panel_2 = Panel(solver.out)
