# Grasshopper definition weighted_overlay_기본 골자.gh (Grasshopper 1.0.8)
# plug-ins: RhinoCodePluginGH

행정동 = Panel("lt_c_ademd_info")
py3 = Python3Script(
    Run=Toggle(True),
    address1="인천 남동구 도림동",
    address2="경기 남양주시 해밀예당1로 272",
    typeCol=행정동,
    vworld_key="5C3E2796-9BD1-3BC1-A884-5BD7AE4D360E")  # -> out, info, shape, shape_name, shape_code; inputs address1: list
# ---------- py3: Python ----------
import rhinoscriptsyntax as rs
import Rhino.Geometry as rg
from System.Net import HttpWebRequest, WebRequest
from System.IO import StreamReader
import json
import clr
#from System.Web.Script.Serialization import JavaScriptSerializer
vworld_key = vworld_key
from math import sin, cos, tan, pi, sqrt
import re

RADIANS_PER_DEGREE = pi/180.0
DEGREES_PER_RADIAN = 180.0/pi

WGS84_A =  6378137.0
WGS84_B =  6356752.31424518
WGS84_F =  0.0033528107
WGS84_E =  0.0818191908
WGS84_EP = 0.0820944379

UTM_K0 =   0.9996
UTM_FE =   500000.0
UTM_FN_N = 0.0
UTM_FN_S = 10000000.0
UTM_E2 =   (WGS84_E*WGS84_E)
UTM_E4 =   (UTM_E2*UTM_E2)
UTM_E6 =   (UTM_E4*UTM_E2)
UTM_EP2 =  (UTM_E2/(1-UTM_E2))

class GPStoUTM(object):
    def __init__(self, **kwargs):
        pass

    def UTM(self, lat, lon):
        '''
        Gets the UTM coordinate without the letter and number.
        '''
        self.m0 = (1 - UTM_E2/4 - 3*UTM_E4/64 - 5*UTM_E6/256)
        self.m1 = -(3*UTM_E2/8 + 3*UTM_E4/32 + 45*UTM_E6/1024)
        self.m2 = (15*UTM_E4/256 + 45*UTM_E6/1024)
        self.m3 = -(35*UTM_E6/3072)

        if lon > 0:
            self.cm = int(lon) - (int(lon) % 6) + 3
        else:
            self.cm = int(lon) - (int(lon) % 6) - 3

        self.rlat = lat * RADIANS_PER_DEGREE
        self.rlon = lon * RADIANS_PER_DEGREE
        self.rlon0 = self.cm * RADIANS_PER_DEGREE

        self.slat = sin(self.rlat)
        self.clat = cos(self.rlat)
        self.tlat = tan(self.rlat)

        if lat > 0:
            self.fn = UTM_FN_N
        else:
            self.fn = UTM_FN_S

        self.T = self.tlat*self.tlat
        self.C = UTM_EP2 * self.clat * self.clat
        self.A = (self.rlon - self.rlon0) * self.clat
        self.M = WGS84_A * (self.m0*self.rlat + self.m1*sin(2*self.rlat) + \
            self.m2*sin(4*self.rlat) + self.m3*sin(6*self.rlat))
        self.V = WGS84_A / sqrt(1 - UTM_E2 * self.slat * self.slat)

        self.x = UTM_FE + UTM_K0 * self.V * (self.A + (1-self.T+self.C)\
            *pow(self.A, 3)/6 +(5-18*self.T+self.T*self.T+72*self.C-58*UTM_EP2)\
            *pow(self.A, 5)/120)

        self.y = self.fn + UTM_K0 * (self.M + self.V * self.tlat * \
            (self.A*self.A/2 + (5-self.T+9*self.C+4*self.C*self.C)* \
            pow(self.A, 4)/24 + ((61-58*self.T+self.T*self.T+600*self.C-\
            330*UTM_EP2) * pow(self.A, 6)/720)))

        return (self.x, self.y)

    def UTMLetterDesignator(self, Lat):
        '''
        Gets the UTM letter only.
        '''
        self.LetterDesignator = 'Z'
        if ((84 >= Lat) and (Lat >= 72)):
            self.LetterDesignator = 'X'
        elif ((72 > Lat) and (Lat >= 64)):
            self.LetterDesignator = 'W'
        elif ((64 > Lat) and (Lat >= 56)):
            self.LetterDesignator = 'V'
        elif ((56 > Lat) and (Lat >= 48)):
            self.LetterDesignator = 'U'
        elif ((48 > Lat) and (Lat >= 40)):
            self.LetterDesignator = 'T'
        elif ((40 > Lat) and (Lat >= 32)):
            self.LetterDesignator = 'S'
        elif ((32 > Lat) and (Lat >= 24)):
            self.LetterDesignator = 'R'
        elif ((24 > Lat) and (Lat >= 16)):
            self.LetterDesignator = 'Q'
        elif ((16 > Lat) and (Lat >= 8)):
            self.LetterDesignator = 'P'
        elif (( 8 > Lat) and (Lat >= 0)):
            self.LetterDesignator = 'N'
        elif (( 0 > Lat) and (Lat >= -8)):
            self.LetterDesignator = 'M'
        elif ((-8 > Lat) and (Lat >= -16)):
            self.LetterDesignator = 'L'
        elif ((-16 > Lat) and (Lat >= -24)):
            self.LetterDesignator = 'K'
        elif ((-24 > Lat) and (Lat >= -32)):
            self.LetterDesignator = 'J'
        elif ((-32 > Lat) and (Lat >= -40)):
            self.LetterDesignator = 'H'
        elif ((-40 > Lat) and (Lat >= -48)):
            self.LetterDesignator = 'G'
        elif ((-48 > Lat) and (Lat >= -56)):
            self.LetterDesignator = 'F'
        elif ((-56 > Lat) and (Lat >= -64)):
            self.LetterDesignator = 'E'
        elif ((-64 > Lat) and (Lat >= -72)):
            self.LetterDesignator = 'D'
        elif ((-72 > Lat) and (Lat >= -80)):
            self.LetterDesignator = 'C'
        return self.LetterDesignator

    def LLtoUTM(self, Lat, Long):
        '''
        Gets the UTM coordinate with the letter and number as inputs also.
        '''
        self.a = WGS84_A;
        self.eccSquared = UTM_E2;
        self.k0 = UTM_K0;

        self.LongTemp = (Long+180)-int((Long+180)/360)*360-180

        self.LatRad = Lat * RADIANS_PER_DEGREE
        self.LongRad = self.LongTemp * RADIANS_PER_DEGREE

        self.ZoneNumber = int((self.LongTemp+180)/6) + 1

        self.LongOrigin = (self.ZoneNumber-1)*6 - 180 + 3
        self.LongOriginRad = self.LongOrigin * RADIANS_PER_DEGREE

        self.eccPrimeSquared = (self.eccSquared)/(1-self.eccSquared);

        self.N = self.a/sqrt(1-self.eccSquared*sin(self.LatRad)*\
            sin(self.LatRad));
        self.T = tan(self.LatRad)*tan(self.LatRad);
        self.C = self.eccPrimeSquared*cos(self.LatRad)*cos(self.LatRad);
        self.A = cos(self.LatRad)*(self.LongRad-self.LongOriginRad);

        self.M = self.a*((1 - self.eccSquared/4 -\
            3*self.eccSquared*self.eccSquared/64 -\
            5*self.eccSquared*self.eccSquared*self.eccSquared/256) * \
            self.LatRad - (3*self.eccSquared/8 + 3*self.eccSquared*\
            self.eccSquared/32 +45*self.eccSquared*self.eccSquared*\
            self.eccSquared/1024)*sin(2*self.LatRad) + (15*self.eccSquared*\
            self.eccSquared/256 + 45*self.eccSquared*self.eccSquared*\
            self.eccSquared/1024)*sin(4*self.LatRad) - (35*self.eccSquared*\
            self.eccSquared*self.eccSquared/3072)*sin(6*self.LatRad))

        self.UTMEasting = float(self.k0*self.N*(self.A+(1-self.T+self.C)*\
            self.A**3/6 + (5-18*self.T+self.T*self.T+72*self.C-58*\
            self.eccPrimeSquared)*self.A**4/120) + 500000.0)

        self.UTMNorthing = float(self.k0*(self.M+self.N*tan(self.LatRad)\
            *(self.A**2/2+(5-self.T+9*self.C+4*self.C**2)*self.A**4/24 + (61-58\
            *self.T+self.T**2+600*self.C-330*self.eccPrimeSquared)\
            *self.A**6/720)))

        if (Lat < 0):
            self.UTMNorthing += 10000000.0

        return (self.UTMEasting, self.UTMNorthing)

    def UTMtoLL(self, UTMNorthing, UTMEasting, UTMNumber, UTMLetter):
        '''
        Gets the latitude and longitude with the UTM letter and number.
        '''
        self.ZoneNumber = int(UTMNumber)
        self.ZoneLetter = UTMLetter

        self.k0 = UTM_K0
        self.a = WGS84_A
        self.eccSquared = UTM_E2
        self.e1 = (1-sqrt(1-self.eccSquared))/(1+sqrt(1-self.eccSquared))

        self.x = UTMEasting - 500000.0
        self.y = UTMNorthing

        if self.ZoneLetter < 'N':
            self.y -= 10000000.0

        self.LongOrigin = (self.ZoneNumber - 1)*6 - 180 + 3
        self.eccPrimeSquared = (self.eccSquared)/(1-self.eccSquared)

        self.M = self.y/self.k0;
        self.mu = self.M/(self.a*(1-self.eccSquared/4-3*self.eccSquared**2/64\
            -5*self.eccSquared**3/256))

        self.phi1Rad = self.mu + ((3*self.e1/2-27*self.e1**3/32)*sin(2*self.mu)\
            + (21*self.e1**2/16-55*self.e1**4/32)*sin(4*self.mu)\
            + (151*self.e1**3/96)*sin(6*self.mu))

        self.N1 = self.a/sqrt(1-self.eccSquared*sin(self.phi1Rad)**2)
        self.T1 = tan(self.phi1Rad)**2
        self.C1 = self.eccPrimeSquared*cos(self.phi1Rad)**2
        self.R1 = self.a*(1-self.eccSquared)/pow(1-self.eccSquared*sin(self.phi1Rad)**2, 1.5)
        self.D = self.x/(self.N1*self.k0)

        self.Lat = self.phi1Rad - ((self.N1*tan(self.phi1Rad)/self.R1)\
            *(self.D**2/2-(5+3*self.T1+10*self.C1-4*self.C1**2-9\
            *self.eccPrimeSquared)*self.D**4/24+(61+90*self.T1+298*self.C1\
            +45*self.T1**2-252*self.eccPrimeSquared-3*self.C1**2)\
            *self.D**6/720))

        self.Lat = self.Lat * DEGREES_PER_RADIAN

        self.Long = ((self.D-(1+2*self.T1+self.C1)*self.D**3/6+(5-2*self.C1\
            +28*self.T1-3*self.C1**2+8*self.eccPrimeSquared+24*self.T1**2)\
            *self.D**5/120)/cos(self.phi1Rad))

        self.Long = self.LongOrigin + self.Long * DEGREES_PER_RADIAN

        return (self.Lat, self.Long)
        
gps = GPStoUTM()

def read(apiurl) : 
    request = WebRequest.Create(apiurl)
    request.Method = "GET"
    response = request.GetResponse()
    stream = response.GetResponseStream()
    reader = StreamReader(stream)
    responseText = reader.ReadToEnd()
    return json.loads(responseText)

def terrain(ymin,xmin,ymax,xmax, typeCol, vworld_key) :
    params = {
        "SERVICE": "WFS",
        "REQUEST": "GetFeature",
        "TYPENAME": typeCol,
        "BBOX": "{0},{1},{2},{3}".format(ymin, xmin, ymax, xmax),
        "VERSION": "1.1.0",
        "MAXFEATURES": "1000",
        "SRSNAME": "EPSG:4326",
        "OUTPUT": "application/json",
        "EXCEPTIONS": "text/xml",
        "KEY": vworld_key
    }

    apiurl = "https://api.vworld.kr/req/wfs"

    # params 딕셔너리를 URL 쿼리 스트링으로 변환
    query_string = "&".join(["{0}={1}".format(key, value) for key, value in params.items()])
    full_url = "{0}?{1}".format(apiurl,query_string)
    data = read(full_url)
    return data


def AddressToCoord(input_address, vworld_key):
    apiurl = "https://api.vworld.kr/req/address?service=address&request=getcoord&crs=EPSG:4326&address={0}&format=json&type=road&key={1}".format(input_address, vworld_key)
    request = WebRequest.Create(apiurl)
    request.Method = "GET"
    response = request.GetResponse()
    stream = response.GetResponseStream()
    reader = StreamReader(stream)
    responseText = reader.ReadToEnd()
    response_data = json.loads(responseText)
    x_coord = response_data['response']['result']['point']['x']
    y_coord = response_data['response']['result']['point']['y']
    return float(x_coord), float(y_coord)
    
info = {}
select_type = []
select_type.append(typeCol)
dong_geom = []
dong_name = []
dong_code = []
nodata = []
nodataid = []



def remove_numbers(string):
    return re.sub(r'\d+', '', string)


if Run : 
    xmin, ymin = AddressToCoord(address1, vworld_key)
    xmax, ymax = AddressToCoord(address2, vworld_key)
    if(ymin > ymax) : ymin, ymax = ymax, ymin
    if(xmin > xmax) : xmin, xmax = xmax, xmin
    data = terrain(ymin, xmin, ymax, xmax, select_type[0], vworld_key)
    try: 
        info = data
        features = info["features"]
        for feature in features : 
            coords = feature['geometry']['coordinates']
            feat_name = feature['properties']['full_nm']
            print(feature)
            if "서울" in feat_name : 
                points = []
                for coord in coords[0][0] : 
                    try:
                        x, y = gps.LLtoUTM(coord[1], coord[0])
                        pt = rg.Point3d(x, y, 0)
                        points.append(pt)
                    except: continue
                try : 
                    polyline = rs.AddPolyline(points)
                    dong_geom.append(polyline)
                    dong_name.append(feat_name)
                    dong_code.append(feature['properties']['emd_cd'])
                except : pass
    except : pass

shape = dong_geom
shape_name = dong_name
shape_code = dong_code
# ---------- end py3 ----------
url = Python3Script(
    URL="http://openapi.seoul.go.kr:8088",
    api_key="707372594162726936364c44614e78",
    service="VwsmAdstrdNcmCnsmpW",
    area="POI041")  # -> out, a; inputs URL: String
# ---------- url: Python ----------
import rhinoscriptsyntax as rs
from System.Net import HttpWebRequest, WebRequest
from System.IO import StreamReader
import json
import clr
import xml.etree.ElementTree as ET

def read(apiurl) : 
    request = WebRequest.Create(apiurl)
    request.Method = "GET"
    response = request.GetResponse()
    stream = response.GetResponseStream()
    reader = StreamReader(stream)
    responseText = reader.ReadToEnd()
    return responseText

def parse_xml_recursive(element):
    """재귀적으로 XML 데이터를 파싱하여 딕셔너리로 반환."""
    data = {}
    for child in element:
        if len(child):  # 하위 태그가 있는 경우
            data[child.tag] = parse_xml_recursive(child)
        else:  # 하위 태그가 없는 경우
            data[child.tag] = child.text
    return data

def parse_xml_response(xml_response):
    """XML 응답을 루트로 시작해 파싱."""
    root = ET.fromstring(xml_response)  # XML 문자열을 ElementTree로 변환
    parsed_data = parse_xml_recursive(root)  # 재귀적으로 파싱
    return parsed_data
import json
from concurrent.futures import ThreadPoolExecutor
url = URL
key = api_key
service = service
area = area

all_data = []
start_index = 1
end_index = 1
total_count = 900

def fetch_data(index):
    # 각 인덱스마다 apiurl 생성 (여기서는 한 건씩 요청)
    apiurl = f"{url}/{key}/xml/{service}/{index}/{index}"
    response = read(apiurl)
    parsed_data = parse_xml_response(response)
    return json.dumps(parsed_data, ensure_ascii=False, indent=4)

# total_count 만큼 동시에 요청을 보냄 (예: 100건)
with ThreadPoolExecutor(max_workers=10) as executor:
    # executor.map은 입력 순서대로 결과를 반환합니다.
    all_data = list(executor.map(fetch_data, range(1, total_count+1)))

a = all_data

# while start_index <= total_count:
#     apiurl = f"{url}/{key}/xml/{service}/{start_index}/{end_index}"
#     response = read(apiurl)
#     parsed_data = parse_xml_response(response)
#     datum = json.dumps(parsed_data, ensure_ascii=False, indent=4)
#     all_data.append(datum)
#     # 필요한 부분만 all_data에 축적
#     # all_data.append(parsed_data)
#     # 다음 페이지로 이동
#     start_index += 1
#     end_index += 1

# a = all_data
# 결과 출력
# a = [json.dumps(datum, ensure_ascii=False, indent=4) for datum in all_data]
# print(a)
# ---------- end url ----------
url_2 = Python3Script(
    URL="http://openapi.seoul.go.kr:8088",
    api_key="707372594162726936364c44614e78",
    service="VwsmAdstrdNcmCnsmpW",
    area="POI041")  # -> out, a; inputs URL: String
# ---------- url_2: Python ----------
import clr
from System.Net import WebRequest, WebResponse
from System.IO import StreamReader
import System.Threading.Tasks as Tasks
from System import AsyncCallback, Func, IAsyncResult, Object, Array
import xml.etree.ElementTree as ET
import json

def process_response(response):
    try:
        stream = response.GetResponseStream()
        reader = StreamReader(stream)
        return reader.ReadToEnd()
    except Exception as e:
        print("Error processing response:", e)
        return None

def read_async(apiurl):
    request = WebRequest.Create(apiurl)
    request.Method = "GET"
    
    # 래핑 함수 정의
    def begin_get_response(callback, state):
        return request.BeginGetResponse(callback, state)
    
    def end_get_response(async_result):
        return request.EndGetResponse(async_result)
    
    # delegate로 변환
    beginDelegate = Func[AsyncCallback, Object, IAsyncResult](begin_get_response)
    endDelegate = Func[IAsyncResult, WebResponse](end_get_response)
    
    # Task[WebResponse] 생성 (비동기 HTTP 요청)
    responseTask = Tasks.Task[WebResponse].Factory.FromAsync(beginDelegate, endDelegate, None)
    
    # 응답 Task가 완료되면, 결과 (WebResponse)를 process_response로 처리하여 XML 문자열을 반환
    stringTask = responseTask.ContinueWith(lambda t: process_response(t.Result))
    return stringTask

def parse_xml_recursive(element):
    data = {}
    for child in element:
        child_data = parse_xml_recursive(child) if len(child) else child.text
        if child.tag in data:
            if not isinstance(data[child.tag], list):
                data[child.tag] = [data[child.tag]]
            data[child.tag].append(child_data)
        else:
            data[child.tag] = child_data
    return data

def parse_xml_response(xml_response):
    try:
        root = ET.fromstring(xml_response)
        return parse_xml_recursive(root)
    except Exception as e:
        print("XML parsing error:", e)
        return None

# --- 기본 변수 설정 (실제 값으로 대체) ---
url = URL
key = api_key
service = service

# 예시: 1건의 요청을 비동기로 처리 (동기 방식으로 호출 시 올바른 응답이 나온다면)
total_count = 1
tasks_list = []
for i in range(1, total_count + 1):
    apiurl = f"{url}/{key}/xml/{service}/{i}/{i}"
    tasks_list.append(read_async(apiurl))

# python 리스트를 .NET 배열로 변환
tasks_array = Array[Tasks.Task](tasks_list)
Tasks.Task.WaitAll(tasks_array)

all_data = []
for t in tasks_list:
    # Continuation Task의 결과로 XML 문자열을 받아옴.
    xml_response = t.GetAwaiter().GetResult()
    if xml_response is None:
        print("No response for one of the tasks, skipping...")
        continue
    parsed_data = parse_xml_response(xml_response)
    if parsed_data is None:
        print("Parsing failed for one response, skipping...")
        continue
    datum = json.dumps(parsed_data, ensure_ascii=False, indent=4)
    all_data.append(datum)

print(all_data)
# ---------- end url_2 ----------
area = Area(Geometry=py3.shape)  # -> Area, Centroid
larger = LargerThan(FirstNumber=area.Area, SecondNumber=Slider(100, range=0..100))  # -> LargerThan, OrEqualTo
path = FilePath("D:\Keon Chae\Programming Languages\Python\referred_files\KIKmix.20240201.xlsx")
panel = Panel(url.a)
dong_to_bub = Python3Script(path=path)  # -> out, df; inputs path: String
# ---------- dong_to_bub: Python ----------
# requirements: openpyxl
import locale
locale.setlocale(locale.LC_ALL, 'en_US.UTF-8')
import openpyxl
import pandas as pd
file_path = path  
df = pd.read_excel(file_path, engine='openpyxl')
df = df[df['시도명'].str.contains('서울특별시')]
df['address'] = df['시도명'] + ' ' + df['시군구명'] + ' ' + df['동리명']
df = df
# ---------- end dong_to_bub ----------
cull = CullPattern(List=py3.shape, CullPattern=larger.LargerThan)
cull_2 = CullPattern(List=py3.shape_code, CullPattern=larger.LargerThan)
py3_2 = Python3Script(df=dong_to_bub.df, shape_code=cull_2)  # -> out, result; inputs shape_code: list of String
# ---------- py3_2: Python ----------
import pandas as pd
from collections import defaultdict

# 데이터 로드
월평균소득 = pd.read_csv('D:/Keon Chae/Programming Languages/Python/referred_files/서울시 상권분석서비스(소득소비-행정동).csv', encoding="euckr")
average_income = 월평균소득.groupby('행정동_코드')['월_평균_소득_금액'].mean().reset_index()

# 앞에서 가지고 온 모든 서울시 법정동 코드
shape_code = list(map(lambda x: int(x + '00'), shape_code))
result = []

def hang(k):
    """법정동에 해당하는 행정동코드 리스트 반환"""
    h = df['행정동코드'][df['법정동코드'] == k]
    return h

# 기본값 (평균 소득)
default_value = average_income['월_평균_소득_금액'].mean()

for i in shape_code:
    k = list(set(hang(i)))  # 법정동 코드에 해당하는 행정동 코드 리스트
    pop = 0  # 현재 법정동의 평균 소득 초기화
    count = 0  # 유효한 행정동 데이터의 개수
    for j in k:
        j = str(j)[:-2]  # 뒤의 "00" 제거
        j = int(j)  # 정수형으로 변환

        # 행정동 코드에 해당하는 소득값 가져오기
        ret = average_income['월_평균_소득_금액'][average_income['행정동_코드'] == j]

        if ret.empty:
            print(f"행정동 코드 {j}에 해당하는 데이터가 없습니다.")
            continue
        else:
            pop += ret.values[0]  # 소득값 합산
            count += 1  # 유효한 데이터 카운트 증가
    
    # 평균 계산 (유효한 데이터가 있을 경우만)
    if count > 0:
        pop /= count
    else:
        pop = default_value  # 데이터가 없는 경우 기본값 사용
    
    result.append(pop)

print("법정동 코드별 월 평균 소득:", result)
# ---------- end py3_2 ----------
bnd = Bounds(Numbers=py3_2.result)
dom = ConstructDomain(DomainStart=Slider(100, range=0..1000), DomainEnd=Slider(10000, range=0..10000))
remap = RemapNumbers(Value=py3_2.result, Source=bnd, Target=dom)  # -> Mapped, Clipped
cull_3 = CullPattern(List=area.Centroid, CullPattern=larger.LargerThan)
Z = UnitZ(Factor=remap.Mapped)
move = Move(Geometry=cull_3, Motion=Z)  # -> Geometry, Transform
extr = Extrude(Base=cull, Direction=Z)
cap = CapHoles()
