# Grasshopper definition weighted_overlay_월평균소득.gh (Grasshopper 1.0.8)
# plug-ins: RhinoCodePluginGH

path = FilePath("C:\Users\BaekInchan\Downloads\jscode20240208\KIKmix.20240208.xlsx")  # disabled
dong_to_bub = Python3Script(path=path)  # -> out, df; inputs path: String; disabled
# ---------- dong_to_bub: Python ----------
# requirements: openpyxl
import locale
locale.setlocale(locale.LC_ALL, 'en_US.UTF-8')
import openpyxl
import pandas as pd
file_path = path  
df = pd.read_excel(file_path, engine='openpyxl')
df = df[df['시도명'].str.contains('서울특별시')]
df['address'] = df['시도명'] + ' ' + df['시군구명'] + ' ' + df['동리명']
df = df
# ---------- end dong_to_bub ----------
path_2 = FilePath("C:\Users\BaekInchan\Downloads\행정안전부_지역별(행정동) 성별 연령별 주민등록 인구수_20241130.csv")  # disabled
py3 = Python3Script(df=dong_to_bub.df, file_population=path_2)  # -> out, dictionary_address_pop; disabled
# ---------- py3: Python ----------
import pandas as pd
from collections import defaultdict

def hang_to_bub(t) : 
    data = df[:][df['행정동코드'] == t]
    return list(set(data['법정동코드']))

df_p = pd.read_csv(file_population, encoding = 'cp949')

dictionary = defaultdict(int)

for i in range(len(df_p)) : 
    pop_row = df_p.iloc[i]
    code = pop_row['행정기관코드']
    bub_code = hang_to_bub(code)
    pop = int(pop_row['계'])
    for j in bub_code : 
        address = df['address'][df['법정동코드'] == j]
        print(len(address))
        address = address.values[0]
        dictionary[address] += pop

dictionary_address_pop = dictionary
# ---------- end py3 ----------
panel = Panel("D4F65F8F-A3B9-3D6C-9F94-06A911D059F2")  # disabled
행정동 = Panel("lt_c_ademd_info")  # disabled
toggle = BooleanToggle(True)  # disabled
행정동_2 = Panel("lt_c_ademd_info")
시군구 = Panel("lt_c_adsigg_info")
지적도 = Panel("lp_pa_cbnd_bubun")
panel_2 = Panel("인천 남동구 도림동")  # disabled
panel_3 = Panel("경기 남양주시 해밀예당1로 272")  # disabled
행정동_3 = Panel("lt_c_ademd_info")  # disabled
panel_4 = Panel("D4F65F8F-A3B9-3D6C-9F94-06A911D059F2")  # disabled
toggle_2 = BooleanToggle(True)  # disabled
py3_2 = Python3Script()  # -> gps; disabled
# ---------- py3_2: Python ----------
import rhinoscriptsyntax as rs
import Rhino.Geometry as rg
from System.Net import HttpWebRequest, WebRequest
from System.IO import StreamReader
import json
import clr
from math import sin, cos, tan, pi, sqrt
import re

RADIANS_PER_DEGREE = pi/180.0
DEGREES_PER_RADIAN = 180.0/pi

WGS84_A =  6378137.0
WGS84_B =  6356752.31424518
WGS84_F =  0.0033528107
WGS84_E =  0.0818191908
WGS84_EP = 0.0820944379

UTM_K0 =   0.9996
UTM_FE =   500000.0
UTM_FN_N = 0.0
UTM_FN_S = 10000000.0
UTM_E2 =   (WGS84_E*WGS84_E)
UTM_E4 =   (UTM_E2*UTM_E2)
UTM_E6 =   (UTM_E4*UTM_E2)
UTM_EP2 =  (UTM_E2/(1-UTM_E2))

class GPStoUTM(object):
    def __init__(self, **kwargs):
        pass

    def UTM(self, lat, lon):
        '''
        Gets the UTM coordinate without the letter and number.
        '''
        self.m0 = (1 - UTM_E2/4 - 3*UTM_E4/64 - 5*UTM_E6/256)
        self.m1 = -(3*UTM_E2/8 + 3*UTM_E4/32 + 45*UTM_E6/1024)
        self.m2 = (15*UTM_E4/256 + 45*UTM_E6/1024)
        self.m3 = -(35*UTM_E6/3072)

        if lon > 0:
            self.cm = int(lon) - (int(lon) % 6) + 3
        else:
            self.cm = int(lon) - (int(lon) % 6) - 3

        self.rlat = lat * RADIANS_PER_DEGREE
        self.rlon = lon * RADIANS_PER_DEGREE
        self.rlon0 = self.cm * RADIANS_PER_DEGREE

        self.slat = sin(self.rlat)
        self.clat = cos(self.rlat)
        self.tlat = tan(self.rlat)

        if lat > 0:
            self.fn = UTM_FN_N
        else:
            self.fn = UTM_FN_S

        self.T = self.tlat*self.tlat
        self.C = UTM_EP2 * self.clat * self.clat
        self.A = (self.rlon - self.rlon0) * self.clat
        self.M = WGS84_A * (self.m0*self.rlat + self.m1*sin(2*self.rlat) + \
            self.m2*sin(4*self.rlat) + self.m3*sin(6*self.rlat))
        self.V = WGS84_A / sqrt(1 - UTM_E2 * self.slat * self.slat)

        self.x = UTM_FE + UTM_K0 * self.V * (self.A + (1-self.T+self.C)\
            *pow(self.A, 3)/6 +(5-18*self.T+self.T*self.T+72*self.C-58*UTM_EP2)\
            *pow(self.A, 5)/120)

        self.y = self.fn + UTM_K0 * (self.M + self.V * self.tlat * \
            (self.A*self.A/2 + (5-self.T+9*self.C+4*self.C*self.C)* \
            pow(self.A, 4)/24 + ((61-58*self.T+self.T*self.T+600*self.C-\
            330*UTM_EP2) * pow(self.A, 6)/720)))

        return (self.x, self.y)

    def UTMLetterDesignator(self, Lat):
        '''
        Gets the UTM letter only.
        '''
        self.LetterDesignator = 'Z'
        if ((84 >= Lat) and (Lat >= 72)):
            self.LetterDesignator = 'X'
        elif ((72 > Lat) and (Lat >= 64)):
            self.LetterDesignator = 'W'
        elif ((64 > Lat) and (Lat >= 56)):
            self.LetterDesignator = 'V'
        elif ((56 > Lat) and (Lat >= 48)):
            self.LetterDesignator = 'U'
        elif ((48 > Lat) and (Lat >= 40)):
            self.LetterDesignator = 'T'
        elif ((40 > Lat) and (Lat >= 32)):
            self.LetterDesignator = 'S'
        elif ((32 > Lat) and (Lat >= 24)):
            self.LetterDesignator = 'R'
        elif ((24 > Lat) and (Lat >= 16)):
            self.LetterDesignator = 'Q'
        elif ((16 > Lat) and (Lat >= 8)):
            self.LetterDesignator = 'P'
        elif (( 8 > Lat) and (Lat >= 0)):
            self.LetterDesignator = 'N'
        elif (( 0 > Lat) and (Lat >= -8)):
            self.LetterDesignator = 'M'
        elif ((-8 > Lat) and (Lat >= -16)):
            self.LetterDesignator = 'L'
        elif ((-16 > Lat) and (Lat >= -24)):
            self.LetterDesignator = 'K'
        elif ((-24 > Lat) and (Lat >= -32)):
            self.LetterDesignator = 'J'
        elif ((-32 > Lat) and (Lat >= -40)):
            self.LetterDesignator = 'H'
        elif ((-40 > Lat) and (Lat >= -48)):
            self.LetterDesignator = 'G'
        elif ((-48 > Lat) and (Lat >= -56)):
            self.LetterDesignator = 'F'
        elif ((-56 > Lat) and (Lat >= -64)):
            self.LetterDesignator = 'E'
        elif ((-64 > Lat) and (Lat >= -72)):
            self.LetterDesignator = 'D'
        elif ((-72 > Lat) and (Lat >= -80)):
            self.LetterDesignator = 'C'
        return self.LetterDesignator

    def LLtoUTM(self, Lat, Long):
        '''
        Gets the UTM coordinate with the letter and number as inputs also.
        '''
        self.a = WGS84_A;
        self.eccSquared = UTM_E2;
        self.k0 = UTM_K0;

        self.LongTemp = (Long+180)-int((Long+180)/360)*360-180

        self.LatRad = Lat * RADIANS_PER_DEGREE
        self.LongRad = self.LongTemp * RADIANS_PER_DEGREE

        self.ZoneNumber = int((self.LongTemp+180)/6) + 1

        self.LongOrigin = (self.ZoneNumber-1)*6 - 180 + 3
        self.LongOriginRad = self.LongOrigin * RADIANS_PER_DEGREE

        self.eccPrimeSquared = (self.eccSquared)/(1-self.eccSquared);

        self.N = self.a/sqrt(1-self.eccSquared*sin(self.LatRad)*\
            sin(self.LatRad));
        self.T = tan(self.LatRad)*tan(self.LatRad);
        self.C = self.eccPrimeSquared*cos(self.LatRad)*cos(self.LatRad);
        self.A = cos(self.LatRad)*(self.LongRad-self.LongOriginRad);

        self.M = self.a*((1 - self.eccSquared/4 -\
            3*self.eccSquared*self.eccSquared/64 -\
            5*self.eccSquared*self.eccSquared*self.eccSquared/256) * \
            self.LatRad - (3*self.eccSquared/8 + 3*self.eccSquared*\
            self.eccSquared/32 +45*self.eccSquared*self.eccSquared*\
            self.eccSquared/1024)*sin(2*self.LatRad) + (15*self.eccSquared*\
            self.eccSquared/256 + 45*self.eccSquared*self.eccSquared*\
            self.eccSquared/1024)*sin(4*self.LatRad) - (35*self.eccSquared*\
            self.eccSquared*self.eccSquared/3072)*sin(6*self.LatRad))

        self.UTMEasting = float(self.k0*self.N*(self.A+(1-self.T+self.C)*\
            self.A**3/6 + (5-18*self.T+self.T*self.T+72*self.C-58*\
            self.eccPrimeSquared)*self.A**4/120) + 500000.0)

        self.UTMNorthing = float(self.k0*(self.M+self.N*tan(self.LatRad)\
            *(self.A**2/2+(5-self.T+9*self.C+4*self.C**2)*self.A**4/24 + (61-58\
            *self.T+self.T**2+600*self.C-330*self.eccPrimeSquared)\
            *self.A**6/720)))

        if (Lat < 0):
            self.UTMNorthing += 10000000.0

        return (self.UTMEasting, self.UTMNorthing)

    def UTMtoLL(self, UTMNorthing, UTMEasting, UTMNumber, UTMLetter):
        '''
        Gets the latitude and longitude with the UTM letter and number.
        '''
        self.ZoneNumber = int(UTMNumber)
        self.ZoneLetter = UTMLetter

        self.k0 = UTM_K0
        self.a = WGS84_A
        self.eccSquared = UTM_E2
        self.e1 = (1-sqrt(1-self.eccSquared))/(1+sqrt(1-self.eccSquared))

        self.x = UTMEasting - 500000.0
        self.y = UTMNorthing

        if self.ZoneLetter < 'N':
            self.y -= 10000000.0

        self.LongOrigin = (self.ZoneNumber - 1)*6 - 180 + 3
        self.eccPrimeSquared = (self.eccSquared)/(1-self.eccSquared)

        self.M = self.y/self.k0;
        self.mu = self.M/(self.a*(1-self.eccSquared/4-3*self.eccSquared**2/64\
            -5*self.eccSquared**3/256))

        self.phi1Rad = self.mu + ((3*self.e1/2-27*self.e1**3/32)*sin(2*self.mu)\
            + (21*self.e1**2/16-55*self.e1**4/32)*sin(4*self.mu)\
            + (151*self.e1**3/96)*sin(6*self.mu))

        self.N1 = self.a/sqrt(1-self.eccSquared*sin(self.phi1Rad)**2)
        self.T1 = tan(self.phi1Rad)**2
        self.C1 = self.eccPrimeSquared*cos(self.phi1Rad)**2
        self.R1 = self.a*(1-self.eccSquared)/pow(1-self.eccSquared*sin(self.phi1Rad)**2, 1.5)
        self.D = self.x/(self.N1*self.k0)

        self.Lat = self.phi1Rad - ((self.N1*tan(self.phi1Rad)/self.R1)\
            *(self.D**2/2-(5+3*self.T1+10*self.C1-4*self.C1**2-9\
            *self.eccPrimeSquared)*self.D**4/24+(61+90*self.T1+298*self.C1\
            +45*self.T1**2-252*self.eccPrimeSquared-3*self.C1**2)\
            *self.D**6/720))

        self.Lat = self.Lat * DEGREES_PER_RADIAN

        self.Long = ((self.D-(1+2*self.T1+self.C1)*self.D**3/6+(5-2*self.C1\
            +28*self.T1-3*self.C1**2+8*self.eccPrimeSquared+24*self.T1**2)\
            *self.D**5/120)/cos(self.phi1Rad))

        self.Long = self.LongOrigin + self.Long * DEGREES_PER_RADIAN

        return (self.Lat, self.Long)
        
gps = GPStoUTM()
# ---------- end py3_2 ----------
py3_3 = Python3Script(gps=py3_2, Run=toggle, dictionary_address_pop=py3.dictionary_address_pop, typeCol=행정동, vworld_key=panel)  # -> out, shape_name, shape, shape_height; inputs Run: Boolean, typeCol: String, vworld_key: String; disabled
# ---------- py3_3: Python ----------
import rhinoscriptsyntax as rs
import Rhino.Geometry as rg
from System.Net import HttpWebRequest, WebRequest
from System.IO import StreamReader
import json
import clr
from math import sin, cos, tan, pi, sqrt
import re

dictionary = dictionary_address_pop
vworld_key = vworld_key
gps = gps


def read(apiurl) : 
    request = WebRequest.Create(apiurl)
    request.Method = "GET"
    response = request.GetResponse()
    stream = response.GetResponseStream()
    reader = StreamReader(stream)
    responseText = reader.ReadToEnd()
    return json.loads(responseText)

def terrain(ymin,xmin,ymax,xmax, typeCol, vworld_key) :
    params = {
        "SERVICE": "WFS",
        "REQUEST": "GetFeature",
        "TYPENAME": typeCol,
        "BBOX": "{0},{1},{2},{3}".format(ymin, xmin, ymax, xmax),
        "VERSION": "1.1.0",
        "MAXFEATURES": "1000",
        "SRSNAME": "EPSG:4326",
        "OUTPUT": "application/json",
        "EXCEPTIONS": "text/xml",
        "KEY": vworld_key
    }

    apiurl = "https://api.vworld.kr/req/wfs"

    # params 딕셔너리를 URL 쿼리 스트링으로 변환
    query_string = "&".join(["{0}={1}".format(key, value) for key, value in params.items()])
    full_url = "{0}?{1}".format(apiurl,query_string)
    data = read(full_url)
    return data


def AddressToCoord(input_address, vworld_key):
    apiurl = "https://api.vworld.kr/req/address?service=address&request=getcoord&crs=EPSG:4326&address={0}&format=json&type=road&key={1}".format(input_address, vworld_key)
    request = WebRequest.Create(apiurl)
    request.Method = "GET"
    response = request.GetResponse()
    stream = response.GetResponseStream()
    reader = StreamReader(stream)
    responseText = reader.ReadToEnd()
    response_data = json.loads(responseText)
    x_coord = response_data['response']['result']['point']['x']
    y_coord = response_data['response']['result']['point']['y']
    return float(x_coord), float(y_coord)
    
info = {}
select_type = []
select_type.append(typeCol)
dong_geom = []
dong_name = []
dong_code = []
dong_height = []

if Run : 
    for idx, (k, v) in enumerate(dictionary.items()):
        # if idx >= 10 : break
        xmin, ymin = AddressToCoord(k, vworld_key)
        data = terrain(ymin, xmin, ymin + 0.001, xmin+ 0.001, select_type[0], vworld_key)
        try: 
            info = data
            features = info["features"]
            for feature in features : 
                coords = feature['geometry']['coordinates']
                points = []
                for coord in coords[0][0] : 
                    try:
                        x, y = gps.LLtoUTM(coord[1], coord[0])
                        pt = rg.Point3d(x, y, 0)
                        points.append(pt)
                    except: 
                        print('1')
                try : 
                    polyline = rs.AddPolyline(points)
                    dong_geom.append(polyline)
                    dong_name.append(k)
                    dong_height.append(v)
                    dong_code.append(feature['properties']['emd_cd'])
                except : 
                    print(k)
        except : pass

shape = dong_geom
shape_name = dong_name
shape_code = dong_code
shape_height = dong_height
# ---------- end py3_3 ----------
py3_4 = Python3Script(
    Run=Toggle(True),
    address1="인천 남동구 도림동",
    address2="경기 남양주시 해밀예당1로 272",
    typeCol=행정동_2,
    vworld_key="5C3E2796-9BD1-3BC1-A884-5BD7AE4D360E")  # -> out, info, shape, shape_name, shape_code; inputs address1: list
# ---------- py3_4: Python ----------
import rhinoscriptsyntax as rs
import Rhino.Geometry as rg
from System.Net import HttpWebRequest, WebRequest
from System.IO import StreamReader
import json
import clr
#from System.Web.Script.Serialization import JavaScriptSerializer
vworld_key = vworld_key
from math import sin, cos, tan, pi, sqrt
import re

RADIANS_PER_DEGREE = pi/180.0
DEGREES_PER_RADIAN = 180.0/pi

WGS84_A =  6378137.0
WGS84_B =  6356752.31424518
WGS84_F =  0.0033528107
WGS84_E =  0.0818191908
WGS84_EP = 0.0820944379

UTM_K0 =   0.9996
UTM_FE =   500000.0
UTM_FN_N = 0.0
UTM_FN_S = 10000000.0
UTM_E2 =   (WGS84_E*WGS84_E)
UTM_E4 =   (UTM_E2*UTM_E2)
UTM_E6 =   (UTM_E4*UTM_E2)
UTM_EP2 =  (UTM_E2/(1-UTM_E2))

class GPStoUTM(object):
    def __init__(self, **kwargs):
        pass

    def UTM(self, lat, lon):
        '''
        Gets the UTM coordinate without the letter and number.
        '''
        self.m0 = (1 - UTM_E2/4 - 3*UTM_E4/64 - 5*UTM_E6/256)
        self.m1 = -(3*UTM_E2/8 + 3*UTM_E4/32 + 45*UTM_E6/1024)
        self.m2 = (15*UTM_E4/256 + 45*UTM_E6/1024)
        self.m3 = -(35*UTM_E6/3072)

        if lon > 0:
            self.cm = int(lon) - (int(lon) % 6) + 3
        else:
            self.cm = int(lon) - (int(lon) % 6) - 3

        self.rlat = lat * RADIANS_PER_DEGREE
        self.rlon = lon * RADIANS_PER_DEGREE
        self.rlon0 = self.cm * RADIANS_PER_DEGREE

        self.slat = sin(self.rlat)
        self.clat = cos(self.rlat)
        self.tlat = tan(self.rlat)

        if lat > 0:
            self.fn = UTM_FN_N
        else:
            self.fn = UTM_FN_S

        self.T = self.tlat*self.tlat
        self.C = UTM_EP2 * self.clat * self.clat
        self.A = (self.rlon - self.rlon0) * self.clat
        self.M = WGS84_A * (self.m0*self.rlat + self.m1*sin(2*self.rlat) + \
            self.m2*sin(4*self.rlat) + self.m3*sin(6*self.rlat))
        self.V = WGS84_A / sqrt(1 - UTM_E2 * self.slat * self.slat)

        self.x = UTM_FE + UTM_K0 * self.V * (self.A + (1-self.T+self.C)\
            *pow(self.A, 3)/6 +(5-18*self.T+self.T*self.T+72*self.C-58*UTM_EP2)\
            *pow(self.A, 5)/120)

        self.y = self.fn + UTM_K0 * (self.M + self.V * self.tlat * \
            (self.A*self.A/2 + (5-self.T+9*self.C+4*self.C*self.C)* \
            pow(self.A, 4)/24 + ((61-58*self.T+self.T*self.T+600*self.C-\
            330*UTM_EP2) * pow(self.A, 6)/720)))

        return (self.x, self.y)

    def UTMLetterDesignator(self, Lat):
        '''
        Gets the UTM letter only.
        '''
        self.LetterDesignator = 'Z'
        if ((84 >= Lat) and (Lat >= 72)):
            self.LetterDesignator = 'X'
        elif ((72 > Lat) and (Lat >= 64)):
            self.LetterDesignator = 'W'
        elif ((64 > Lat) and (Lat >= 56)):
            self.LetterDesignator = 'V'
        elif ((56 > Lat) and (Lat >= 48)):
            self.LetterDesignator = 'U'
        elif ((48 > Lat) and (Lat >= 40)):
            self.LetterDesignator = 'T'
        elif ((40 > Lat) and (Lat >= 32)):
            self.LetterDesignator = 'S'
        elif ((32 > Lat) and (Lat >= 24)):
            self.LetterDesignator = 'R'
        elif ((24 > Lat) and (Lat >= 16)):
            self.LetterDesignator = 'Q'
        elif ((16 > Lat) and (Lat >= 8)):
            self.LetterDesignator = 'P'
        elif (( 8 > Lat) and (Lat >= 0)):
            self.LetterDesignator = 'N'
        elif (( 0 > Lat) and (Lat >= -8)):
            self.LetterDesignator = 'M'
        elif ((-8 > Lat) and (Lat >= -16)):
            self.LetterDesignator = 'L'
        elif ((-16 > Lat) and (Lat >= -24)):
            self.LetterDesignator = 'K'
        elif ((-24 > Lat) and (Lat >= -32)):
            self.LetterDesignator = 'J'
        elif ((-32 > Lat) and (Lat >= -40)):
            self.LetterDesignator = 'H'
        elif ((-40 > Lat) and (Lat >= -48)):
            self.LetterDesignator = 'G'
        elif ((-48 > Lat) and (Lat >= -56)):
            self.LetterDesignator = 'F'
        elif ((-56 > Lat) and (Lat >= -64)):
            self.LetterDesignator = 'E'
        elif ((-64 > Lat) and (Lat >= -72)):
            self.LetterDesignator = 'D'
        elif ((-72 > Lat) and (Lat >= -80)):
            self.LetterDesignator = 'C'
        return self.LetterDesignator

    def LLtoUTM(self, Lat, Long):
        '''
        Gets the UTM coordinate with the letter and number as inputs also.
        '''
        self.a = WGS84_A;
        self.eccSquared = UTM_E2;
        self.k0 = UTM_K0;

        self.LongTemp = (Long+180)-int((Long+180)/360)*360-180

        self.LatRad = Lat * RADIANS_PER_DEGREE
        self.LongRad = self.LongTemp * RADIANS_PER_DEGREE

        self.ZoneNumber = int((self.LongTemp+180)/6) + 1

        self.LongOrigin = (self.ZoneNumber-1)*6 - 180 + 3
        self.LongOriginRad = self.LongOrigin * RADIANS_PER_DEGREE

        self.eccPrimeSquared = (self.eccSquared)/(1-self.eccSquared);

        self.N = self.a/sqrt(1-self.eccSquared*sin(self.LatRad)*\
            sin(self.LatRad));
        self.T = tan(self.LatRad)*tan(self.LatRad);
        self.C = self.eccPrimeSquared*cos(self.LatRad)*cos(self.LatRad);
        self.A = cos(self.LatRad)*(self.LongRad-self.LongOriginRad);

        self.M = self.a*((1 - self.eccSquared/4 -\
            3*self.eccSquared*self.eccSquared/64 -\
            5*self.eccSquared*self.eccSquared*self.eccSquared/256) * \
            self.LatRad - (3*self.eccSquared/8 + 3*self.eccSquared*\
            self.eccSquared/32 +45*self.eccSquared*self.eccSquared*\
            self.eccSquared/1024)*sin(2*self.LatRad) + (15*self.eccSquared*\
            self.eccSquared/256 + 45*self.eccSquared*self.eccSquared*\
            self.eccSquared/1024)*sin(4*self.LatRad) - (35*self.eccSquared*\
            self.eccSquared*self.eccSquared/3072)*sin(6*self.LatRad))

        self.UTMEasting = float(self.k0*self.N*(self.A+(1-self.T+self.C)*\
            self.A**3/6 + (5-18*self.T+self.T*self.T+72*self.C-58*\
            self.eccPrimeSquared)*self.A**4/120) + 500000.0)

        self.UTMNorthing = float(self.k0*(self.M+self.N*tan(self.LatRad)\
            *(self.A**2/2+(5-self.T+9*self.C+4*self.C**2)*self.A**4/24 + (61-58\
            *self.T+self.T**2+600*self.C-330*self.eccPrimeSquared)\
            *self.A**6/720)))

        if (Lat < 0):
            self.UTMNorthing += 10000000.0

        return (self.UTMEasting, self.UTMNorthing)

    def UTMtoLL(self, UTMNorthing, UTMEasting, UTMNumber, UTMLetter):
        '''
        Gets the latitude and longitude with the UTM letter and number.
        '''
        self.ZoneNumber = int(UTMNumber)
        self.ZoneLetter = UTMLetter

        self.k0 = UTM_K0
        self.a = WGS84_A
        self.eccSquared = UTM_E2
        self.e1 = (1-sqrt(1-self.eccSquared))/(1+sqrt(1-self.eccSquared))

        self.x = UTMEasting - 500000.0
        self.y = UTMNorthing

        if self.ZoneLetter < 'N':
            self.y -= 10000000.0

        self.LongOrigin = (self.ZoneNumber - 1)*6 - 180 + 3
        self.eccPrimeSquared = (self.eccSquared)/(1-self.eccSquared)

        self.M = self.y/self.k0;
        self.mu = self.M/(self.a*(1-self.eccSquared/4-3*self.eccSquared**2/64\
            -5*self.eccSquared**3/256))

        self.phi1Rad = self.mu + ((3*self.e1/2-27*self.e1**3/32)*sin(2*self.mu)\
            + (21*self.e1**2/16-55*self.e1**4/32)*sin(4*self.mu)\
            + (151*self.e1**3/96)*sin(6*self.mu))

        self.N1 = self.a/sqrt(1-self.eccSquared*sin(self.phi1Rad)**2)
        self.T1 = tan(self.phi1Rad)**2
        self.C1 = self.eccPrimeSquared*cos(self.phi1Rad)**2
        self.R1 = self.a*(1-self.eccSquared)/pow(1-self.eccSquared*sin(self.phi1Rad)**2, 1.5)
        self.D = self.x/(self.N1*self.k0)

        self.Lat = self.phi1Rad - ((self.N1*tan(self.phi1Rad)/self.R1)\
            *(self.D**2/2-(5+3*self.T1+10*self.C1-4*self.C1**2-9\
            *self.eccPrimeSquared)*self.D**4/24+(61+90*self.T1+298*self.C1\
            +45*self.T1**2-252*self.eccPrimeSquared-3*self.C1**2)\
            *self.D**6/720))

        self.Lat = self.Lat * DEGREES_PER_RADIAN

        self.Long = ((self.D-(1+2*self.T1+self.C1)*self.D**3/6+(5-2*self.C1\
            +28*self.T1-3*self.C1**2+8*self.eccPrimeSquared+24*self.T1**2)\
            *self.D**5/120)/cos(self.phi1Rad))

        self.Long = self.LongOrigin + self.Long * DEGREES_PER_RADIAN

        return (self.Lat, self.Long)
        
gps = GPStoUTM()

def read(apiurl) : 
    request = WebRequest.Create(apiurl)
    request.Method = "GET"
    response = request.GetResponse()
    stream = response.GetResponseStream()
    reader = StreamReader(stream)
    responseText = reader.ReadToEnd()
    return json.loads(responseText)

def terrain(ymin,xmin,ymax,xmax, typeCol, vworld_key) :
    params = {
        "SERVICE": "WFS",
        "REQUEST": "GetFeature",
        "TYPENAME": typeCol,
        "BBOX": "{0},{1},{2},{3}".format(ymin, xmin, ymax, xmax),
        "VERSION": "1.1.0",
        "MAXFEATURES": "1000",
        "SRSNAME": "EPSG:4326",
        "OUTPUT": "application/json",
        "EXCEPTIONS": "text/xml",
        "KEY": vworld_key
    }

    apiurl = "https://api.vworld.kr/req/wfs"

    # params 딕셔너리를 URL 쿼리 스트링으로 변환
    query_string = "&".join(["{0}={1}".format(key, value) for key, value in params.items()])
    full_url = "{0}?{1}".format(apiurl,query_string)
    data = read(full_url)
    return data


def AddressToCoord(input_address, vworld_key):
    apiurl = "https://api.vworld.kr/req/address?service=address&request=getcoord&crs=EPSG:4326&address={0}&format=json&type=road&key={1}".format(input_address, vworld_key)
    request = WebRequest.Create(apiurl)
    request.Method = "GET"
    response = request.GetResponse()
    stream = response.GetResponseStream()
    reader = StreamReader(stream)
    responseText = reader.ReadToEnd()
    response_data = json.loads(responseText)
    x_coord = response_data['response']['result']['point']['x']
    y_coord = response_data['response']['result']['point']['y']
    return float(x_coord), float(y_coord)
    
info = {}
select_type = []
select_type.append(typeCol)
dong_geom = []
dong_name = []
dong_code = []
nodata = []
nodataid = []



def remove_numbers(string):
    return re.sub(r'\d+', '', string)


if Run : 
    xmin, ymin = AddressToCoord(address1, vworld_key)
    xmax, ymax = AddressToCoord(address2, vworld_key)
    if(ymin > ymax) : ymin, ymax = ymax, ymin
    if(xmin > xmax) : xmin, xmax = xmax, xmin
    data = terrain(ymin, xmin, ymax, xmax, select_type[0], vworld_key)
    try: 
        info = data
        features = info["features"]
        for feature in features : 
            coords = feature['geometry']['coordinates']
            feat_name = feature['properties']['full_nm']
            print(feature)
            if "서울" in feat_name : 
                points = []
                for coord in coords[0][0] : 
                    try:
                        x, y = gps.LLtoUTM(coord[1], coord[0])
                        pt = rg.Point3d(x, y, 0)
                        points.append(pt)
                    except: continue
                try : 
                    polyline = rs.AddPolyline(points)
                    dong_geom.append(polyline)
                    dong_name.append(feat_name)
                    dong_code.append(feature['properties']['emd_cd'])
                except : pass
    except : pass

shape = dong_geom
shape_name = dong_name
shape_code = dong_code
# ---------- end py3_4 ----------
py3_5 = Python3Script(Run=toggle_2, address1=panel_2, address2=panel_3, typeCol=행정동_3, vworld_key=panel_4)  # -> out, info, shape, shape_name, shape_code; inputs address1: list; disabled; same code as py3_4
number_slider = Slider(100, range=0..100)  # disabled
area = Area(Geometry=py3_4.shape)  # -> Area, Centroid
boundary = BoundarySurfaces(Edges=py3_3.shape)  # disabled
area_2 = Area(Geometry=py3_5.shape)  # -> Area, Centroid; disabled
area_3 = Area(Geometry=py3_3.shape)  # -> Area, Centroid; disabled
larger = LargerThan(FirstNumber=area.Area, SecondNumber=Slider(100, range=0..100))  # -> LargerThan, OrEqualTo
path_3 = FilePath("D:\Keon Chae\Programming Languages\Python\referred_files\KIKmix.20240201.xlsx")
larger_2 = LargerThan(FirstNumber=area_2.Area, SecondNumber=number_slider)  # -> LargerThan, OrEqualTo; disabled
path_4 = FilePath("C:\Users\BaekInchan\Downloads\jscode20240208\KIKmix.20240208.xlsx")  # disabled
sort = SortList(Keys=area_3.Area, ValuesA=py3_3.shape, ValuesB=py3_3.shape_name, ValuesC=py3_3.shape_height)  # -> Keys, ValuesA, ValuesB, ValuesC; disabled
dong_to_bub_2 = Python3Script(path=path_3)  # -> out, df; inputs path: String; same code as dong_to_bub
cull = CullPattern(List=py3_4.shape, CullPattern=larger.LargerThan)
cull_2 = CullPattern(List=py3_4.shape_code, CullPattern=larger.LargerThan)
dong_to_bub_3 = Python3Script(path=path_4)  # -> out, df; inputs path: String; disabled; same code as dong_to_bub
cull_3 = CullPattern(List=py3_5.shape, CullPattern=larger_2.LargerThan)  # disabled
cull_4 = CullPattern(List=py3_5.shape_code, CullPattern=larger_2.LargerThan)  # disabled
merge = Merge(Data1=graft(sort.ValuesA), Data2=graft(sort.ValuesB), Data3=graft(sort.ValuesC))  # disabled
path_5 = FilePath("C:\Users\BaekInchan\Downloads\행정안전부_지역별(행정동) 성별 연령별 주민등록 인구수_20241130.csv")  # disabled
tstat = TreeStatistics(Tree=merge)  # -> Paths, Length, Count; disabled
panel_5 = Panel("0")  # disabled
py3_6 = Python3Script(df=dong_to_bub_2.df, shape_code=cull_2)  # -> out, result; inputs shape_code: list of String
# ---------- py3_6: Python ----------
import pandas as pd
from collections import defaultdict

# 데이터 로드
월평균소득 = pd.read_csv('D:/Keon Chae/Programming Languages/Python/referred_files/서울시 상권분석서비스(소득소비-행정동).csv', encoding="euckr")
average_income = 월평균소득.groupby('행정동_코드')['월_평균_소득_금액'].mean().reset_index()

# 앞에서 가지고 온 모든 서울시 법정동 코드
shape_code = list(map(lambda x: int(x + '00'), shape_code))
result = []

def hang(k):
    """법정동에 해당하는 행정동코드 리스트 반환"""
    h = df['행정동코드'][df['법정동코드'] == k]
    return h

# 기본값 (평균 소득)
default_value = average_income['월_평균_소득_금액'].mean()

for i in shape_code:
    k = list(set(hang(i)))  # 법정동 코드에 해당하는 행정동 코드 리스트
    pop = 0  # 현재 법정동의 평균 소득 초기화
    count = 0  # 유효한 행정동 데이터의 개수
    for j in k:
        j = str(j)[:-2]  # 뒤의 "00" 제거
        j = int(j)  # 정수형으로 변환

        # 행정동 코드에 해당하는 소득값 가져오기
        ret = average_income['월_평균_소득_금액'][average_income['행정동_코드'] == j]

        if ret.empty:
            print(f"행정동 코드 {j}에 해당하는 데이터가 없습니다.")
            continue
        else:
            pop += ret.values[0]  # 소득값 합산
            count += 1  # 유효한 데이터 카운트 증가
    
    # 평균 계산 (유효한 데이터가 있을 경우만)
    if count > 0:
        pop /= count
    else:
        pop = default_value  # 데이터가 없는 경우 기본값 사용
    
    result.append(pop)

print("법정동 코드별 월 평균 소득:", result)
# ---------- end py3_6 ----------
number_slider_2 = Slider(100, range=0..1000)  # disabled
number_slider_3 = Slider(10000, range=0..10000)  # disabled
py3_7 = Python3Script(df=dong_to_bub_3.df, file_population=path_5, shape_code=cull_4)  # -> out, result; inputs shape_code: list of String; disabled
# ---------- py3_7: Python ----------
import pandas as pd
from collections import defaultdict

df_p = pd.read_csv(file_population, encoding = 'cp949')

dictionary = defaultdict(int)

shape_code = list(map(lambda x : int(x + '00'), shape_code))
result = []

def hang(k) : 
    h = df['행정동코드'][df['법정동코드']==k]
    return h

for i in shape_code : 
    k = list(set(hang(i)))
    pop = 0
    for j in k : 
        ret = df_p['계'][df_p['행정기관코드'] == j].values[0]
        pop += int(ret)
    result.append(pop)

result = result
# ---------- end py3_7 ----------
cull_i = CullIndex(List=tstat.Paths, Indices=panel_5, Wrap=True)  # disabled
area_4 = Area(Geometry=cull_3)  # -> Area, Centroid; disabled
url = Python3Script(URL="http://openapi.seoul.go.kr:8088", api_key="707372594162726936364c44614e78", service="citydata", area="POI041")  # -> out, a; inputs URL: String
# ---------- url: Python ----------
import rhinoscriptsyntax as rs
from System.Net import HttpWebRequest, WebRequest
from System.IO import StreamReader
import json
import clr
import xml.etree.ElementTree as ET

def read(apiurl) : 
    request = WebRequest.Create(apiurl)
    request.Method = "GET"
    response = request.GetResponse()
    stream = response.GetResponseStream()
    reader = StreamReader(stream)
    responseText = reader.ReadToEnd()
    return responseText

def parse_xml_recursive(element):
    """재귀적으로 XML 데이터를 파싱하여 딕셔너리로 반환."""
    data = {}
    for child in element:
        if len(child):  # 하위 태그가 있는 경우
            data[child.tag] = parse_xml_recursive(child)
        else:  # 하위 태그가 없는 경우
            data[child.tag] = child.text
    return data

def parse_xml_response(xml_response):
    """XML 응답을 루트로 시작해 파싱."""
    root = ET.fromstring(xml_response)  # XML 문자열을 ElementTree로 변환
    parsed_data = parse_xml_recursive(root)  # 재귀적으로 파싱
    return parsed_data

url = URL
key = api_key
service = service
area = area

apiurl = f"{url}/{key}/xml/{service}/1/5/{area}"


print(apiurl)
response = read(apiurl)
# parsed_data = parse_xml_dynamic(response)

# # 결과 출력
# for data in parsed_data:
#     print(data)

parsed_data = parse_xml_response(response)

# 결과 출력
import json
print(json.dumps(parsed_data, ensure_ascii=False, indent=4))
# ---------- end url ----------
branch = TreeBranch(Tree=merge, Path=cull_i, MaintainPaths=True)  # disabled
division = Division(A=area_4.Area, B=py3_7.result)  # disabled
bnd = Bounds(Numbers=py3_6.result)
dom = ConstructDomain(DomainStart=Slider(100, range=0..1000), DomainEnd=Slider(10000, range=0..10000))
item = ListItem(List=branch, Index=0, Wrap=True)  # -> Item, Item1, Item2; disabled
dom_2 = ConstructDomain(DomainStart=number_slider_2, DomainEnd=number_slider_3)  # disabled
number_slider_4 = Slider(100, range=0..1000)  # disabled
bnd_2 = Bounds(Numbers=division)  # disabled
number_slider_5 = Slider(10000, range=0..10000)  # disabled
remap = RemapNumbers(Value=py3_6.result, Source=bnd, Target=dom)  # -> Mapped, Clipped
cull_5 = CullPattern(List=area.Centroid, CullPattern=larger.LargerThan)
panel_6 = Panel(url.out)
area_5 = Area(Geometry=item.Item)  # -> Area, Centroid; disabled
remap_2 = RemapNumbers(Value=division, Source=bnd_2, Target=dom_2)  # -> Mapped, Clipped; disabled
Z = UnitZ(Factor=remap.Mapped)
division_2 = Division(A=item.Item2, B=area_5.Area)  # -> flatten(Result); disabled
one_over_x = OneOverX(Value=remap_2.Mapped)  # disabled
crv = Curve(flatten(item.Item))  # disabled
move = Move(Geometry=cull_5, Motion=Z)  # -> Geometry, Transform
extr = Extrude(Base=cull, Direction=Z)
bnd_3 = Bounds(Numbers=one_over_x)  # disabled
bnd_4 = Bounds(Numbers=division_2)  # disabled
dom_3 = ConstructDomain(DomainStart=number_slider_4, DomainEnd=number_slider_5)  # disabled
cap = CapHoles()
remap_3 = RemapNumbers(Value=one_over_x, Source=bnd_3, Target=dom_2)  # -> Mapped, Clipped; disabled
remap_4 = RemapNumbers(Value=division_2, Source=bnd_4, Target=dom_3)  # -> Mapped, Clipped; disabled
Z_2 = UnitZ(Factor=remap_3.Mapped)  # disabled
Z_3 = UnitZ(Factor=remap_4.Mapped)  # disabled
extr_2 = Extrude(Base=cull_3, Direction=Z_2)  # disabled
extr_3 = Extrude(Base=crv, Direction=Z_3)  # disabled
cap_2 = CapHoles()  # disabled
cap_3 = CapHoles(Brep=extr_3)  # disabled
panel_7 = Panel("C:\Users\H01\Downloads\행정안전부_지역별(행정동) 성별 연령별 주민등록 인구수_20241130 (1).csv")  # disabled
시군구_2 = Panel("lt_c_adsigg_info")  # disabled
panel_8 = Panel("C:\Users\H01\Downloads\행정안전부_지역별(행정동) 성별 연령별 주민등록 인구수_20241130.csv")  # disabled
panel_9 = Panel("1111051500")  # disabled
panel_10 = Panel("서울특별시 종로구 창신동")  # disabled
panel_11 = Panel("D4F65F8F-A3B9-3D6C-9F94-06A911D059F2")  # disabled
지적도_2 = Panel("lp_pa_cbnd_bubun")  # disabled
행정동_4 = Panel("lt_c_ademd_info")  # disabled
toggle_3 = BooleanToggle(False)  # disabled
py3_8 = Python3Script(Run=toggle_3, address1=panel_10, path=panel_7, typeCol=행정동_4, vworld_key=panel_11)  # -> out, info, graft(shape), shape_name, shape_code, nodata, nodataid; inputs address1: list; disabled
# ---------- py3_8: Python ----------
# requirements: PublicDataReader
import rhinoscriptsyntax as rs
import Rhino.Geometry as rg
from System.Net import HttpWebRequest, WebRequest
from System.IO import StreamReader
import json
import clr
#from System.Web.Script.Serialization import JavaScriptSerializer
vworld_key = vworld_key
from math import sin, cos, tan, pi, sqrt
import re

RADIANS_PER_DEGREE = pi/180.0
DEGREES_PER_RADIAN = 180.0/pi

WGS84_A =  6378137.0
WGS84_B =  6356752.31424518
WGS84_F =  0.0033528107
WGS84_E =  0.0818191908
WGS84_EP = 0.0820944379

UTM_K0 =   0.9996
UTM_FE =   500000.0
UTM_FN_N = 0.0
UTM_FN_S = 10000000.0
UTM_E2 =   (WGS84_E*WGS84_E)
UTM_E4 =   (UTM_E2*UTM_E2)
UTM_E6 =   (UTM_E4*UTM_E2)
UTM_EP2 =  (UTM_E2/(1-UTM_E2))

class GPStoUTM(object):
    def __init__(self, **kwargs):
        pass

    def UTM(self, lat, lon):
        '''
        Gets the UTM coordinate without the letter and number.
        '''
        self.m0 = (1 - UTM_E2/4 - 3*UTM_E4/64 - 5*UTM_E6/256)
        self.m1 = -(3*UTM_E2/8 + 3*UTM_E4/32 + 45*UTM_E6/1024)
        self.m2 = (15*UTM_E4/256 + 45*UTM_E6/1024)
        self.m3 = -(35*UTM_E6/3072)

        if lon > 0:
            self.cm = int(lon) - (int(lon) % 6) + 3
        else:
            self.cm = int(lon) - (int(lon) % 6) - 3

        self.rlat = lat * RADIANS_PER_DEGREE
        self.rlon = lon * RADIANS_PER_DEGREE
        self.rlon0 = self.cm * RADIANS_PER_DEGREE

        self.slat = sin(self.rlat)
        self.clat = cos(self.rlat)
        self.tlat = tan(self.rlat)

        if lat > 0:
            self.fn = UTM_FN_N
        else:
            self.fn = UTM_FN_S

        self.T = self.tlat*self.tlat
        self.C = UTM_EP2 * self.clat * self.clat
        self.A = (self.rlon - self.rlon0) * self.clat
        self.M = WGS84_A * (self.m0*self.rlat + self.m1*sin(2*self.rlat) + \
            self.m2*sin(4*self.rlat) + self.m3*sin(6*self.rlat))
        self.V = WGS84_A / sqrt(1 - UTM_E2 * self.slat * self.slat)

        self.x = UTM_FE + UTM_K0 * self.V * (self.A + (1-self.T+self.C)\
            *pow(self.A, 3)/6 +(5-18*self.T+self.T*self.T+72*self.C-58*UTM_EP2)\
            *pow(self.A, 5)/120)

        self.y = self.fn + UTM_K0 * (self.M + self.V * self.tlat * \
            (self.A*self.A/2 + (5-self.T+9*self.C+4*self.C*self.C)* \
            pow(self.A, 4)/24 + ((61-58*self.T+self.T*self.T+600*self.C-\
            330*UTM_EP2) * pow(self.A, 6)/720)))

        return (self.x, self.y)

    def UTMLetterDesignator(self, Lat):
        '''
        Gets the UTM letter only.
        '''
        self.LetterDesignator = 'Z'
        if ((84 >= Lat) and (Lat >= 72)):
            self.LetterDesignator = 'X'
        elif ((72 > Lat) and (Lat >= 64)):
            self.LetterDesignator = 'W'
        elif ((64 > Lat) and (Lat >= 56)):
            self.LetterDesignator = 'V'
        elif ((56 > Lat) and (Lat >= 48)):
            self.LetterDesignator = 'U'
        elif ((48 > Lat) and (Lat >= 40)):
            self.LetterDesignator = 'T'
        elif ((40 > Lat) and (Lat >= 32)):
            self.LetterDesignator = 'S'
        elif ((32 > Lat) and (Lat >= 24)):
            self.LetterDesignator = 'R'
        elif ((24 > Lat) and (Lat >= 16)):
            self.LetterDesignator = 'Q'
        elif ((16 > Lat) and (Lat >= 8)):
            self.LetterDesignator = 'P'
        elif (( 8 > Lat) and (Lat >= 0)):
            self.LetterDesignator = 'N'
        elif (( 0 > Lat) and (Lat >= -8)):
            self.LetterDesignator = 'M'
        elif ((-8 > Lat) and (Lat >= -16)):
            self.LetterDesignator = 'L'
        elif ((-16 > Lat) and (Lat >= -24)):
            self.LetterDesignator = 'K'
        elif ((-24 > Lat) and (Lat >= -32)):
            self.LetterDesignator = 'J'
        elif ((-32 > Lat) and (Lat >= -40)):
            self.LetterDesignator = 'H'
        elif ((-40 > Lat) and (Lat >= -48)):
            self.LetterDesignator = 'G'
        elif ((-48 > Lat) and (Lat >= -56)):
            self.LetterDesignator = 'F'
        elif ((-56 > Lat) and (Lat >= -64)):
            self.LetterDesignator = 'E'
        elif ((-64 > Lat) and (Lat >= -72)):
            self.LetterDesignator = 'D'
        elif ((-72 > Lat) and (Lat >= -80)):
            self.LetterDesignator = 'C'
        return self.LetterDesignator

    def LLtoUTM(self, Lat, Long):
        '''
        Gets the UTM coordinate with the letter and number as inputs also.
        '''
        self.a = WGS84_A;
        self.eccSquared = UTM_E2;
        self.k0 = UTM_K0;

        self.LongTemp = (Long+180)-int((Long+180)/360)*360-180

        self.LatRad = Lat * RADIANS_PER_DEGREE
        self.LongRad = self.LongTemp * RADIANS_PER_DEGREE

        self.ZoneNumber = int((self.LongTemp+180)/6) + 1

        self.LongOrigin = (self.ZoneNumber-1)*6 - 180 + 3
        self.LongOriginRad = self.LongOrigin * RADIANS_PER_DEGREE

        self.eccPrimeSquared = (self.eccSquared)/(1-self.eccSquared);

        self.N = self.a/sqrt(1-self.eccSquared*sin(self.LatRad)*\
            sin(self.LatRad));
        self.T = tan(self.LatRad)*tan(self.LatRad);
        self.C = self.eccPrimeSquared*cos(self.LatRad)*cos(self.LatRad);
        self.A = cos(self.LatRad)*(self.LongRad-self.LongOriginRad);

        self.M = self.a*((1 - self.eccSquared/4 -\
            3*self.eccSquared*self.eccSquared/64 -\
            5*self.eccSquared*self.eccSquared*self.eccSquared/256) * \
            self.LatRad - (3*self.eccSquared/8 + 3*self.eccSquared*\
            self.eccSquared/32 +45*self.eccSquared*self.eccSquared*\
            self.eccSquared/1024)*sin(2*self.LatRad) + (15*self.eccSquared*\
            self.eccSquared/256 + 45*self.eccSquared*self.eccSquared*\
            self.eccSquared/1024)*sin(4*self.LatRad) - (35*self.eccSquared*\
            self.eccSquared*self.eccSquared/3072)*sin(6*self.LatRad))

        self.UTMEasting = float(self.k0*self.N*(self.A+(1-self.T+self.C)*\
            self.A**3/6 + (5-18*self.T+self.T*self.T+72*self.C-58*\
            self.eccPrimeSquared)*self.A**4/120) + 500000.0)

        self.UTMNorthing = float(self.k0*(self.M+self.N*tan(self.LatRad)\
            *(self.A**2/2+(5-self.T+9*self.C+4*self.C**2)*self.A**4/24 + (61-58\
            *self.T+self.T**2+600*self.C-330*self.eccPrimeSquared)\
            *self.A**6/720)))

        if (Lat < 0):
            self.UTMNorthing += 10000000.0

        return (self.UTMEasting, self.UTMNorthing)

    def UTMtoLL(self, UTMNorthing, UTMEasting, UTMNumber, UTMLetter):
        '''
        Gets the latitude and longitude with the UTM letter and number.
        '''
        self.ZoneNumber = int(UTMNumber)
        self.ZoneLetter = UTMLetter

        self.k0 = UTM_K0
        self.a = WGS84_A
        self.eccSquared = UTM_E2
        self.e1 = (1-sqrt(1-self.eccSquared))/(1+sqrt(1-self.eccSquared))

        self.x = UTMEasting - 500000.0
        self.y = UTMNorthing

        if self.ZoneLetter < 'N':
            self.y -= 10000000.0

        self.LongOrigin = (self.ZoneNumber - 1)*6 - 180 + 3
        self.eccPrimeSquared = (self.eccSquared)/(1-self.eccSquared)

        self.M = self.y/self.k0;
        self.mu = self.M/(self.a*(1-self.eccSquared/4-3*self.eccSquared**2/64\
            -5*self.eccSquared**3/256))

        self.phi1Rad = self.mu + ((3*self.e1/2-27*self.e1**3/32)*sin(2*self.mu)\
            + (21*self.e1**2/16-55*self.e1**4/32)*sin(4*self.mu)\
            + (151*self.e1**3/96)*sin(6*self.mu))

        self.N1 = self.a/sqrt(1-self.eccSquared*sin(self.phi1Rad)**2)
        self.T1 = tan(self.phi1Rad)**2
        self.C1 = self.eccPrimeSquared*cos(self.phi1Rad)**2
        self.R1 = self.a*(1-self.eccSquared)/pow(1-self.eccSquared*sin(self.phi1Rad)**2, 1.5)
        self.D = self.x/(self.N1*self.k0)

        self.Lat = self.phi1Rad - ((self.N1*tan(self.phi1Rad)/self.R1)\
            *(self.D**2/2-(5+3*self.T1+10*self.C1-4*self.C1**2-9\
            *self.eccPrimeSquared)*self.D**4/24+(61+90*self.T1+298*self.C1\
            +45*self.T1**2-252*self.eccPrimeSquared-3*self.C1**2)\
            *self.D**6/720))

        self.Lat = self.Lat * DEGREES_PER_RADIAN

        self.Long = ((self.D-(1+2*self.T1+self.C1)*self.D**3/6+(5-2*self.C1\
            +28*self.T1-3*self.C1**2+8*self.eccPrimeSquared+24*self.T1**2)\
            *self.D**5/120)/cos(self.phi1Rad))

        self.Long = self.LongOrigin + self.Long * DEGREES_PER_RADIAN

        return (self.Lat, self.Long)
        
gps = GPStoUTM()

def read(apiurl) : 
    request = WebRequest.Create(apiurl)
    request.Method = "GET"
    response = request.GetResponse()
    stream = response.GetResponseStream()
    reader = StreamReader(stream)
    responseText = reader.ReadToEnd()
    return json.loads(responseText)

def terrain(ymin,xmin,ymax,xmax, typeCol, vworld_key) :
    params = {
        "SERVICE": "WFS",
        "REQUEST": "GetFeature",
        "TYPENAME": typeCol,
        "BBOX": "{0},{1},{2},{3}".format(ymin, xmin, ymax, xmax),
        "VERSION": "1.1.0",
        "MAXFEATURES": "1000",
        "SRSNAME": "EPSG:4326",
        "OUTPUT": "application/json",
        "EXCEPTIONS": "text/xml",
        "KEY": vworld_key
    }

    apiurl = "https://api.vworld.kr/req/wfs"

    # params 딕셔너리를 URL 쿼리 스트링으로 변환
    query_string = "&".join(["{0}={1}".format(key, value) for key, value in params.items()])
    full_url = "{0}?{1}".format(apiurl,query_string)
    data = read(full_url)
    return data


def AddressToCoord(input_address, vworld_key):
    apiurl = "https://api.vworld.kr/req/address?service=address&request=getcoord&crs=EPSG:4326&address={0}&format=json&type=road&key={1}".format(input_address, vworld_key)
    request = WebRequest.Create(apiurl)
    request.Method = "GET"
    response = request.GetResponse()
    stream = response.GetResponseStream()
    reader = StreamReader(stream)
    responseText = reader.ReadToEnd()
    response_data = json.loads(responseText)
    x_coord = response_data['response']['result']['point']['x']
    y_coord = response_data['response']['result']['point']['y']
    return float(x_coord), float(y_coord)
    
info = {}
select_type = []
select_type.append(typeCol)
dong_geom = []
dong_name = []
dong_code = []
nodata = []
nodataid = []

import pandas as pd
import openpyxl
file_path = path  
df = pd.read_csv(file_path, encoding = "cp949")
df.head()
df = df[:][df['시도명'] == '서울특별시']
df['name'] = df['시도명'] + ' ' + df['시군구명'] + ' ' + df['읍면동명']
df = df[['행정기관코드', '계', 'name']]

def remove_numbers(string):
    return re.sub(r'\d+', '', string)


print(len(df))
print(df.iloc[0])
if Run : 
    xmin, ymin = AddressToCoord(address1, vworld_key)
    xmax, ymax = AddressToCoord(address2, vworld_key)
    if(ymin > ymax) : ymin, ymax = ymax, ymin
    if(xmin > xmax) : xmin, xmax = xmax, xmin
    data = terrain(ymin, xmin, ymax, xmax, select_type[0], vworld_key)
    print(data)
    for i in range(len(df)) : 
        print(df.iloc[i]['name'])
        address1 = df.iloc[i]['name']
        # address1 = remove_numbers(address1)
        # if(address1[-2] == '제') : address1 = address1[:-2] + address1[-1]
        try: 
            xmin, ymin = AddressToCoord(address1, vworld_key)
            data = terrain(ymin, xmin, ymin, xmin, select_type[0], vworld_key)
            info = data
            features = info["features"]
            for feature in features : 
                coords = feature['geometry']['coordinates']
                feat_name = feature['properties']['full_nm']
                # print(feature)
                if "서울" in feat_name : 
                    points = []
                    for coord in coords[0][0] : 
                        try:
                            x, y = gps.LLtoUTM(coord[1], coord[0])
                            pt = rg.Point3d(x, y, 0)
                            points.append(pt)
                        except: continue
                    try : 
                        polyline = rs.AddPolyline(points)
                        dong_geom.append(polyline)
                        dong_name.append(feat_name)
                        dong_code.append(feature['properties']['emd_cd'])
                    except : pass
        except : 
            nodata.append(address1)
            nodataid.append(df.iloc[i]['행정기관코드'])

shape = dong_geom
shape_name = dong_name
shape_code = dong_code
# ---------- end py3_8 ----------
py3_9 = Python3Script(path=panel_8)  # -> out, a; disabled
# ---------- py3_9: Python ----------
import pandas as pd
import openpyxl
file_path = path  
df = pd.read_csv(file_path, encoding = "cp949")
df.head()
df = df[:][df['시도명'] == '서울특별시']
df['name'] = df['시도명'] + ' ' + df['시군구명'] + ' ' + df['읍면동명']
df = df[['행정기관코드', '계', 'name']]
print(df.head())
# ---------- end py3_9 ----------
boundary_2 = BoundarySurfaces(Edges=py3_8.shape)  # disabled
panel_12 = Panel(py3_8.shape_name)  # disabled
panel_13 = Panel(py3_8.shape_code)  # disabled
