# Grasshopper definition weighted_overlay_인찬.gh (Grasshopper 1.0.8)
# plug-ins: RhinoCodePluginGH

행정동 = Panel("lt_c_ademd_info")
# KT핫플레이스
panel = Panel("http://openapi.seoul.go.kr:8088")
# 소득
toggle = BooleanToggle(True)
# 인구
toggle_2 = BooleanToggle(True)
행정동_2 = Panel("lt_c_ademd_info")
# 헬리패드 위치
toggle_3 = BooleanToggle(True)
panel_2 = Panel("lt_c_aisuac")
py3 = Python3Script(
    Run=toggle,
    address1="인천 남동구 도림동",
    address2="경기 남양주시 해밀예당1로 272",
    typeCol=행정동,
    vworld_key="D4F65F8F-A3B9-3D6C-9F94-06A911D059F2")  # -> out, info, shape, shape_name, shape_code; inputs address1: list
# ---------- py3: Python ----------
import rhinoscriptsyntax as rs
import Rhino.Geometry as rg
from System.Net import HttpWebRequest, WebRequest
from System.IO import StreamReader
import json
import clr
#from System.Web.Script.Serialization import JavaScriptSerializer
vworld_key = vworld_key
from math import sin, cos, tan, pi, sqrt
import re

RADIANS_PER_DEGREE = pi/180.0
DEGREES_PER_RADIAN = 180.0/pi

WGS84_A =  6378137.0
WGS84_B =  6356752.31424518
WGS84_F =  0.0033528107
WGS84_E =  0.0818191908
WGS84_EP = 0.0820944379

UTM_K0 =   0.9996
UTM_FE =   500000.0
UTM_FN_N = 0.0
UTM_FN_S = 10000000.0
UTM_E2 =   (WGS84_E*WGS84_E)
UTM_E4 =   (UTM_E2*UTM_E2)
UTM_E6 =   (UTM_E4*UTM_E2)
UTM_EP2 =  (UTM_E2/(1-UTM_E2))

class GPStoUTM(object):
    def __init__(self, **kwargs):
        pass

    def UTM(self, lat, lon):
        '''
        Gets the UTM coordinate without the letter and number.
        '''
        self.m0 = (1 - UTM_E2/4 - 3*UTM_E4/64 - 5*UTM_E6/256)
        self.m1 = -(3*UTM_E2/8 + 3*UTM_E4/32 + 45*UTM_E6/1024)
        self.m2 = (15*UTM_E4/256 + 45*UTM_E6/1024)
        self.m3 = -(35*UTM_E6/3072)

        if lon > 0:
            self.cm = int(lon) - (int(lon) % 6) + 3
        else:
            self.cm = int(lon) - (int(lon) % 6) - 3

        self.rlat = lat * RADIANS_PER_DEGREE
        self.rlon = lon * RADIANS_PER_DEGREE
        self.rlon0 = self.cm * RADIANS_PER_DEGREE

        self.slat = sin(self.rlat)
        self.clat = cos(self.rlat)
        self.tlat = tan(self.rlat)

        if lat > 0:
            self.fn = UTM_FN_N
        else:
            self.fn = UTM_FN_S

        self.T = self.tlat*self.tlat
        self.C = UTM_EP2 * self.clat * self.clat
        self.A = (self.rlon - self.rlon0) * self.clat
        self.M = WGS84_A * (self.m0*self.rlat + self.m1*sin(2*self.rlat) + \
            self.m2*sin(4*self.rlat) + self.m3*sin(6*self.rlat))
        self.V = WGS84_A / sqrt(1 - UTM_E2 * self.slat * self.slat)

        self.x = UTM_FE + UTM_K0 * self.V * (self.A + (1-self.T+self.C)\
            *pow(self.A, 3)/6 +(5-18*self.T+self.T*self.T+72*self.C-58*UTM_EP2)\
            *pow(self.A, 5)/120)

        self.y = self.fn + UTM_K0 * (self.M + self.V * self.tlat * \
            (self.A*self.A/2 + (5-self.T+9*self.C+4*self.C*self.C)* \
            pow(self.A, 4)/24 + ((61-58*self.T+self.T*self.T+600*self.C-\
            330*UTM_EP2) * pow(self.A, 6)/720)))

        return (self.x, self.y)

    def UTMLetterDesignator(self, Lat):
        '''
        Gets the UTM letter only.
        '''
        self.LetterDesignator = 'Z'
        if ((84 >= Lat) and (Lat >= 72)):
            self.LetterDesignator = 'X'
        elif ((72 > Lat) and (Lat >= 64)):
            self.LetterDesignator = 'W'
        elif ((64 > Lat) and (Lat >= 56)):
            self.LetterDesignator = 'V'
        elif ((56 > Lat) and (Lat >= 48)):
            self.LetterDesignator = 'U'
        elif ((48 > Lat) and (Lat >= 40)):
            self.LetterDesignator = 'T'
        elif ((40 > Lat) and (Lat >= 32)):
            self.LetterDesignator = 'S'
        elif ((32 > Lat) and (Lat >= 24)):
            self.LetterDesignator = 'R'
        elif ((24 > Lat) and (Lat >= 16)):
            self.LetterDesignator = 'Q'
        elif ((16 > Lat) and (Lat >= 8)):
            self.LetterDesignator = 'P'
        elif (( 8 > Lat) and (Lat >= 0)):
            self.LetterDesignator = 'N'
        elif (( 0 > Lat) and (Lat >= -8)):
            self.LetterDesignator = 'M'
        elif ((-8 > Lat) and (Lat >= -16)):
            self.LetterDesignator = 'L'
        elif ((-16 > Lat) and (Lat >= -24)):
            self.LetterDesignator = 'K'
        elif ((-24 > Lat) and (Lat >= -32)):
            self.LetterDesignator = 'J'
        elif ((-32 > Lat) and (Lat >= -40)):
            self.LetterDesignator = 'H'
        elif ((-40 > Lat) and (Lat >= -48)):
            self.LetterDesignator = 'G'
        elif ((-48 > Lat) and (Lat >= -56)):
            self.LetterDesignator = 'F'
        elif ((-56 > Lat) and (Lat >= -64)):
            self.LetterDesignator = 'E'
        elif ((-64 > Lat) and (Lat >= -72)):
            self.LetterDesignator = 'D'
        elif ((-72 > Lat) and (Lat >= -80)):
            self.LetterDesignator = 'C'
        return self.LetterDesignator

    def LLtoUTM(self, Lat, Long):
        '''
        Gets the UTM coordinate with the letter and number as inputs also.
        '''
        self.a = WGS84_A;
        self.eccSquared = UTM_E2;
        self.k0 = UTM_K0;

        self.LongTemp = (Long+180)-int((Long+180)/360)*360-180

        self.LatRad = Lat * RADIANS_PER_DEGREE
        self.LongRad = self.LongTemp * RADIANS_PER_DEGREE

        self.ZoneNumber = int((self.LongTemp+180)/6) + 1

        self.LongOrigin = (self.ZoneNumber-1)*6 - 180 + 3
        self.LongOriginRad = self.LongOrigin * RADIANS_PER_DEGREE

        self.eccPrimeSquared = (self.eccSquared)/(1-self.eccSquared);

        self.N = self.a/sqrt(1-self.eccSquared*sin(self.LatRad)*\
            sin(self.LatRad));
        self.T = tan(self.LatRad)*tan(self.LatRad);
        self.C = self.eccPrimeSquared*cos(self.LatRad)*cos(self.LatRad);
        self.A = cos(self.LatRad)*(self.LongRad-self.LongOriginRad);

        self.M = self.a*((1 - self.eccSquared/4 -\
            3*self.eccSquared*self.eccSquared/64 -\
            5*self.eccSquared*self.eccSquared*self.eccSquared/256) * \
            self.LatRad - (3*self.eccSquared/8 + 3*self.eccSquared*\
            self.eccSquared/32 +45*self.eccSquared*self.eccSquared*\
            self.eccSquared/1024)*sin(2*self.LatRad) + (15*self.eccSquared*\
            self.eccSquared/256 + 45*self.eccSquared*self.eccSquared*\
            self.eccSquared/1024)*sin(4*self.LatRad) - (35*self.eccSquared*\
            self.eccSquared*self.eccSquared/3072)*sin(6*self.LatRad))

        self.UTMEasting = float(self.k0*self.N*(self.A+(1-self.T+self.C)*\
            self.A**3/6 + (5-18*self.T+self.T*self.T+72*self.C-58*\
            self.eccPrimeSquared)*self.A**4/120) + 500000.0)

        self.UTMNorthing = float(self.k0*(self.M+self.N*tan(self.LatRad)\
            *(self.A**2/2+(5-self.T+9*self.C+4*self.C**2)*self.A**4/24 + (61-58\
            *self.T+self.T**2+600*self.C-330*self.eccPrimeSquared)\
            *self.A**6/720)))

        if (Lat < 0):
            self.UTMNorthing += 10000000.0

        return (self.UTMEasting, self.UTMNorthing)

    def UTMtoLL(self, UTMNorthing, UTMEasting, UTMNumber, UTMLetter):
        '''
        Gets the latitude and longitude with the UTM letter and number.
        '''
        self.ZoneNumber = int(UTMNumber)
        self.ZoneLetter = UTMLetter

        self.k0 = UTM_K0
        self.a = WGS84_A
        self.eccSquared = UTM_E2
        self.e1 = (1-sqrt(1-self.eccSquared))/(1+sqrt(1-self.eccSquared))

        self.x = UTMEasting - 500000.0
        self.y = UTMNorthing

        if self.ZoneLetter < 'N':
            self.y -= 10000000.0

        self.LongOrigin = (self.ZoneNumber - 1)*6 - 180 + 3
        self.eccPrimeSquared = (self.eccSquared)/(1-self.eccSquared)

        self.M = self.y/self.k0;
        self.mu = self.M/(self.a*(1-self.eccSquared/4-3*self.eccSquared**2/64\
            -5*self.eccSquared**3/256))

        self.phi1Rad = self.mu + ((3*self.e1/2-27*self.e1**3/32)*sin(2*self.mu)\
            + (21*self.e1**2/16-55*self.e1**4/32)*sin(4*self.mu)\
            + (151*self.e1**3/96)*sin(6*self.mu))

        self.N1 = self.a/sqrt(1-self.eccSquared*sin(self.phi1Rad)**2)
        self.T1 = tan(self.phi1Rad)**2
        self.C1 = self.eccPrimeSquared*cos(self.phi1Rad)**2
        self.R1 = self.a*(1-self.eccSquared)/pow(1-self.eccSquared*sin(self.phi1Rad)**2, 1.5)
        self.D = self.x/(self.N1*self.k0)

        self.Lat = self.phi1Rad - ((self.N1*tan(self.phi1Rad)/self.R1)\
            *(self.D**2/2-(5+3*self.T1+10*self.C1-4*self.C1**2-9\
            *self.eccPrimeSquared)*self.D**4/24+(61+90*self.T1+298*self.C1\
            +45*self.T1**2-252*self.eccPrimeSquared-3*self.C1**2)\
            *self.D**6/720))

        self.Lat = self.Lat * DEGREES_PER_RADIAN

        self.Long = ((self.D-(1+2*self.T1+self.C1)*self.D**3/6+(5-2*self.C1\
            +28*self.T1-3*self.C1**2+8*self.eccPrimeSquared+24*self.T1**2)\
            *self.D**5/120)/cos(self.phi1Rad))

        self.Long = self.LongOrigin + self.Long * DEGREES_PER_RADIAN

        return (self.Lat, self.Long)
        
gps = GPStoUTM()

def read(apiurl) : 
    request = WebRequest.Create(apiurl)
    request.Method = "GET"
    response = request.GetResponse()
    stream = response.GetResponseStream()
    reader = StreamReader(stream)
    responseText = reader.ReadToEnd()
    return json.loads(responseText)

def terrain(ymin,xmin,ymax,xmax, typeCol, vworld_key) :
    params = {
        "SERVICE": "WFS",
        "REQUEST": "GetFeature",
        "TYPENAME": typeCol,
        "BBOX": "{0},{1},{2},{3}".format(ymin, xmin, ymax, xmax),
        "VERSION": "1.1.0",
        "MAXFEATURES": "1000",
        "SRSNAME": "EPSG:4326",
        "OUTPUT": "application/json",
        "EXCEPTIONS": "text/xml",
        "KEY": vworld_key
    }

    apiurl = "https://api.vworld.kr/req/wfs"

    # params 딕셔너리를 URL 쿼리 스트링으로 변환
    query_string = "&".join(["{0}={1}".format(key, value) for key, value in params.items()])
    full_url = "{0}?{1}".format(apiurl,query_string)
    data = read(full_url)
    return data


def AddressToCoord(input_address, vworld_key):
    apiurl = "https://api.vworld.kr/req/address?service=address&request=getcoord&crs=EPSG:4326&address={0}&format=json&type=road&key={1}".format(input_address, vworld_key)
    request = WebRequest.Create(apiurl)
    request.Method = "GET"
    response = request.GetResponse()
    stream = response.GetResponseStream()
    reader = StreamReader(stream)
    responseText = reader.ReadToEnd()
    response_data = json.loads(responseText)
    x_coord = response_data['response']['result']['point']['x']
    y_coord = response_data['response']['result']['point']['y']
    return float(x_coord), float(y_coord)
    
info = {}
select_type = []
select_type.append(typeCol)
dong_geom = []
dong_name = []
dong_code = []
nodata = []
nodataid = []



def remove_numbers(string):
    return re.sub(r'\d+', '', string)


if Run : 
    xmin, ymin = AddressToCoord(address1, vworld_key)
    xmax, ymax = AddressToCoord(address2, vworld_key)
    if(ymin > ymax) : ymin, ymax = ymax, ymin
    if(xmin > xmax) : xmin, xmax = xmax, xmin
    data = terrain(ymin, xmin, ymax, xmax, select_type[0], vworld_key)
    try: 
        info = data
        features = info["features"]
        for feature in features : 
            coords = feature['geometry']['coordinates']
            feat_name = feature['properties']['full_nm']
            print(feature)
            if "서울" in feat_name : 
                points = []
                for coord in coords[0][0] : 
                    try:
                        x, y = gps.LLtoUTM(coord[1], coord[0])
                        pt = rg.Point3d(x, y, 0)
                        points.append(pt)
                    except: continue
                try : 
                    polyline = rs.AddPolyline(points)
                    dong_geom.append(polyline)
                    dong_name.append(feat_name)
                    dong_code.append(feature['properties']['emd_cd'])
                except : pass
    except : pass

shape = dong_geom
shape_name = dong_name
shape_code = dong_code
# ---------- end py3 ----------
py3_2 = Python3Script(
    Run=toggle_2,
    address1="인천 남동구 도림동",
    address2="경기 남양주시 해밀예당1로 272",
    typeCol=행정동_2,
    vworld_key="D4F65F8F-A3B9-3D6C-9F94-06A911D059F2")  # -> out, info, shape, shape_name, shape_code; inputs address1: list; same code as py3
py3_3 = Python3Script(
    Run=toggle_3,
    address1="인천 남동구 도림동",
    address2="경기 남양주시 해밀예당1로 272",
    typeCol="lt_l_aispath",
    typeStyle="lt_l_aispath",
    vworld_key="D4F65F8F-A3B9-3D6C-9F94-06A911D059F2")  # -> out, info, shape, shape_name, shape_code; inputs address1: list
# ---------- py3_3: Python ----------
import rhinoscriptsyntax as rs
import Rhino.Geometry as rg
from System.Net import HttpWebRequest, WebRequest
from System.IO import StreamReader
import json
import clr
#from System.Web.Script.Serialization import JavaScriptSerializer
vworld_key = vworld_key
from math import sin, cos, tan, pi, sqrt
import re

RADIANS_PER_DEGREE = pi/180.0
DEGREES_PER_RADIAN = 180.0/pi

WGS84_A =  6378137.0
WGS84_B =  6356752.31424518
WGS84_F =  0.0033528107
WGS84_E =  0.0818191908
WGS84_EP = 0.0820944379

UTM_K0 =   0.9996
UTM_FE =   500000.0
UTM_FN_N = 0.0
UTM_FN_S = 10000000.0
UTM_E2 =   (WGS84_E*WGS84_E)
UTM_E4 =   (UTM_E2*UTM_E2)
UTM_E6 =   (UTM_E4*UTM_E2)
UTM_EP2 =  (UTM_E2/(1-UTM_E2))

class GPStoUTM(object):
    def __init__(self, **kwargs):
        pass

    def UTM(self, lat, lon):
        '''
        Gets the UTM coordinate without the letter and number.
        '''
        self.m0 = (1 - UTM_E2/4 - 3*UTM_E4/64 - 5*UTM_E6/256)
        self.m1 = -(3*UTM_E2/8 + 3*UTM_E4/32 + 45*UTM_E6/1024)
        self.m2 = (15*UTM_E4/256 + 45*UTM_E6/1024)
        self.m3 = -(35*UTM_E6/3072)

        if lon > 0:
            self.cm = int(lon) - (int(lon) % 6) + 3
        else:
            self.cm = int(lon) - (int(lon) % 6) - 3

        self.rlat = lat * RADIANS_PER_DEGREE
        self.rlon = lon * RADIANS_PER_DEGREE
        self.rlon0 = self.cm * RADIANS_PER_DEGREE

        self.slat = sin(self.rlat)
        self.clat = cos(self.rlat)
        self.tlat = tan(self.rlat)

        if lat > 0:
            self.fn = UTM_FN_N
        else:
            self.fn = UTM_FN_S

        self.T = self.tlat*self.tlat
        self.C = UTM_EP2 * self.clat * self.clat
        self.A = (self.rlon - self.rlon0) * self.clat
        self.M = WGS84_A * (self.m0*self.rlat + self.m1*sin(2*self.rlat) + \
            self.m2*sin(4*self.rlat) + self.m3*sin(6*self.rlat))
        self.V = WGS84_A / sqrt(1 - UTM_E2 * self.slat * self.slat)

        self.x = UTM_FE + UTM_K0 * self.V * (self.A + (1-self.T+self.C)\
            *pow(self.A, 3)/6 +(5-18*self.T+self.T*self.T+72*self.C-58*UTM_EP2)\
            *pow(self.A, 5)/120)

        self.y = self.fn + UTM_K0 * (self.M + self.V * self.tlat * \
            (self.A*self.A/2 + (5-self.T+9*self.C+4*self.C*self.C)* \
            pow(self.A, 4)/24 + ((61-58*self.T+self.T*self.T+600*self.C-\
            330*UTM_EP2) * pow(self.A, 6)/720)))

        return (self.x, self.y)

    def UTMLetterDesignator(self, Lat):
        '''
        Gets the UTM letter only.
        '''
        self.LetterDesignator = 'Z'
        if ((84 >= Lat) and (Lat >= 72)):
            self.LetterDesignator = 'X'
        elif ((72 > Lat) and (Lat >= 64)):
            self.LetterDesignator = 'W'
        elif ((64 > Lat) and (Lat >= 56)):
            self.LetterDesignator = 'V'
        elif ((56 > Lat) and (Lat >= 48)):
            self.LetterDesignator = 'U'
        elif ((48 > Lat) and (Lat >= 40)):
            self.LetterDesignator = 'T'
        elif ((40 > Lat) and (Lat >= 32)):
            self.LetterDesignator = 'S'
        elif ((32 > Lat) and (Lat >= 24)):
            self.LetterDesignator = 'R'
        elif ((24 > Lat) and (Lat >= 16)):
            self.LetterDesignator = 'Q'
        elif ((16 > Lat) and (Lat >= 8)):
            self.LetterDesignator = 'P'
        elif (( 8 > Lat) and (Lat >= 0)):
            self.LetterDesignator = 'N'
        elif (( 0 > Lat) and (Lat >= -8)):
            self.LetterDesignator = 'M'
        elif ((-8 > Lat) and (Lat >= -16)):
            self.LetterDesignator = 'L'
        elif ((-16 > Lat) and (Lat >= -24)):
            self.LetterDesignator = 'K'
        elif ((-24 > Lat) and (Lat >= -32)):
            self.LetterDesignator = 'J'
        elif ((-32 > Lat) and (Lat >= -40)):
            self.LetterDesignator = 'H'
        elif ((-40 > Lat) and (Lat >= -48)):
            self.LetterDesignator = 'G'
        elif ((-48 > Lat) and (Lat >= -56)):
            self.LetterDesignator = 'F'
        elif ((-56 > Lat) and (Lat >= -64)):
            self.LetterDesignator = 'E'
        elif ((-64 > Lat) and (Lat >= -72)):
            self.LetterDesignator = 'D'
        elif ((-72 > Lat) and (Lat >= -80)):
            self.LetterDesignator = 'C'
        return self.LetterDesignator

    def LLtoUTM(self, Lat, Long):
        '''
        Gets the UTM coordinate with the letter and number as inputs also.
        '''
        self.a = WGS84_A;
        self.eccSquared = UTM_E2;
        self.k0 = UTM_K0;

        self.LongTemp = (Long+180)-int((Long+180)/360)*360-180

        self.LatRad = Lat * RADIANS_PER_DEGREE
        self.LongRad = self.LongTemp * RADIANS_PER_DEGREE

        self.ZoneNumber = int((self.LongTemp+180)/6) + 1

        self.LongOrigin = (self.ZoneNumber-1)*6 - 180 + 3
        self.LongOriginRad = self.LongOrigin * RADIANS_PER_DEGREE

        self.eccPrimeSquared = (self.eccSquared)/(1-self.eccSquared);

        self.N = self.a/sqrt(1-self.eccSquared*sin(self.LatRad)*\
            sin(self.LatRad));
        self.T = tan(self.LatRad)*tan(self.LatRad);
        self.C = self.eccPrimeSquared*cos(self.LatRad)*cos(self.LatRad);
        self.A = cos(self.LatRad)*(self.LongRad-self.LongOriginRad);

        self.M = self.a*((1 - self.eccSquared/4 -\
            3*self.eccSquared*self.eccSquared/64 -\
            5*self.eccSquared*self.eccSquared*self.eccSquared/256) * \
            self.LatRad - (3*self.eccSquared/8 + 3*self.eccSquared*\
            self.eccSquared/32 +45*self.eccSquared*self.eccSquared*\
            self.eccSquared/1024)*sin(2*self.LatRad) + (15*self.eccSquared*\
            self.eccSquared/256 + 45*self.eccSquared*self.eccSquared*\
            self.eccSquared/1024)*sin(4*self.LatRad) - (35*self.eccSquared*\
            self.eccSquared*self.eccSquared/3072)*sin(6*self.LatRad))

        self.UTMEasting = float(self.k0*self.N*(self.A+(1-self.T+self.C)*\
            self.A**3/6 + (5-18*self.T+self.T*self.T+72*self.C-58*\
            self.eccPrimeSquared)*self.A**4/120) + 500000.0)

        self.UTMNorthing = float(self.k0*(self.M+self.N*tan(self.LatRad)\
            *(self.A**2/2+(5-self.T+9*self.C+4*self.C**2)*self.A**4/24 + (61-58\
            *self.T+self.T**2+600*self.C-330*self.eccPrimeSquared)\
            *self.A**6/720)))

        if (Lat < 0):
            self.UTMNorthing += 10000000.0

        return (self.UTMEasting, self.UTMNorthing)

    def UTMtoLL(self, UTMNorthing, UTMEasting, UTMNumber, UTMLetter):
        '''
        Gets the latitude and longitude with the UTM letter and number.
        '''
        self.ZoneNumber = int(UTMNumber)
        self.ZoneLetter = UTMLetter

        self.k0 = UTM_K0
        self.a = WGS84_A
        self.eccSquared = UTM_E2
        self.e1 = (1-sqrt(1-self.eccSquared))/(1+sqrt(1-self.eccSquared))

        self.x = UTMEasting - 500000.0
        self.y = UTMNorthing

        if self.ZoneLetter < 'N':
            self.y -= 10000000.0

        self.LongOrigin = (self.ZoneNumber - 1)*6 - 180 + 3
        self.eccPrimeSquared = (self.eccSquared)/(1-self.eccSquared)

        self.M = self.y/self.k0;
        self.mu = self.M/(self.a*(1-self.eccSquared/4-3*self.eccSquared**2/64\
            -5*self.eccSquared**3/256))

        self.phi1Rad = self.mu + ((3*self.e1/2-27*self.e1**3/32)*sin(2*self.mu)\
            + (21*self.e1**2/16-55*self.e1**4/32)*sin(4*self.mu)\
            + (151*self.e1**3/96)*sin(6*self.mu))

        self.N1 = self.a/sqrt(1-self.eccSquared*sin(self.phi1Rad)**2)
        self.T1 = tan(self.phi1Rad)**2
        self.C1 = self.eccPrimeSquared*cos(self.phi1Rad)**2
        self.R1 = self.a*(1-self.eccSquared)/pow(1-self.eccSquared*sin(self.phi1Rad)**2, 1.5)
        self.D = self.x/(self.N1*self.k0)

        self.Lat = self.phi1Rad - ((self.N1*tan(self.phi1Rad)/self.R1)\
            *(self.D**2/2-(5+3*self.T1+10*self.C1-4*self.C1**2-9\
            *self.eccPrimeSquared)*self.D**4/24+(61+90*self.T1+298*self.C1\
            +45*self.T1**2-252*self.eccPrimeSquared-3*self.C1**2)\
            *self.D**6/720))

        self.Lat = self.Lat * DEGREES_PER_RADIAN

        self.Long = ((self.D-(1+2*self.T1+self.C1)*self.D**3/6+(5-2*self.C1\
            +28*self.T1-3*self.C1**2+8*self.eccPrimeSquared+24*self.T1**2)\
            *self.D**5/120)/cos(self.phi1Rad))

        self.Long = self.LongOrigin + self.Long * DEGREES_PER_RADIAN

        return (self.Lat, self.Long)
        
gps = GPStoUTM()

def read(apiurl) : 
    request = WebRequest.Create(apiurl)
    request.Method = "GET"
    response = request.GetResponse()
    stream = response.GetResponseStream()
    reader = StreamReader(stream)
    responseText = reader.ReadToEnd()
    return json.loads(responseText)

def terrain(ymin,xmin,ymax,xmax, typeCol, vworld_key) :
    params = {
        "SERVICE": "WFS",
        "REQUEST": "GetFeature",
        "TYPENAME": typeCol,
        "BBOX": "{0},{1},{2},{3}".format(ymin, xmin, ymax, xmax),
        "VERSION": "1.1.0",
        "MAXFEATURES": "1000",
        "SRSNAME": "EPSG:4326",
        "OUTPUT": "application/json",
        "EXCEPTIONS": "text/xml",
        "KEY": vworld_key
    }

    apiurl = "https://api.vworld.kr/req/wfs"

    # params 딕셔너리를 URL 쿼리 스트링으로 변환
    query_string = "&".join(["{0}={1}".format(key, value) for key, value in params.items()])
    full_url = "{0}?{1}".format(apiurl,query_string)
    data = read(full_url)
    return data

def WMS(ymin,xmin,ymax,xmax, typeCol, typeStyle, vworld_key) :
    params = {
        "SERVICE": "WMS",
        "REQUEST": "GetFeatureInfo",
        "VERSION": "1.3.0",
        "LAYERS": typeCol,
        "STYLES": typeStyle,
        "CRS": "EPSG:4326",
        "BBOX": "{0},{1},{2},{3}".format(ymin, xmin, ymax, xmax),
        "WIDTH": "256",
        "HEIGHT": "256",
        "QUERY_LAYERS": typeCol,
        "INFO_FORMAT": "application/json",  # JSON 포맷 요청
        "FEATURE_COUNT": "1000",
        "EXCEPTIONS": "text/xml",
        "I": 0,
        "J": 100,
        "KEY": vworld_key,
    }

    apiurl = "https://api.vworld.kr/req/wms"

    # params 딕셔너리를 URL 쿼리 스트링으로 변환
    query_string = "&".join(["{0}={1}".format(key, value) for key, value in params.items()])
    full_url = "{0}?{1}".format(apiurl,query_string)
    data = read(full_url)
    print(full_url)
    return data


def AddressToCoord(input_address, vworld_key):
    apiurl = "https://api.vworld.kr/req/address?service=address&request=getcoord&crs=EPSG:4326&address={0}&format=json&type=road&key={1}".format(input_address, vworld_key)
    request = WebRequest.Create(apiurl)
    request.Method = "GET"
    response = request.GetResponse()
    stream = response.GetResponseStream()
    reader = StreamReader(stream)
    responseText = reader.ReadToEnd()
    response_data = json.loads(responseText)
    x_coord = response_data['response']['result']['point']['x']
    y_coord = response_data['response']['result']['point']['y']
    return float(x_coord), float(y_coord)
    
info = {}
select_type = []
select_type.append(typeCol)
dong_geom = []
dong_name = []
dong_code = []
select_style = []
select_style.append(typeStyle)



if Run : 
    xmin, ymin = AddressToCoord(address1, vworld_key)
    xmax, ymax = AddressToCoord(address2, vworld_key)
    if(ymin > ymax) : ymin, ymax = ymax, ymin
    if(xmin > xmax) : xmin, xmax = xmax, xmin
    data = WMS(ymin, xmin, ymax, xmax, select_type[0], select_style[0], vworld_key)
    print(data)
    # try: 
    #     info = data
    #     features = info["features"]
    #     for feature in features : 
    #         coords = feature['geometry']['coordinates']
    #         feat_name = feature['properties']['full_nm']
    #         print(feature)
    #         if "서울" in feat_name : 
    #             points = []
    #             for coord in coords[0][0] : 
    #                 try:
    #                     x, y = gps.LLtoUTM(coord[1], coord[0])
    #                     pt = rg.Point3d(x, y, 0)
    #                     points.append(pt)
    #                 except: continue
    #             try : 
    #                 polyline = rs.AddPolyline(points)
    #                 dong_geom.append(polyline)
    #                 dong_name.append(feat_name)
    #                 dong_code.append(feature['properties']['emd_cd'])
    #             except : pass
    # except : pass

shape = dong_geom
shape_name = dong_name
shape_code = dong_code
# ---------- end py3_3 ----------
path = FilePath("C:\Users\BaekInchan\Downloads\서울시 주요 116장소명 목록 (3).xlsx")
url = Python3Script(URL=panel, api_key="63676847796269633538616f634374", service="citydata", path=path)  # -> out, location, data; inputs URL: String, path: String
# ---------- url: Python ----------
import rhinoscriptsyntax as rs
from System.Net import HttpWebRequest, WebRequest
from System.IO import StreamReader
import json
import clr
import xml.etree.ElementTree as ET
import pandas as pd

file_path = path  
df = pd.read_excel(file_path, engine='openpyxl')

def read(apiurl): 
    request = WebRequest.Create(apiurl)
    request.Method = "GET"
    response = request.GetResponse()
    stream = response.GetResponseStream()
    reader = StreamReader(stream)
    responseText = reader.ReadToEnd()
    return responseText

def parse_xml_response(xml_response, target_path):
    """특정 XML 경로에 있는 데이터를 파싱."""
    root = ET.fromstring(xml_response)
    for tag in target_path:
        root = root.find(tag)  # 대상 태그로 이동
        if root is None:  # 태그가 없는 경우
            return None
    return root.text if root is not None else None

area_list = df['AREA_CD'].tolist()
url = URL
key = api_key
service = service

data = []
location = []

for id, i in enumerate(area_list): 
    if id >= 1: break  # 테스트 목적으로 10개까지만 처리
    try : 
        apiurl = f"{url}/{key}/xml/{service}/1/1/{i}"
        response = read(apiurl)
        target_path = ['CITYDATA', 'SUB_STTS', 'SUB_STTS', 'SUB_STN_RADDR']
        extracted_data = parse_xml_response(response, target_path)
        if extracted_data != None : 
            data.append(' '.join(extracted_data.split()[:-2]))
            location.append(i)
    except : continue

data = data
location = location
print(data)
# ---------- end url ----------
행정동_3 = Panel("lt_c_ademd_info")
area = Area(Geometry=py3.shape)  # -> Area, Centroid
area_2 = Area(Geometry=py3_2.shape)  # -> Area, Centroid
py3_4 = Python3Script()  # -> gps
# ---------- py3_4: Python ----------
import rhinoscriptsyntax as rs
import Rhino.Geometry as rg
from System.Net import HttpWebRequest, WebRequest
from System.IO import StreamReader
import json
import clr
from math import sin, cos, tan, pi, sqrt
import re

RADIANS_PER_DEGREE = pi/180.0
DEGREES_PER_RADIAN = 180.0/pi

WGS84_A =  6378137.0
WGS84_B =  6356752.31424518
WGS84_F =  0.0033528107
WGS84_E =  0.0818191908
WGS84_EP = 0.0820944379

UTM_K0 =   0.9996
UTM_FE =   500000.0
UTM_FN_N = 0.0
UTM_FN_S = 10000000.0
UTM_E2 =   (WGS84_E*WGS84_E)
UTM_E4 =   (UTM_E2*UTM_E2)
UTM_E6 =   (UTM_E4*UTM_E2)
UTM_EP2 =  (UTM_E2/(1-UTM_E2))

class GPStoUTM(object):
    def __init__(self, **kwargs):
        pass

    def UTM(self, lat, lon):
        '''
        Gets the UTM coordinate without the letter and number.
        '''
        self.m0 = (1 - UTM_E2/4 - 3*UTM_E4/64 - 5*UTM_E6/256)
        self.m1 = -(3*UTM_E2/8 + 3*UTM_E4/32 + 45*UTM_E6/1024)
        self.m2 = (15*UTM_E4/256 + 45*UTM_E6/1024)
        self.m3 = -(35*UTM_E6/3072)

        if lon > 0:
            self.cm = int(lon) - (int(lon) % 6) + 3
        else:
            self.cm = int(lon) - (int(lon) % 6) - 3

        self.rlat = lat * RADIANS_PER_DEGREE
        self.rlon = lon * RADIANS_PER_DEGREE
        self.rlon0 = self.cm * RADIANS_PER_DEGREE

        self.slat = sin(self.rlat)
        self.clat = cos(self.rlat)
        self.tlat = tan(self.rlat)

        if lat > 0:
            self.fn = UTM_FN_N
        else:
            self.fn = UTM_FN_S

        self.T = self.tlat*self.tlat
        self.C = UTM_EP2 * self.clat * self.clat
        self.A = (self.rlon - self.rlon0) * self.clat
        self.M = WGS84_A * (self.m0*self.rlat + self.m1*sin(2*self.rlat) + \
            self.m2*sin(4*self.rlat) + self.m3*sin(6*self.rlat))
        self.V = WGS84_A / sqrt(1 - UTM_E2 * self.slat * self.slat)

        self.x = UTM_FE + UTM_K0 * self.V * (self.A + (1-self.T+self.C)\
            *pow(self.A, 3)/6 +(5-18*self.T+self.T*self.T+72*self.C-58*UTM_EP2)\
            *pow(self.A, 5)/120)

        self.y = self.fn + UTM_K0 * (self.M + self.V * self.tlat * \
            (self.A*self.A/2 + (5-self.T+9*self.C+4*self.C*self.C)* \
            pow(self.A, 4)/24 + ((61-58*self.T+self.T*self.T+600*self.C-\
            330*UTM_EP2) * pow(self.A, 6)/720)))

        return (self.x, self.y)

    def UTMLetterDesignator(self, Lat):
        '''
        Gets the UTM letter only.
        '''
        self.LetterDesignator = 'Z'
        if ((84 >= Lat) and (Lat >= 72)):
            self.LetterDesignator = 'X'
        elif ((72 > Lat) and (Lat >= 64)):
            self.LetterDesignator = 'W'
        elif ((64 > Lat) and (Lat >= 56)):
            self.LetterDesignator = 'V'
        elif ((56 > Lat) and (Lat >= 48)):
            self.LetterDesignator = 'U'
        elif ((48 > Lat) and (Lat >= 40)):
            self.LetterDesignator = 'T'
        elif ((40 > Lat) and (Lat >= 32)):
            self.LetterDesignator = 'S'
        elif ((32 > Lat) and (Lat >= 24)):
            self.LetterDesignator = 'R'
        elif ((24 > Lat) and (Lat >= 16)):
            self.LetterDesignator = 'Q'
        elif ((16 > Lat) and (Lat >= 8)):
            self.LetterDesignator = 'P'
        elif (( 8 > Lat) and (Lat >= 0)):
            self.LetterDesignator = 'N'
        elif (( 0 > Lat) and (Lat >= -8)):
            self.LetterDesignator = 'M'
        elif ((-8 > Lat) and (Lat >= -16)):
            self.LetterDesignator = 'L'
        elif ((-16 > Lat) and (Lat >= -24)):
            self.LetterDesignator = 'K'
        elif ((-24 > Lat) and (Lat >= -32)):
            self.LetterDesignator = 'J'
        elif ((-32 > Lat) and (Lat >= -40)):
            self.LetterDesignator = 'H'
        elif ((-40 > Lat) and (Lat >= -48)):
            self.LetterDesignator = 'G'
        elif ((-48 > Lat) and (Lat >= -56)):
            self.LetterDesignator = 'F'
        elif ((-56 > Lat) and (Lat >= -64)):
            self.LetterDesignator = 'E'
        elif ((-64 > Lat) and (Lat >= -72)):
            self.LetterDesignator = 'D'
        elif ((-72 > Lat) and (Lat >= -80)):
            self.LetterDesignator = 'C'
        return self.LetterDesignator

    def LLtoUTM(self, Lat, Long):
        '''
        Gets the UTM coordinate with the letter and number as inputs also.
        '''
        self.a = WGS84_A;
        self.eccSquared = UTM_E2;
        self.k0 = UTM_K0;

        self.LongTemp = (Long+180)-int((Long+180)/360)*360-180

        self.LatRad = Lat * RADIANS_PER_DEGREE
        self.LongRad = self.LongTemp * RADIANS_PER_DEGREE

        self.ZoneNumber = int((self.LongTemp+180)/6) + 1

        self.LongOrigin = (self.ZoneNumber-1)*6 - 180 + 3
        self.LongOriginRad = self.LongOrigin * RADIANS_PER_DEGREE

        self.eccPrimeSquared = (self.eccSquared)/(1-self.eccSquared);

        self.N = self.a/sqrt(1-self.eccSquared*sin(self.LatRad)*\
            sin(self.LatRad));
        self.T = tan(self.LatRad)*tan(self.LatRad);
        self.C = self.eccPrimeSquared*cos(self.LatRad)*cos(self.LatRad);
        self.A = cos(self.LatRad)*(self.LongRad-self.LongOriginRad);

        self.M = self.a*((1 - self.eccSquared/4 -\
            3*self.eccSquared*self.eccSquared/64 -\
            5*self.eccSquared*self.eccSquared*self.eccSquared/256) * \
            self.LatRad - (3*self.eccSquared/8 + 3*self.eccSquared*\
            self.eccSquared/32 +45*self.eccSquared*self.eccSquared*\
            self.eccSquared/1024)*sin(2*self.LatRad) + (15*self.eccSquared*\
            self.eccSquared/256 + 45*self.eccSquared*self.eccSquared*\
            self.eccSquared/1024)*sin(4*self.LatRad) - (35*self.eccSquared*\
            self.eccSquared*self.eccSquared/3072)*sin(6*self.LatRad))

        self.UTMEasting = float(self.k0*self.N*(self.A+(1-self.T+self.C)*\
            self.A**3/6 + (5-18*self.T+self.T*self.T+72*self.C-58*\
            self.eccPrimeSquared)*self.A**4/120) + 500000.0)

        self.UTMNorthing = float(self.k0*(self.M+self.N*tan(self.LatRad)\
            *(self.A**2/2+(5-self.T+9*self.C+4*self.C**2)*self.A**4/24 + (61-58\
            *self.T+self.T**2+600*self.C-330*self.eccPrimeSquared)\
            *self.A**6/720)))

        if (Lat < 0):
            self.UTMNorthing += 10000000.0

        return (self.UTMEasting, self.UTMNorthing)

    def UTMtoLL(self, UTMNorthing, UTMEasting, UTMNumber, UTMLetter):
        '''
        Gets the latitude and longitude with the UTM letter and number.
        '''
        self.ZoneNumber = int(UTMNumber)
        self.ZoneLetter = UTMLetter

        self.k0 = UTM_K0
        self.a = WGS84_A
        self.eccSquared = UTM_E2
        self.e1 = (1-sqrt(1-self.eccSquared))/(1+sqrt(1-self.eccSquared))

        self.x = UTMEasting - 500000.0
        self.y = UTMNorthing

        if self.ZoneLetter < 'N':
            self.y -= 10000000.0

        self.LongOrigin = (self.ZoneNumber - 1)*6 - 180 + 3
        self.eccPrimeSquared = (self.eccSquared)/(1-self.eccSquared)

        self.M = self.y/self.k0;
        self.mu = self.M/(self.a*(1-self.eccSquared/4-3*self.eccSquared**2/64\
            -5*self.eccSquared**3/256))

        self.phi1Rad = self.mu + ((3*self.e1/2-27*self.e1**3/32)*sin(2*self.mu)\
            + (21*self.e1**2/16-55*self.e1**4/32)*sin(4*self.mu)\
            + (151*self.e1**3/96)*sin(6*self.mu))

        self.N1 = self.a/sqrt(1-self.eccSquared*sin(self.phi1Rad)**2)
        self.T1 = tan(self.phi1Rad)**2
        self.C1 = self.eccPrimeSquared*cos(self.phi1Rad)**2
        self.R1 = self.a*(1-self.eccSquared)/pow(1-self.eccSquared*sin(self.phi1Rad)**2, 1.5)
        self.D = self.x/(self.N1*self.k0)

        self.Lat = self.phi1Rad - ((self.N1*tan(self.phi1Rad)/self.R1)\
            *(self.D**2/2-(5+3*self.T1+10*self.C1-4*self.C1**2-9\
            *self.eccPrimeSquared)*self.D**4/24+(61+90*self.T1+298*self.C1\
            +45*self.T1**2-252*self.eccPrimeSquared-3*self.C1**2)\
            *self.D**6/720))

        self.Lat = self.Lat * DEGREES_PER_RADIAN

        self.Long = ((self.D-(1+2*self.T1+self.C1)*self.D**3/6+(5-2*self.C1\
            +28*self.T1-3*self.C1**2+8*self.eccPrimeSquared+24*self.T1**2)\
            *self.D**5/120)/cos(self.phi1Rad))

        self.Long = self.LongOrigin + self.Long * DEGREES_PER_RADIAN

        return (self.Lat, self.Long)
        
gps = GPStoUTM()
# ---------- end py3_4 ----------
py3_5 = Python3Script()  # -> gps; same code as py3_4
larger = LargerThan(FirstNumber=area_2.Area, SecondNumber=Slider(100, range=0..100))  # -> LargerThan, OrEqualTo
larger_2 = LargerThan(FirstNumber=area.Area, SecondNumber=Slider(100, range=0..100))  # -> LargerThan, OrEqualTo
path_2 = FilePath("C:\Users\BaekInchan\Downloads\jscode20240208\KIKmix.20240208.xlsx")
path_3 = FilePath("C:\Users\BaekInchan\Downloads\jscode20240208\KIKmix.20240208.xlsx")
py3_6 = Python3Script(gps=py3_4, vworld_key="D4F65F8F-A3B9-3D6C-9F94-06A911D059F2")  # -> out, location_pt, location_name, shape_name, shape, shape_code; inputs location: list of String, data: list of String, typeCol: String, vworld_key: String
# ---------- py3_6: Python ----------
import rhinoscriptsyntax as rs
import Rhino.Geometry as rg
from System.Net import HttpWebRequest, WebRequest
from System.IO import StreamReader
import json
import clr
from math import sin, cos, tan, pi, sqrt
import re

vworld_key = vworld_key
gps = gps


def read(apiurl) : 
    request = WebRequest.Create(apiurl)
    request.Method = "GET"
    response = request.GetResponse()
    stream = response.GetResponseStream()
    reader = StreamReader(stream)
    responseText = reader.ReadToEnd()
    return json.loads(responseText)

def terrain(ymin,xmin,ymax,xmax, typeCol, vworld_key) :
    params = {
        "SERVICE": "WFS",
        "REQUEST": "GetFeature",
        "TYPENAME": typeCol,
        "BBOX": "{0},{1},{2},{3}".format(ymin, xmin, ymax, xmax),
        "VERSION": "1.1.0",
        "MAXFEATURES": "1000",
        "SRSNAME": "EPSG:4326",
        "OUTPUT": "application/json",
        "EXCEPTIONS": "text/xml",
        "KEY": vworld_key
    }

    apiurl = "https://api.vworld.kr/req/wfs"

    # params 딕셔너리를 URL 쿼리 스트링으로 변환
    query_string = "&".join(["{0}={1}".format(key, value) for key, value in params.items()])
    full_url = "{0}?{1}".format(apiurl,query_string)
    data = read(full_url)
    return data


def AddressToCoord(input_address, vworld_key):
    apiurl = "https://api.vworld.kr/req/address?service=address&request=getcoord&crs=EPSG:4326&address={0}&format=json&type=road&key={1}".format(input_address, vworld_key)
    request = WebRequest.Create(apiurl)
    request.Method = "GET"
    response = request.GetResponse()
    stream = response.GetResponseStream()
    reader = StreamReader(stream)
    responseText = reader.ReadToEnd()
    response_data = json.loads(responseText)
    x_coord = response_data['response']['result']['point']['x']
    y_coord = response_data['response']['result']['point']['y']
    return float(x_coord), float(y_coord)


info = {}
select_type = []
select_type.append(typeCol)
dong_geom = []
dong_name = []
dong_code = []
location_pt = []
location_name = []

data = data
location = location

for id, d in enumerate(data) :
    try: 
        xmin, ymin = AddressToCoord(d, vworld_key)
        data = terrain(ymin, xmin, ymin, xmin, select_type[0], vworld_key)
        p, q = gps.LLtoUTM(ymin, xmin)
        info = data
        features = info["features"]
        for feature in features : 
            coords = feature['geometry']['coordinates']
            points = []
            for coord in coords[0][0] : 
                try:
                    x, y = gps.LLtoUTM(coord[1], coord[0])
                    pt = rg.Point3d(x, y, 0)
                    points.append(pt)
                except: 
                    print('1')
            try : 
                polyline = rs.AddPolyline(points)
                dong_geom.append(polyline)
                dong_code.append(feature['properties']['emd_cd'])
                location_name.append(location[id])
                location_pt.append(rg.Point3d(p, q, 0))
            except : continue
    except : pass

shape = dong_geom
shape_name = dong_name
shape_code = dong_code
location_pt = location_pt
location_name = location_name
print(location)
# ---------- end py3_6 ----------
dong_to_bub = Python3Script(path=path_2)  # -> out, df; inputs path: String
# ---------- dong_to_bub: Python ----------
# requirements: openpyxl
import locale
locale.setlocale(locale.LC_ALL, 'en_US.UTF-8')
import openpyxl
import pandas as pd
file_path = path  
df = pd.read_excel(file_path, engine='openpyxl')
df = df[df['시도명'].str.contains('서울특별시')]
df['address'] = df['시도명'] + ' ' + df['시군구명'] + ' ' + df['동리명']
df = df
# ---------- end dong_to_bub ----------
dong_to_bub_2 = Python3Script(path=path_3)  # -> out, df; inputs path: String; same code as dong_to_bub
py3_7 = Python3Script(gps=py3_5, location=url.location, data=url.data, typeCol=행정동_3, vworld_key="D4F65F8F-A3B9-3D6C-9F94-06A911D059F2")  # -> out, location_pt, location_name, shape_name, shape, shape_code; inputs location: list of String, data: list of String, typeCol: String, vworld_key: String; same code as py3_6
cull = CullPattern(List=py3.shape, CullPattern=larger_2.LargerThan)
cull_2 = CullPattern(List=py3.shape_code, CullPattern=larger_2.LargerThan)
cull_3 = CullPattern(List=py3_2.shape, CullPattern=larger.LargerThan)
cull_4 = CullPattern(List=py3_2.shape_code, CullPattern=larger.LargerThan)
path_4 = FilePath("C:\Users\BaekInchan\Downloads\행정안전부_지역별(행정동) 성별 연령별 주민등록 인구수_20241130.csv")
path_5 = FilePath("C:\Users\BaekInchan\Downloads\서울시 상권분석서비스(소득소비-행정동).csv")
py3_8 = Python3Script(df=dong_to_bub_2.df, file_population=path_4, shape_code=cull_4)  # -> out, result; inputs shape_code: list of String
# ---------- py3_8: Python ----------
import pandas as pd
from collections import defaultdict

df_p = pd.read_csv(file_population, encoding = 'cp949')

dictionary = defaultdict(int)

shape_code = list(map(lambda x : int(x + '00'), shape_code))
result = []

def hang(k) : 
    h = df['행정동코드'][df['법정동코드']==k]
    return h

for i in shape_code : 
    k = list(set(hang(i)))
    pop = 0
    for j in k : 
        ret = df_p['계'][df_p['행정기관코드'] == j].values[0]
        pop += int(ret)
    result.append(pop)

result = result
# ---------- end py3_8 ----------
py3_9 = Python3Script(df=dong_to_bub.df, shape_code=cull_2, path=path_5)  # -> out, result; inputs shape_code: list of String
# ---------- py3_9: Python ----------
import pandas as pd
from collections import defaultdict

# 데이터 로드
월평균소득 = pd.read_csv(path, encoding="euckr")
average_income = 월평균소득.groupby('행정동_코드')['월_평균_소득_금액'].mean().reset_index()

shape_code = list(map(lambda x: int(x + '00'), shape_code)) #앞에서 가지고온 모든 서울시 법정동 코드임 
result = []

def hang(k):
    h = df['행정동코드'][df['법정동코드'] == k]
    return h


default_value = average_income['월_평균_소득_금액'].mean()


for i in shape_code:
    k = list(set(hang(i))) #법정동코드 = 행정동1 + 행정동2 + ''''에서 행정동코드만 가지고옴
    pop = 0
    cnt = 0
    for j in k:
        j = str(j)
        j = j[:-2] #뒤에 00을 제거하여 average_income['행정동_코드']의 코드양식과 일치시킴
        ret = average_income['월_평균_소득_금액'][average_income['행정동_코드'] == int(j)] #현재 칼럼의 타입이 float64이므로 정수형으로 변환시켜야함int(j)
        if ret.empty : 
            print(1) # 데이터가 없을 때 확인하기 위해 1을 찍어봄
        else : 
            pop += int(ret)
            cnt += 1
    if cnt == 0 : result.append(0)
    else : result.append(pop / cnt)

print("법정동 코드별 월 평균 소득:", result)
# ---------- end py3_9 ----------
bnd = Bounds(Numbers=py3_9.result)
dom = ConstructDomain(DomainStart=Slider(10, range=0..1000), DomainEnd=Slider(10000, range=0..10000))
bnd_2 = Bounds(Numbers=py3_8.result)
dom_2 = ConstructDomain(DomainStart=Slider(100, range=0..1000), DomainEnd=Slider(10000, range=0..10000))
remap = RemapNumbers(Value=py3_9.result, Source=bnd, Target=dom)  # -> Mapped, Clipped
remap_2 = RemapNumbers(Value=py3_8.result, Source=bnd_2, Target=dom_2)  # -> Mapped, Clipped
Z = UnitZ(Factor=remap.Mapped)
Z_2 = UnitZ(Factor=remap_2.Mapped)
extr = Extrude(Base=cull, Direction=Z)
extr_2 = Extrude(Base=cull_3, Direction=Z_2)
cap = CapHoles()
