# Grasshopper definition weighted_overlay_지하철역 평균승하차량.gh (Grasshopper 1.0.8)
# plug-ins: RhinoCodePluginGH

행정동 = Panel("lt_c_ademd_info")
# 지하철역사 별 평균 승하차량
py3 = Python3Script()  # -> out, Z, Point
# ---------- py3: Python ----------
import locale
locale.setlocale(locale.LC_ALL, 'ko_KR')
import pandas as pd
import rhinoscriptsyntax as rs
import Rhino.Geometry as rg

# 데이터 로드
지하철역 = pd.read_csv("D:/채건희/Programming Languages/Python/CARD_SUBWAY_MONTH_202411.csv", encoding="euckr")
역사ID좌표 = pd.read_csv("D:/채건희/Programming Languages/Python/서울시 역사마스터 정보.csv", encoding="euckr")

# 필요한 컬럼 추출
역사좌표 = 역사ID좌표[['역사명', '위도', '경도']]

# 승하차합계 및 평균 계산
지하철역['승하차합계'] = 지하철역['승차총승객수'] + 지하철역['하차총승객수']
평균승하차 = 지하철역.groupby('역명')['승하차합계'].mean().reset_index()
평균승하차.columns = ['역사명', '평균승하차']

# 좌표 결합
평균승하차좌표 = pd.merge(역사좌표, 평균승하차, on='역사명', how='left')

# 결측치 처리: 평균승하차 열에서 결측치를 전체 평균값으로 대체
평균값 = 평균승하차['평균승하차'].mean()  # 평균값 계산
평균승하차좌표['평균승하차'].fillna(평균값, inplace=True)  # 결측치 대체



# GPStoUTM 클래스 정의
class GPStoUTM:
    def __init__(self):
        pass

    def LLtoUTM(self, Lat, Long):
        import math
        RADIANS_PER_DEGREE = math.pi / 180.0
        WGS84_A = 6378137.0
        WGS84_E = 0.0818191908
        UTM_K0 = 0.9996
        UTM_FE = 500000.0
        UTM_FN_N = 0.0
        UTM_FN_S = 10000000.0

        LatRad = Lat * RADIANS_PER_DEGREE
        LongRad = Long * RADIANS_PER_DEGREE
        ZoneNumber = int((Long + 180) / 6) + 1
        LongOrigin = (ZoneNumber - 1) * 6 - 180 + 3
        LongOriginRad = LongOrigin * RADIANS_PER_DEGREE

        eccSquared = WGS84_E ** 2
        N = WGS84_A / math.sqrt(1 - eccSquared * math.sin(LatRad) ** 2)
        T = math.tan(LatRad) ** 2
        C = eccSquared / (1 - eccSquared) * math.cos(LatRad) ** 2
        A = math.cos(LatRad) * (LongRad - LongOriginRad)
        M = WGS84_A * ((1 - eccSquared / 4 - 3 * eccSquared ** 2 / 64 - 5 * eccSquared ** 3 / 256) * LatRad - (
                3 * eccSquared / 8 + 3 * eccSquared ** 2 / 32 + 45 * eccSquared ** 3 / 1024) * math.sin(
            2 * LatRad) + (15 * eccSquared ** 2 / 256 + 45 * eccSquared ** 3 / 1024) * math.sin(
            4 * LatRad) - (35 * eccSquared ** 3 / 3072) * math.sin(6 * LatRad))
        x = UTM_FE + UTM_K0 * N * (
                A + (1 - T + C) * A ** 3 / 6 + (5 - 18 * T + T ** 2 + 72 * C - 58 * eccSquared) * A ** 5 / 120)
        y = UTM_FN_N + UTM_K0 * (M + N * math.tan(LatRad) * (
                A ** 2 / 2 + (5 - T + 9 * C + 4 * C ** 2) * A ** 4 / 24 + (
                61 - 58 * T + T ** 2 + 600 * C - 330 * eccSquared) * A ** 6 / 720))

        if Lat < 0:
            y += UTM_FN_S

        return x, y

# GPStoUTM 인스턴스
gps = GPStoUTM()

# Rhino 점 생성 및 Overlay
Point = []
Z = []
for _, row in 평균승하차좌표.iterrows():
    try:
        # 위도, 경도 및 평균승하차 값 가져오기
        lat, lon = row['위도'], row['경도']
        avg_traffic = row['평균승하차']
        
        # 위도/경도를 UTM으로 변환
        x, y = gps.LLtoUTM(lat, lon)
        
        # Z값: 평균승하차량
        Z.append(avg_traffic)
        
        # Point3d 생성
        point = rg.Point3d(x, y, 0)
        Point.append(point)
        
        
    except Exception as e:
        print(f"Error processing row: {row}. Exception: {e}")
# ---------- end py3 ----------
bnd = Bounds(Numbers=py3.Z)
dom = ConstructDomain(DomainStart=Slider(100, range=0..1000), DomainEnd=Slider(10000, range=0..10000))
remap = RemapNumbers(Value=py3.Z, Source=bnd, Target=dom)  # -> Mapped, Clipped
py3_2 = Python3Script(
    Run=Toggle(True),
    address1="인천 남동구 도림동",
    address2="경기 남양주시 해밀예당1로 272",
    typeCol=행정동,
    vworld_key="D4F65F8F-A3B9-3D6C-9F94-06A911D059F2")  # -> out, info, shape, shape_name, shape_code; inputs address1: list
# ---------- py3_2: Python ----------
import rhinoscriptsyntax as rs
import Rhino.Geometry as rg
from System.Net import HttpWebRequest, WebRequest
from System.IO import StreamReader
import json
import clr
#from System.Web.Script.Serialization import JavaScriptSerializer
vworld_key = vworld_key
from math import sin, cos, tan, pi, sqrt
import re

RADIANS_PER_DEGREE = pi/180.0
DEGREES_PER_RADIAN = 180.0/pi

WGS84_A =  6378137.0
WGS84_B =  6356752.31424518
WGS84_F =  0.0033528107
WGS84_E =  0.0818191908
WGS84_EP = 0.0820944379

UTM_K0 =   0.9996
UTM_FE =   500000.0
UTM_FN_N = 0.0
UTM_FN_S = 10000000.0
UTM_E2 =   (WGS84_E*WGS84_E)
UTM_E4 =   (UTM_E2*UTM_E2)
UTM_E6 =   (UTM_E4*UTM_E2)
UTM_EP2 =  (UTM_E2/(1-UTM_E2))

class GPStoUTM(object):
    def __init__(self, **kwargs):
        pass

    def UTM(self, lat, lon):
        '''
        Gets the UTM coordinate without the letter and number.
        '''
        self.m0 = (1 - UTM_E2/4 - 3*UTM_E4/64 - 5*UTM_E6/256)
        self.m1 = -(3*UTM_E2/8 + 3*UTM_E4/32 + 45*UTM_E6/1024)
        self.m2 = (15*UTM_E4/256 + 45*UTM_E6/1024)
        self.m3 = -(35*UTM_E6/3072)

        if lon > 0:
            self.cm = int(lon) - (int(lon) % 6) + 3
        else:
            self.cm = int(lon) - (int(lon) % 6) - 3

        self.rlat = lat * RADIANS_PER_DEGREE
        self.rlon = lon * RADIANS_PER_DEGREE
        self.rlon0 = self.cm * RADIANS_PER_DEGREE

        self.slat = sin(self.rlat)
        self.clat = cos(self.rlat)
        self.tlat = tan(self.rlat)

        if lat > 0:
            self.fn = UTM_FN_N
        else:
            self.fn = UTM_FN_S

        self.T = self.tlat*self.tlat
        self.C = UTM_EP2 * self.clat * self.clat
        self.A = (self.rlon - self.rlon0) * self.clat
        self.M = WGS84_A * (self.m0*self.rlat + self.m1*sin(2*self.rlat) + \
            self.m2*sin(4*self.rlat) + self.m3*sin(6*self.rlat))
        self.V = WGS84_A / sqrt(1 - UTM_E2 * self.slat * self.slat)

        self.x = UTM_FE + UTM_K0 * self.V * (self.A + (1-self.T+self.C)\
            *pow(self.A, 3)/6 +(5-18*self.T+self.T*self.T+72*self.C-58*UTM_EP2)\
            *pow(self.A, 5)/120)

        self.y = self.fn + UTM_K0 * (self.M + self.V * self.tlat * \
            (self.A*self.A/2 + (5-self.T+9*self.C+4*self.C*self.C)* \
            pow(self.A, 4)/24 + ((61-58*self.T+self.T*self.T+600*self.C-\
            330*UTM_EP2) * pow(self.A, 6)/720)))

        return (self.x, self.y)

    def UTMLetterDesignator(self, Lat):
        '''
        Gets the UTM letter only.
        '''
        self.LetterDesignator = 'Z'
        if ((84 >= Lat) and (Lat >= 72)):
            self.LetterDesignator = 'X'
        elif ((72 > Lat) and (Lat >= 64)):
            self.LetterDesignator = 'W'
        elif ((64 > Lat) and (Lat >= 56)):
            self.LetterDesignator = 'V'
        elif ((56 > Lat) and (Lat >= 48)):
            self.LetterDesignator = 'U'
        elif ((48 > Lat) and (Lat >= 40)):
            self.LetterDesignator = 'T'
        elif ((40 > Lat) and (Lat >= 32)):
            self.LetterDesignator = 'S'
        elif ((32 > Lat) and (Lat >= 24)):
            self.LetterDesignator = 'R'
        elif ((24 > Lat) and (Lat >= 16)):
            self.LetterDesignator = 'Q'
        elif ((16 > Lat) and (Lat >= 8)):
            self.LetterDesignator = 'P'
        elif (( 8 > Lat) and (Lat >= 0)):
            self.LetterDesignator = 'N'
        elif (( 0 > Lat) and (Lat >= -8)):
            self.LetterDesignator = 'M'
        elif ((-8 > Lat) and (Lat >= -16)):
            self.LetterDesignator = 'L'
        elif ((-16 > Lat) and (Lat >= -24)):
            self.LetterDesignator = 'K'
        elif ((-24 > Lat) and (Lat >= -32)):
            self.LetterDesignator = 'J'
        elif ((-32 > Lat) and (Lat >= -40)):
            self.LetterDesignator = 'H'
        elif ((-40 > Lat) and (Lat >= -48)):
            self.LetterDesignator = 'G'
        elif ((-48 > Lat) and (Lat >= -56)):
            self.LetterDesignator = 'F'
        elif ((-56 > Lat) and (Lat >= -64)):
            self.LetterDesignator = 'E'
        elif ((-64 > Lat) and (Lat >= -72)):
            self.LetterDesignator = 'D'
        elif ((-72 > Lat) and (Lat >= -80)):
            self.LetterDesignator = 'C'
        return self.LetterDesignator

    def LLtoUTM(self, Lat, Long):
        '''
        Gets the UTM coordinate with the letter and number as inputs also.
        '''
        self.a = WGS84_A;
        self.eccSquared = UTM_E2;
        self.k0 = UTM_K0;

        self.LongTemp = (Long+180)-int((Long+180)/360)*360-180

        self.LatRad = Lat * RADIANS_PER_DEGREE
        self.LongRad = self.LongTemp * RADIANS_PER_DEGREE

        self.ZoneNumber = int((self.LongTemp+180)/6) + 1

        self.LongOrigin = (self.ZoneNumber-1)*6 - 180 + 3
        self.LongOriginRad = self.LongOrigin * RADIANS_PER_DEGREE

        self.eccPrimeSquared = (self.eccSquared)/(1-self.eccSquared);

        self.N = self.a/sqrt(1-self.eccSquared*sin(self.LatRad)*\
            sin(self.LatRad));
        self.T = tan(self.LatRad)*tan(self.LatRad);
        self.C = self.eccPrimeSquared*cos(self.LatRad)*cos(self.LatRad);
        self.A = cos(self.LatRad)*(self.LongRad-self.LongOriginRad);

        self.M = self.a*((1 - self.eccSquared/4 -\
            3*self.eccSquared*self.eccSquared/64 -\
            5*self.eccSquared*self.eccSquared*self.eccSquared/256) * \
            self.LatRad - (3*self.eccSquared/8 + 3*self.eccSquared*\
            self.eccSquared/32 +45*self.eccSquared*self.eccSquared*\
            self.eccSquared/1024)*sin(2*self.LatRad) + (15*self.eccSquared*\
            self.eccSquared/256 + 45*self.eccSquared*self.eccSquared*\
            self.eccSquared/1024)*sin(4*self.LatRad) - (35*self.eccSquared*\
            self.eccSquared*self.eccSquared/3072)*sin(6*self.LatRad))

        self.UTMEasting = float(self.k0*self.N*(self.A+(1-self.T+self.C)*\
            self.A**3/6 + (5-18*self.T+self.T*self.T+72*self.C-58*\
            self.eccPrimeSquared)*self.A**4/120) + 500000.0)

        self.UTMNorthing = float(self.k0*(self.M+self.N*tan(self.LatRad)\
            *(self.A**2/2+(5-self.T+9*self.C+4*self.C**2)*self.A**4/24 + (61-58\
            *self.T+self.T**2+600*self.C-330*self.eccPrimeSquared)\
            *self.A**6/720)))

        if (Lat < 0):
            self.UTMNorthing += 10000000.0

        return (self.UTMEasting, self.UTMNorthing)

    def UTMtoLL(self, UTMNorthing, UTMEasting, UTMNumber, UTMLetter):
        '''
        Gets the latitude and longitude with the UTM letter and number.
        '''
        self.ZoneNumber = int(UTMNumber)
        self.ZoneLetter = UTMLetter

        self.k0 = UTM_K0
        self.a = WGS84_A
        self.eccSquared = UTM_E2
        self.e1 = (1-sqrt(1-self.eccSquared))/(1+sqrt(1-self.eccSquared))

        self.x = UTMEasting - 500000.0
        self.y = UTMNorthing

        if self.ZoneLetter < 'N':
            self.y -= 10000000.0

        self.LongOrigin = (self.ZoneNumber - 1)*6 - 180 + 3
        self.eccPrimeSquared = (self.eccSquared)/(1-self.eccSquared)

        self.M = self.y/self.k0;
        self.mu = self.M/(self.a*(1-self.eccSquared/4-3*self.eccSquared**2/64\
            -5*self.eccSquared**3/256))

        self.phi1Rad = self.mu + ((3*self.e1/2-27*self.e1**3/32)*sin(2*self.mu)\
            + (21*self.e1**2/16-55*self.e1**4/32)*sin(4*self.mu)\
            + (151*self.e1**3/96)*sin(6*self.mu))

        self.N1 = self.a/sqrt(1-self.eccSquared*sin(self.phi1Rad)**2)
        self.T1 = tan(self.phi1Rad)**2
        self.C1 = self.eccPrimeSquared*cos(self.phi1Rad)**2
        self.R1 = self.a*(1-self.eccSquared)/pow(1-self.eccSquared*sin(self.phi1Rad)**2, 1.5)
        self.D = self.x/(self.N1*self.k0)

        self.Lat = self.phi1Rad - ((self.N1*tan(self.phi1Rad)/self.R1)\
            *(self.D**2/2-(5+3*self.T1+10*self.C1-4*self.C1**2-9\
            *self.eccPrimeSquared)*self.D**4/24+(61+90*self.T1+298*self.C1\
            +45*self.T1**2-252*self.eccPrimeSquared-3*self.C1**2)\
            *self.D**6/720))

        self.Lat = self.Lat * DEGREES_PER_RADIAN

        self.Long = ((self.D-(1+2*self.T1+self.C1)*self.D**3/6+(5-2*self.C1\
            +28*self.T1-3*self.C1**2+8*self.eccPrimeSquared+24*self.T1**2)\
            *self.D**5/120)/cos(self.phi1Rad))

        self.Long = self.LongOrigin + self.Long * DEGREES_PER_RADIAN

        return (self.Lat, self.Long)
        
gps = GPStoUTM()

def read(apiurl) : 
    request = WebRequest.Create(apiurl)
    request.Method = "GET"
    response = request.GetResponse()
    stream = response.GetResponseStream()
    reader = StreamReader(stream)
    responseText = reader.ReadToEnd()
    return json.loads(responseText)

def terrain(ymin,xmin,ymax,xmax, typeCol, vworld_key) :
    params = {
        "SERVICE": "WFS",
        "REQUEST": "GetFeature",
        "TYPENAME": typeCol,
        "BBOX": "{0},{1},{2},{3}".format(ymin, xmin, ymax, xmax),
        "VERSION": "1.1.0",
        "MAXFEATURES": "1000",
        "SRSNAME": "EPSG:4326",
        "OUTPUT": "application/json",
        "EXCEPTIONS": "text/xml",
        "KEY": vworld_key
    }

    apiurl = "https://api.vworld.kr/req/wfs"

    # params 딕셔너리를 URL 쿼리 스트링으로 변환
    query_string = "&".join(["{0}={1}".format(key, value) for key, value in params.items()])
    full_url = "{0}?{1}".format(apiurl,query_string)
    data = read(full_url)
    return data


def AddressToCoord(input_address, vworld_key):
    apiurl = "https://api.vworld.kr/req/address?service=address&request=getcoord&crs=EPSG:4326&address={0}&format=json&type=road&key={1}".format(input_address, vworld_key)
    request = WebRequest.Create(apiurl)
    request.Method = "GET"
    response = request.GetResponse()
    stream = response.GetResponseStream()
    reader = StreamReader(stream)
    responseText = reader.ReadToEnd()
    response_data = json.loads(responseText)
    x_coord = response_data['response']['result']['point']['x']
    y_coord = response_data['response']['result']['point']['y']
    return float(x_coord), float(y_coord)
    
info = {}
select_type = []
select_type.append(typeCol)
dong_geom = []
dong_name = []
dong_code = []
nodata = []
nodataid = []



def remove_numbers(string):
    return re.sub(r'\d+', '', string)


if Run : 
    xmin, ymin = AddressToCoord(address1, vworld_key)
    xmax, ymax = AddressToCoord(address2, vworld_key)
    if(ymin > ymax) : ymin, ymax = ymax, ymin
    if(xmin > xmax) : xmin, xmax = xmax, xmin
    data = terrain(ymin, xmin, ymax, xmax, select_type[0], vworld_key)
    try: 
        info = data
        features = info["features"]
        for feature in features : 
            coords = feature['geometry']['coordinates']
            feat_name = feature['properties']['full_nm']
            print(feature)
            if "서울" in feat_name : 
                points = []
                for coord in coords[0][0] : 
                    try:
                        x, y = gps.LLtoUTM(coord[1], coord[0])
                        pt = rg.Point3d(x, y, 0)
                        points.append(pt)
                    except: continue
                try : 
                    polyline = rs.AddPolyline(points)
                    dong_geom.append(polyline)
                    dong_name.append(feat_name)
                    dong_code.append(feature['properties']['emd_cd'])
                except : pass
    except : pass

shape = dong_geom
shape_name = dong_name
shape_code = dong_code
# ---------- end py3_2 ----------
Z = UnitZ(Factor=remap.Mapped)
move = Move(Geometry=py3.Point, Motion=Z)  # -> Geometry, Transform
ln = Line(StartPoint=py3.Point, EndPoint=move.Geometry)
geo = Geometry(py3_2.shape)
