# Grasshopper definition 월평균 소득과 지출.gh (Grasshopper 1.0.8)
# plug-ins: RhinoCodePluginGH

py3 = Python3Script(URL="http://openapi.seoul.go.kr:8088", api_key="707372594162726936364c44614e78")  # -> out, a
# ---------- py3: Python ----------
import locale
locale.setlocale(locale.LC_ALL, 'ko_KR')
import pandas as pd
import rhinoscriptsyntax as rs
from System.Net import HttpWebRequest, WebRequest
from System.IO import StreamReader
import json
import clr
import xml.etree.ElementTree as ET

def read(apiurl) : 
    request = WebRequest.Create(apiurl)
    request.Method = "GET"
    response = request.GetResponse()
    stream = response.GetResponseStream()
    reader = StreamReader(stream)
    responseText = reader.ReadToEnd()
    return responseText

def parse_xml_recursive(element):
    """재귀적으로 XML 데이터를 파싱하여 딕셔너리로 반환."""
    data = {}
    for child in element:
        if len(child):  # 하위 태그가 있는 경우
            data[child.tag] = parse_xml_recursive(child)
        else:  # 하위 태그가 없는 경우
            data[child.tag] = child.text
    return data

def parse_xml_response(xml_response):
    """XML 응답을 루트로 시작해 파싱."""
    root = ET.fromstring(xml_response)  # XML 문자열을 ElementTree로 변환
    parsed_data = parse_xml_recursive(root)  # 재귀적으로 파싱
    return parsed_data

url = URL
key = api_key

apiurl = f"{url}/{key}/xml/VwsmAdstrdNcmCnsmpW/1/1000"


# print(apiurl)
response = read(apiurl)
# parsed_data = parse_xml_dynamic(response)

# # 결과 출력
# for data in parsed_data:
#     print(data)

parsed_data = parse_xml_response(response)

# 결과 출력
import json
print(json.dumps(parsed_data, ensure_ascii=False, indent=4))
# ---------- end py3 ----------
panel = Panel(py3.out)
