# Grasshopper definition weighted_overlay_autosave.gh (Grasshopper 1.0.8)
# plug-ins: RhinoCodePluginGH

panel = Panel("""서울특별시 강남구 영동대로 513
서울특별시 중구 을지로 281
서울특별시 중구 명동8길 27
서울특별시 용산구 이태원로 177
서울특별시 송파구 올림픽로 240
서울특별시 종로구 세종대로 175
서울특별시 마포구 양화로 161
서울특별시 종로구 사직로 161
서울특별시 종로구 세종대로 99
서울특별시 종로구 종로 54
서울특별시 강동구 올림픽로 875
서울특별시 종로구 율곡로 99
서울특별시 금천구 벚꽃로 298
서울특별시 강남구 강남대로 396
서울특별시 광진구 아차산로 237
서울특별시 강동구 아리수로 421
서울특별시 서초구 신반포로 194
서울특별시 서초구 서초중앙로 118
서울특별시 구로구 시흥대로 577
서울특별시 구로구 구로중앙로 198
서울특별시 광진구 천호대로 548
서울특별시 구로구 도림천로 477
서울특별시 영등포구 시흥대로 616
서울특별시 종로구 종로 288
서울특별시 성동구 아차산로 42
서울특별시 강북구 도봉로 196
서울특별시 강서구 공항대로 283
서울특별시 강북구 삼양로 700
서울특별시 동작구 동작대로 925
서울특별시 용산구 한강대로 200
서울특별시 관악구 남부순환로 1820
서울특별시 강서구 마곡동로 161
서울특별시 중구 한강대로 405
서울특별시 강남구 테헤란로 334
서울특별시 성북구 동소문로 10
서울특별시 강북구 도봉로 342
서울특별시 강남구 강남대로 478
서울특별시 서초구 강남대로 569
서울특별시 구로구 새말로 117
서울특별시 관악구 남부순환로 1619
서울특별시 서대문구 신촌로 83
서울특별시 서대문구 이화여대길 52
서울특별시 서초구 강남대로 240
서울특별시 강남구 테헤란로 152
서울특별시 은평구 통일로 842
서울특별시 양천구 목동동로 293
서울특별시 성동구 왕십리로 240
서울특별시 용산구 한강대로 405
서울특별시 송파구 가락로 68
서울특별시 성동구 장한로 79
서울특별시 강동구 천호대로 1005
서울특별시 동작구 사당로 300
서울특별시 중구 충정로 10
서울특별시 마포구 양화로 55
서울특별시 종로구 대학로 12
서울특별시 마포구 양화로 188
서울특별시 동대문구 회기로 194
서울특별시 강북구 삼양로173길 27
서울특별시 송파구 양재천로 295
서울특별시 강남구 압구정로 461
서울특별시 영등포구 여의대로 38
서울특별시 마포구 성미산로 164
서울특별시 영등포구 경인로 846
서울특별시 동대문구 휘경로 35
서울특별시 종로구 인사동길 62
서울특별시 성동구 왕십리로 410
서울특별시 강남구 압구정로 461
서울특별시 종로구 윤보선길 31
서울특별시 용산구 녹사평대로 220
서울특별시 종로구 창덕궁길 99
서울특별시 송파구 올림픽로 25
서울특별시 마포구 월드컵로 240
서울특별시 강서구 강서로 65
서울특별시 강남구 도산대로 44
서울특별시 송파구 석촌호수로 176
서울특별시 성동구 상원길 8
서울특별시 송파구 석촌호수로 176
서울특별시 중구 덕수궁길 5
서울특별시 서대문구 창천로 18
서울특별시 송파구 잠실로 269
서울특별시 용산구 한강대로 69
서울특별시 성동구 성수이로 127
서울특별시 강남구 압구정로 421
서울특별시 동대문구 왕산로 128
서울특별시 용산구 한강대로 32
서울특별시 강서구 공항대로 424
서울특별시 종로구 종로3길 17
서울특별시 강동구 고덕로 428
서울특별시 동대문구 왕산로 211
서울특별시 광진구 능동로 216
서울특별시 강서구 마곡서로 119
서울특별시 송파구 올림픽로 240
서울특별시 용산구 녹사평대로 221
서울특별시 송파구 위례성대로 171
서울특별시 종로구 자하문로 263
서울특별시 종로구 율곡로 234
서울특별시 강북구 우이천로 125
서울특별시 강남구 테헤란로 152
서울특별시 서초구 서초대로 411
서울특별시 관악구 봉천로 118
서울특별시 강동구 천호대로 1171
서울특별시 성북구 보문로 37
서울특별시 은평구 진흥로 125
서울특별시 종로구 수표로 3
서울특별시 마포구 대흥로 22
서울특별시 종로구 자하문로 101
서울특별시 동대문구 회기로 2
서울특별시 강북구 솔샘로 31
서울특별시 마포구 대흥로 30
서울특별시 강남구 학동로 211
서울특별시 송파구 송파대로 432
서울특별시 강남구 삼성로 111
서울특별시 용산구 청파로 17
서울특별시 강서구 가로공원로 45
서울특별시 강남구 압구정로 175
서울특별시 은평구 통일로 112""")
행정동 = Panel("lt_c_ademd_info")
행정동_2 = Panel("lt_c_ademd_info")
# 지하철역사 별 평균 승하차량
toggle = BooleanToggle(True)
행정동_3 = Panel("lt_c_ademd_info")
행정동_4 = Panel("lt_c_ademd_info")
# 개별공시지가
# 공시지가
toggle_2 = BooleanToggle(True)
# 소득
toggle_3 = BooleanToggle(True)
# 인구
toggle_4 = BooleanToggle(True)
행정동_5 = Panel("lt_c_ademd_info")
# KT핫플레이스
panel_2 = Panel("D4F65F8F-A3B9-3D6C-9F94-06A911D059F2")
py3 = Python3Script()  # -> gps
# ---------- py3: Python ----------
import rhinoscriptsyntax as rs
import Rhino.Geometry as rg
from System.Net import HttpWebRequest, WebRequest
from System.IO import StreamReader
import json
import clr
from math import sin, cos, tan, pi, sqrt
import re

RADIANS_PER_DEGREE = pi/180.0
DEGREES_PER_RADIAN = 180.0/pi

WGS84_A =  6378137.0
WGS84_B =  6356752.31424518
WGS84_F =  0.0033528107
WGS84_E =  0.0818191908
WGS84_EP = 0.0820944379

UTM_K0 =   0.9996
UTM_FE =   500000.0
UTM_FN_N = 0.0
UTM_FN_S = 10000000.0
UTM_E2 =   (WGS84_E*WGS84_E)
UTM_E4 =   (UTM_E2*UTM_E2)
UTM_E6 =   (UTM_E4*UTM_E2)
UTM_EP2 =  (UTM_E2/(1-UTM_E2))

class GPStoUTM(object):
    def __init__(self, **kwargs):
        pass

    def UTM(self, lat, lon):
        '''
        Gets the UTM coordinate without the letter and number.
        '''
        self.m0 = (1 - UTM_E2/4 - 3*UTM_E4/64 - 5*UTM_E6/256)
        self.m1 = -(3*UTM_E2/8 + 3*UTM_E4/32 + 45*UTM_E6/1024)
        self.m2 = (15*UTM_E4/256 + 45*UTM_E6/1024)
        self.m3 = -(35*UTM_E6/3072)

        if lon > 0:
            self.cm = int(lon) - (int(lon) % 6) + 3
        else:
            self.cm = int(lon) - (int(lon) % 6) - 3

        self.rlat = lat * RADIANS_PER_DEGREE
        self.rlon = lon * RADIANS_PER_DEGREE
        self.rlon0 = self.cm * RADIANS_PER_DEGREE

        self.slat = sin(self.rlat)
        self.clat = cos(self.rlat)
        self.tlat = tan(self.rlat)

        if lat > 0:
            self.fn = UTM_FN_N
        else:
            self.fn = UTM_FN_S

        self.T = self.tlat*self.tlat
        self.C = UTM_EP2 * self.clat * self.clat
        self.A = (self.rlon - self.rlon0) * self.clat
        self.M = WGS84_A * (self.m0*self.rlat + self.m1*sin(2*self.rlat) + \
            self.m2*sin(4*self.rlat) + self.m3*sin(6*self.rlat))
        self.V = WGS84_A / sqrt(1 - UTM_E2 * self.slat * self.slat)

        self.x = UTM_FE + UTM_K0 * self.V * (self.A + (1-self.T+self.C)\
            *pow(self.A, 3)/6 +(5-18*self.T+self.T*self.T+72*self.C-58*UTM_EP2)\
            *pow(self.A, 5)/120)

        self.y = self.fn + UTM_K0 * (self.M + self.V * self.tlat * \
            (self.A*self.A/2 + (5-self.T+9*self.C+4*self.C*self.C)* \
            pow(self.A, 4)/24 + ((61-58*self.T+self.T*self.T+600*self.C-\
            330*UTM_EP2) * pow(self.A, 6)/720)))

        return (self.x, self.y)

    def UTMLetterDesignator(self, Lat):
        '''
        Gets the UTM letter only.
        '''
        self.LetterDesignator = 'Z'
        if ((84 >= Lat) and (Lat >= 72)):
            self.LetterDesignator = 'X'
        elif ((72 > Lat) and (Lat >= 64)):
            self.LetterDesignator = 'W'
        elif ((64 > Lat) and (Lat >= 56)):
            self.LetterDesignator = 'V'
        elif ((56 > Lat) and (Lat >= 48)):
            self.LetterDesignator = 'U'
        elif ((48 > Lat) and (Lat >= 40)):
            self.LetterDesignator = 'T'
        elif ((40 > Lat) and (Lat >= 32)):
            self.LetterDesignator = 'S'
        elif ((32 > Lat) and (Lat >= 24)):
            self.LetterDesignator = 'R'
        elif ((24 > Lat) and (Lat >= 16)):
            self.LetterDesignator = 'Q'
        elif ((16 > Lat) and (Lat >= 8)):
            self.LetterDesignator = 'P'
        elif (( 8 > Lat) and (Lat >= 0)):
            self.LetterDesignator = 'N'
        elif (( 0 > Lat) and (Lat >= -8)):
            self.LetterDesignator = 'M'
        elif ((-8 > Lat) and (Lat >= -16)):
            self.LetterDesignator = 'L'
        elif ((-16 > Lat) and (Lat >= -24)):
            self.LetterDesignator = 'K'
        elif ((-24 > Lat) and (Lat >= -32)):
            self.LetterDesignator = 'J'
        elif ((-32 > Lat) and (Lat >= -40)):
            self.LetterDesignator = 'H'
        elif ((-40 > Lat) and (Lat >= -48)):
            self.LetterDesignator = 'G'
        elif ((-48 > Lat) and (Lat >= -56)):
            self.LetterDesignator = 'F'
        elif ((-56 > Lat) and (Lat >= -64)):
            self.LetterDesignator = 'E'
        elif ((-64 > Lat) and (Lat >= -72)):
            self.LetterDesignator = 'D'
        elif ((-72 > Lat) and (Lat >= -80)):
            self.LetterDesignator = 'C'
        return self.LetterDesignator

    def LLtoUTM(self, Lat, Long):
        '''
        Gets the UTM coordinate with the letter and number as inputs also.
        '''
        self.a = WGS84_A;
        self.eccSquared = UTM_E2;
        self.k0 = UTM_K0;

        self.LongTemp = (Long+180)-int((Long+180)/360)*360-180

        self.LatRad = Lat * RADIANS_PER_DEGREE
        self.LongRad = self.LongTemp * RADIANS_PER_DEGREE

        self.ZoneNumber = int((self.LongTemp+180)/6) + 1

        self.LongOrigin = (self.ZoneNumber-1)*6 - 180 + 3
        self.LongOriginRad = self.LongOrigin * RADIANS_PER_DEGREE

        self.eccPrimeSquared = (self.eccSquared)/(1-self.eccSquared);

        self.N = self.a/sqrt(1-self.eccSquared*sin(self.LatRad)*\
            sin(self.LatRad));
        self.T = tan(self.LatRad)*tan(self.LatRad);
        self.C = self.eccPrimeSquared*cos(self.LatRad)*cos(self.LatRad);
        self.A = cos(self.LatRad)*(self.LongRad-self.LongOriginRad);

        self.M = self.a*((1 - self.eccSquared/4 -\
            3*self.eccSquared*self.eccSquared/64 -\
            5*self.eccSquared*self.eccSquared*self.eccSquared/256) * \
            self.LatRad - (3*self.eccSquared/8 + 3*self.eccSquared*\
            self.eccSquared/32 +45*self.eccSquared*self.eccSquared*\
            self.eccSquared/1024)*sin(2*self.LatRad) + (15*self.eccSquared*\
            self.eccSquared/256 + 45*self.eccSquared*self.eccSquared*\
            self.eccSquared/1024)*sin(4*self.LatRad) - (35*self.eccSquared*\
            self.eccSquared*self.eccSquared/3072)*sin(6*self.LatRad))

        self.UTMEasting = float(self.k0*self.N*(self.A+(1-self.T+self.C)*\
            self.A**3/6 + (5-18*self.T+self.T*self.T+72*self.C-58*\
            self.eccPrimeSquared)*self.A**4/120) + 500000.0)

        self.UTMNorthing = float(self.k0*(self.M+self.N*tan(self.LatRad)\
            *(self.A**2/2+(5-self.T+9*self.C+4*self.C**2)*self.A**4/24 + (61-58\
            *self.T+self.T**2+600*self.C-330*self.eccPrimeSquared)\
            *self.A**6/720)))

        if (Lat < 0):
            self.UTMNorthing += 10000000.0

        return (self.UTMEasting, self.UTMNorthing)

    def UTMtoLL(self, UTMNorthing, UTMEasting, UTMNumber, UTMLetter):
        '''
        Gets the latitude and longitude with the UTM letter and number.
        '''
        self.ZoneNumber = int(UTMNumber)
        self.ZoneLetter = UTMLetter

        self.k0 = UTM_K0
        self.a = WGS84_A
        self.eccSquared = UTM_E2
        self.e1 = (1-sqrt(1-self.eccSquared))/(1+sqrt(1-self.eccSquared))

        self.x = UTMEasting - 500000.0
        self.y = UTMNorthing

        if self.ZoneLetter < 'N':
            self.y -= 10000000.0

        self.LongOrigin = (self.ZoneNumber - 1)*6 - 180 + 3
        self.eccPrimeSquared = (self.eccSquared)/(1-self.eccSquared)

        self.M = self.y/self.k0;
        self.mu = self.M/(self.a*(1-self.eccSquared/4-3*self.eccSquared**2/64\
            -5*self.eccSquared**3/256))

        self.phi1Rad = self.mu + ((3*self.e1/2-27*self.e1**3/32)*sin(2*self.mu)\
            + (21*self.e1**2/16-55*self.e1**4/32)*sin(4*self.mu)\
            + (151*self.e1**3/96)*sin(6*self.mu))

        self.N1 = self.a/sqrt(1-self.eccSquared*sin(self.phi1Rad)**2)
        self.T1 = tan(self.phi1Rad)**2
        self.C1 = self.eccPrimeSquared*cos(self.phi1Rad)**2
        self.R1 = self.a*(1-self.eccSquared)/pow(1-self.eccSquared*sin(self.phi1Rad)**2, 1.5)
        self.D = self.x/(self.N1*self.k0)

        self.Lat = self.phi1Rad - ((self.N1*tan(self.phi1Rad)/self.R1)\
            *(self.D**2/2-(5+3*self.T1+10*self.C1-4*self.C1**2-9\
            *self.eccPrimeSquared)*self.D**4/24+(61+90*self.T1+298*self.C1\
            +45*self.T1**2-252*self.eccPrimeSquared-3*self.C1**2)\
            *self.D**6/720))

        self.Lat = self.Lat * DEGREES_PER_RADIAN

        self.Long = ((self.D-(1+2*self.T1+self.C1)*self.D**3/6+(5-2*self.C1\
            +28*self.T1-3*self.C1**2+8*self.eccPrimeSquared+24*self.T1**2)\
            *self.D**5/120)/cos(self.phi1Rad))

        self.Long = self.LongOrigin + self.Long * DEGREES_PER_RADIAN

        return (self.Lat, self.Long)
        
gps = GPStoUTM()
# ---------- end py3 ----------
py3_2 = Python3Script(x=panel)  # -> out, a
# ---------- py3_2: Python ----------
a = x.split('\n')
# print(a)
print(len(a))
# ---------- end py3_2 ----------
py3_3 = Python3Script(gps=py3, location=py3_2.a, data=py3_2.a, typeCol=행정동, vworld_key="D4F65F8F-A3B9-3D6C-9F94-06A911D059F2")  # -> out, location_pt, location_name, shape_name, shape, shape_code; inputs location: list of String, data: list of String, typeCol: String, vworld_key: String
# ---------- py3_3: Python ----------
import rhinoscriptsyntax as rs
import Rhino.Geometry as rg
from System.Net import HttpWebRequest, WebRequest
from System.IO import StreamReader
import json
import clr
from math import sin, cos, tan, pi, sqrt
import re

vworld_key = vworld_key
gps = gps


def read(apiurl) : 
    request = WebRequest.Create(apiurl)
    request.Method = "GET"
    response = request.GetResponse()
    stream = response.GetResponseStream()
    reader = StreamReader(stream)
    responseText = reader.ReadToEnd()
    return json.loads(responseText)

def terrain(ymin,xmin,ymax,xmax, typeCol, vworld_key) :
    params = {
        "SERVICE": "WFS",
        "REQUEST": "GetFeature",
        "TYPENAME": typeCol,
        "BBOX": "{0},{1},{2},{3}".format(ymin, xmin, ymax, xmax),
        "VERSION": "1.1.0",
        "MAXFEATURES": "1000",
        "SRSNAME": "EPSG:4326",
        "OUTPUT": "application/json",
        "EXCEPTIONS": "text/xml",
        "KEY": vworld_key
    }

    apiurl = "https://api.vworld.kr/req/wfs"

    # params 딕셔너리를 URL 쿼리 스트링으로 변환
    query_string = "&".join(["{0}={1}".format(key, value) for key, value in params.items()])
    full_url = "{0}?{1}".format(apiurl,query_string)
    data = read(full_url)
    return data


def AddressToCoord(input_address, vworld_key):
    apiurl = "https://api.vworld.kr/req/address?service=address&request=getcoord&crs=EPSG:4326&address={0}&format=json&type=road&key={1}".format(input_address, vworld_key)
    request = WebRequest.Create(apiurl)
    request.Method = "GET"
    response = request.GetResponse()
    stream = response.GetResponseStream()
    reader = StreamReader(stream)
    responseText = reader.ReadToEnd()
    response_data = json.loads(responseText)
    x_coord = response_data['response']['result']['point']['x']
    y_coord = response_data['response']['result']['point']['y']
    return float(x_coord), float(y_coord)


info = {}
select_type = []
select_type.append(typeCol)
dong_geom = []
dong_name = []
dong_code = []
location_pt = []
location_name = []

data = data
location = location

for id, d in enumerate(data) :
    try : 
        xmin, ymin = AddressToCoord(d, vworld_key)
        _data = terrain(ymin, xmin, ymin, xmin, select_type[0], vworld_key)
        p, q = gps.LLtoUTM(ymin, xmin)
        info = _data
        print(info)
        features = info["features"]
        for feature in features : 
            coords = feature['geometry']['coordinates']
            feat_name = feature['properties']['full_nm']
            points = []
            for coord in coords[0][0] : 
                try:
                    x, y = gps.LLtoUTM(coord[1], coord[0])
                    pt = rg.Point3d(x, y, 0)
                    points.append(pt)
                except: 
                    print('1')
            try : 
                polyline = rs.AddPolyline(points)
                dong_geom.append(polyline)
                dong_name.append(feat_name)
                location_name.append(location[id])
                location_pt.append(rg.Point3d(p, q, 0))
            except : continue
    except : continue

shape = dong_geom
shape_name = dong_name
shape_code = dong_code
location_pt = location_pt
location_name = location_name
# ---------- end py3_3 ----------
py3_4 = Python3Script(
    Run=toggle_2,
    address1="인천 남동구 도림동",
    address2="경기 남양주시 해밀예당1로 272",
    typeCol=행정동_4,
    vworld_key="D4F65F8F-A3B9-3D6C-9F94-06A911D059F2")  # -> out, info, shape, shape_name, shape_code; inputs address1: list
# ---------- py3_4: Python ----------
import rhinoscriptsyntax as rs
import Rhino.Geometry as rg
from System.Net import HttpWebRequest, WebRequest
from System.IO import StreamReader
import json
import clr
#from System.Web.Script.Serialization import JavaScriptSerializer
vworld_key = vworld_key
from math import sin, cos, tan, pi, sqrt
import re

RADIANS_PER_DEGREE = pi/180.0
DEGREES_PER_RADIAN = 180.0/pi

WGS84_A =  6378137.0
WGS84_B =  6356752.31424518
WGS84_F =  0.0033528107
WGS84_E =  0.0818191908
WGS84_EP = 0.0820944379

UTM_K0 =   0.9996
UTM_FE =   500000.0
UTM_FN_N = 0.0
UTM_FN_S = 10000000.0
UTM_E2 =   (WGS84_E*WGS84_E)
UTM_E4 =   (UTM_E2*UTM_E2)
UTM_E6 =   (UTM_E4*UTM_E2)
UTM_EP2 =  (UTM_E2/(1-UTM_E2))

class GPStoUTM(object):
    def __init__(self, **kwargs):
        pass

    def UTM(self, lat, lon):
        '''
        Gets the UTM coordinate without the letter and number.
        '''
        self.m0 = (1 - UTM_E2/4 - 3*UTM_E4/64 - 5*UTM_E6/256)
        self.m1 = -(3*UTM_E2/8 + 3*UTM_E4/32 + 45*UTM_E6/1024)
        self.m2 = (15*UTM_E4/256 + 45*UTM_E6/1024)
        self.m3 = -(35*UTM_E6/3072)

        if lon > 0:
            self.cm = int(lon) - (int(lon) % 6) + 3
        else:
            self.cm = int(lon) - (int(lon) % 6) - 3

        self.rlat = lat * RADIANS_PER_DEGREE
        self.rlon = lon * RADIANS_PER_DEGREE
        self.rlon0 = self.cm * RADIANS_PER_DEGREE

        self.slat = sin(self.rlat)
        self.clat = cos(self.rlat)
        self.tlat = tan(self.rlat)

        if lat > 0:
            self.fn = UTM_FN_N
        else:
            self.fn = UTM_FN_S

        self.T = self.tlat*self.tlat
        self.C = UTM_EP2 * self.clat * self.clat
        self.A = (self.rlon - self.rlon0) * self.clat
        self.M = WGS84_A * (self.m0*self.rlat + self.m1*sin(2*self.rlat) + \
            self.m2*sin(4*self.rlat) + self.m3*sin(6*self.rlat))
        self.V = WGS84_A / sqrt(1 - UTM_E2 * self.slat * self.slat)

        self.x = UTM_FE + UTM_K0 * self.V * (self.A + (1-self.T+self.C)\
            *pow(self.A, 3)/6 +(5-18*self.T+self.T*self.T+72*self.C-58*UTM_EP2)\
            *pow(self.A, 5)/120)

        self.y = self.fn + UTM_K0 * (self.M + self.V * self.tlat * \
            (self.A*self.A/2 + (5-self.T+9*self.C+4*self.C*self.C)* \
            pow(self.A, 4)/24 + ((61-58*self.T+self.T*self.T+600*self.C-\
            330*UTM_EP2) * pow(self.A, 6)/720)))

        return (self.x, self.y)

    def UTMLetterDesignator(self, Lat):
        '''
        Gets the UTM letter only.
        '''
        self.LetterDesignator = 'Z'
        if ((84 >= Lat) and (Lat >= 72)):
            self.LetterDesignator = 'X'
        elif ((72 > Lat) and (Lat >= 64)):
            self.LetterDesignator = 'W'
        elif ((64 > Lat) and (Lat >= 56)):
            self.LetterDesignator = 'V'
        elif ((56 > Lat) and (Lat >= 48)):
            self.LetterDesignator = 'U'
        elif ((48 > Lat) and (Lat >= 40)):
            self.LetterDesignator = 'T'
        elif ((40 > Lat) and (Lat >= 32)):
            self.LetterDesignator = 'S'
        elif ((32 > Lat) and (Lat >= 24)):
            self.LetterDesignator = 'R'
        elif ((24 > Lat) and (Lat >= 16)):
            self.LetterDesignator = 'Q'
        elif ((16 > Lat) and (Lat >= 8)):
            self.LetterDesignator = 'P'
        elif (( 8 > Lat) and (Lat >= 0)):
            self.LetterDesignator = 'N'
        elif (( 0 > Lat) and (Lat >= -8)):
            self.LetterDesignator = 'M'
        elif ((-8 > Lat) and (Lat >= -16)):
            self.LetterDesignator = 'L'
        elif ((-16 > Lat) and (Lat >= -24)):
            self.LetterDesignator = 'K'
        elif ((-24 > Lat) and (Lat >= -32)):
            self.LetterDesignator = 'J'
        elif ((-32 > Lat) and (Lat >= -40)):
            self.LetterDesignator = 'H'
        elif ((-40 > Lat) and (Lat >= -48)):
            self.LetterDesignator = 'G'
        elif ((-48 > Lat) and (Lat >= -56)):
            self.LetterDesignator = 'F'
        elif ((-56 > Lat) and (Lat >= -64)):
            self.LetterDesignator = 'E'
        elif ((-64 > Lat) and (Lat >= -72)):
            self.LetterDesignator = 'D'
        elif ((-72 > Lat) and (Lat >= -80)):
            self.LetterDesignator = 'C'
        return self.LetterDesignator

    def LLtoUTM(self, Lat, Long):
        '''
        Gets the UTM coordinate with the letter and number as inputs also.
        '''
        self.a = WGS84_A;
        self.eccSquared = UTM_E2;
        self.k0 = UTM_K0;

        self.LongTemp = (Long+180)-int((Long+180)/360)*360-180

        self.LatRad = Lat * RADIANS_PER_DEGREE
        self.LongRad = self.LongTemp * RADIANS_PER_DEGREE

        self.ZoneNumber = int((self.LongTemp+180)/6) + 1

        self.LongOrigin = (self.ZoneNumber-1)*6 - 180 + 3
        self.LongOriginRad = self.LongOrigin * RADIANS_PER_DEGREE

        self.eccPrimeSquared = (self.eccSquared)/(1-self.eccSquared);

        self.N = self.a/sqrt(1-self.eccSquared*sin(self.LatRad)*\
            sin(self.LatRad));
        self.T = tan(self.LatRad)*tan(self.LatRad);
        self.C = self.eccPrimeSquared*cos(self.LatRad)*cos(self.LatRad);
        self.A = cos(self.LatRad)*(self.LongRad-self.LongOriginRad);

        self.M = self.a*((1 - self.eccSquared/4 -\
            3*self.eccSquared*self.eccSquared/64 -\
            5*self.eccSquared*self.eccSquared*self.eccSquared/256) * \
            self.LatRad - (3*self.eccSquared/8 + 3*self.eccSquared*\
            self.eccSquared/32 +45*self.eccSquared*self.eccSquared*\
            self.eccSquared/1024)*sin(2*self.LatRad) + (15*self.eccSquared*\
            self.eccSquared/256 + 45*self.eccSquared*self.eccSquared*\
            self.eccSquared/1024)*sin(4*self.LatRad) - (35*self.eccSquared*\
            self.eccSquared*self.eccSquared/3072)*sin(6*self.LatRad))

        self.UTMEasting = float(self.k0*self.N*(self.A+(1-self.T+self.C)*\
            self.A**3/6 + (5-18*self.T+self.T*self.T+72*self.C-58*\
            self.eccPrimeSquared)*self.A**4/120) + 500000.0)

        self.UTMNorthing = float(self.k0*(self.M+self.N*tan(self.LatRad)\
            *(self.A**2/2+(5-self.T+9*self.C+4*self.C**2)*self.A**4/24 + (61-58\
            *self.T+self.T**2+600*self.C-330*self.eccPrimeSquared)\
            *self.A**6/720)))

        if (Lat < 0):
            self.UTMNorthing += 10000000.0

        return (self.UTMEasting, self.UTMNorthing)

    def UTMtoLL(self, UTMNorthing, UTMEasting, UTMNumber, UTMLetter):
        '''
        Gets the latitude and longitude with the UTM letter and number.
        '''
        self.ZoneNumber = int(UTMNumber)
        self.ZoneLetter = UTMLetter

        self.k0 = UTM_K0
        self.a = WGS84_A
        self.eccSquared = UTM_E2
        self.e1 = (1-sqrt(1-self.eccSquared))/(1+sqrt(1-self.eccSquared))

        self.x = UTMEasting - 500000.0
        self.y = UTMNorthing

        if self.ZoneLetter < 'N':
            self.y -= 10000000.0

        self.LongOrigin = (self.ZoneNumber - 1)*6 - 180 + 3
        self.eccPrimeSquared = (self.eccSquared)/(1-self.eccSquared)

        self.M = self.y/self.k0;
        self.mu = self.M/(self.a*(1-self.eccSquared/4-3*self.eccSquared**2/64\
            -5*self.eccSquared**3/256))

        self.phi1Rad = self.mu + ((3*self.e1/2-27*self.e1**3/32)*sin(2*self.mu)\
            + (21*self.e1**2/16-55*self.e1**4/32)*sin(4*self.mu)\
            + (151*self.e1**3/96)*sin(6*self.mu))

        self.N1 = self.a/sqrt(1-self.eccSquared*sin(self.phi1Rad)**2)
        self.T1 = tan(self.phi1Rad)**2
        self.C1 = self.eccPrimeSquared*cos(self.phi1Rad)**2
        self.R1 = self.a*(1-self.eccSquared)/pow(1-self.eccSquared*sin(self.phi1Rad)**2, 1.5)
        self.D = self.x/(self.N1*self.k0)

        self.Lat = self.phi1Rad - ((self.N1*tan(self.phi1Rad)/self.R1)\
            *(self.D**2/2-(5+3*self.T1+10*self.C1-4*self.C1**2-9\
            *self.eccPrimeSquared)*self.D**4/24+(61+90*self.T1+298*self.C1\
            +45*self.T1**2-252*self.eccPrimeSquared-3*self.C1**2)\
            *self.D**6/720))

        self.Lat = self.Lat * DEGREES_PER_RADIAN

        self.Long = ((self.D-(1+2*self.T1+self.C1)*self.D**3/6+(5-2*self.C1\
            +28*self.T1-3*self.C1**2+8*self.eccPrimeSquared+24*self.T1**2)\
            *self.D**5/120)/cos(self.phi1Rad))

        self.Long = self.LongOrigin + self.Long * DEGREES_PER_RADIAN

        return (self.Lat, self.Long)
        
gps = GPStoUTM()

def read(apiurl) : 
    request = WebRequest.Create(apiurl)
    request.Method = "GET"
    response = request.GetResponse()
    stream = response.GetResponseStream()
    reader = StreamReader(stream)
    responseText = reader.ReadToEnd()
    return json.loads(responseText)

def terrain(ymin,xmin,ymax,xmax, typeCol, vworld_key) :
    params = {
        "SERVICE": "WFS",
        "REQUEST": "GetFeature",
        "TYPENAME": typeCol,
        "BBOX": "{0},{1},{2},{3}".format(ymin, xmin, ymax, xmax),
        "VERSION": "1.1.0",
        "MAXFEATURES": "1000",
        "SRSNAME": "EPSG:4326",
        "OUTPUT": "application/json",
        "EXCEPTIONS": "text/xml",
        "KEY": vworld_key
    }

    apiurl = "https://api.vworld.kr/req/wfs"

    # params 딕셔너리를 URL 쿼리 스트링으로 변환
    query_string = "&".join(["{0}={1}".format(key, value) for key, value in params.items()])
    full_url = "{0}?{1}".format(apiurl,query_string)
    data = read(full_url)
    return data


def AddressToCoord(input_address, vworld_key):
    apiurl = "https://api.vworld.kr/req/address?service=address&request=getcoord&crs=EPSG:4326&address={0}&format=json&type=road&key={1}".format(input_address, vworld_key)
    request = WebRequest.Create(apiurl)
    request.Method = "GET"
    response = request.GetResponse()
    stream = response.GetResponseStream()
    reader = StreamReader(stream)
    responseText = reader.ReadToEnd()
    response_data = json.loads(responseText)
    x_coord = response_data['response']['result']['point']['x']
    y_coord = response_data['response']['result']['point']['y']
    return float(x_coord), float(y_coord)
    
info = {}
select_type = []
select_type.append(typeCol)
dong_geom = []
dong_name = []
dong_code = []
nodata = []
nodataid = []



def remove_numbers(string):
    return re.sub(r'\d+', '', string)


if Run : 
    xmin, ymin = AddressToCoord(address1, vworld_key)
    xmax, ymax = AddressToCoord(address2, vworld_key)
    if(ymin > ymax) : ymin, ymax = ymax, ymin
    if(xmin > xmax) : xmin, xmax = xmax, xmin
    data = terrain(ymin, xmin, ymax, xmax, select_type[0], vworld_key)
    try: 
        info = data
        features = info["features"]
        for feature in features : 
            coords = feature['geometry']['coordinates']
            feat_name = feature['properties']['full_nm']
            print(feature)
            if "서울" in feat_name : 
                points = []
                for coord in coords[0][0] : 
                    try:
                        x, y = gps.LLtoUTM(coord[1], coord[0])
                        pt = rg.Point3d(x, y, 0)
                        points.append(pt)
                    except: continue
                try : 
                    polyline = rs.AddPolyline(points)
                    dong_geom.append(polyline)
                    dong_name.append(feat_name)
                    dong_code.append(feature['properties']['emd_cd'])
                except : pass
    except : pass

shape = dong_geom
shape_name = dong_name
shape_code = dong_code
# ---------- end py3_4 ----------
py3_5 = Python3Script(
    Run=toggle,
    address1="인천 남동구 도림동",
    address2="경기 남양주시 해밀예당1로 272",
    typeCol=행정동_2,
    vworld_key="D4F65F8F-A3B9-3D6C-9F94-06A911D059F2")  # -> out, info, shape, shape_name, shape_code; inputs address1: list; same code as py3_4
py3_6 = Python3Script(
    Run=toggle_3,
    address1="인천 남동구 도림동",
    address2="경기 남양주시 해밀예당1로 272",
    typeCol=행정동_3,
    vworld_key="D4F65F8F-A3B9-3D6C-9F94-06A911D059F2")  # -> out, info, shape, shape_name, shape_code; inputs address1: list; same code as py3_4
py3_7 = Python3Script(Run=toggle_4, address1="인천 남동구 도림동", address2="경기 남양주시 해밀예당1로 272", typeCol=행정동_5, vworld_key=panel_2)  # -> out, info, shape, shape_name, shape_code; inputs address1: list; same code as py3_4
path = FilePath("C:\Users\H01\Documents\카카오톡 받은 파일\행정안전부_지역별(행정동) 성별 연령별 주민등록 인구수_20241130\CARD_SUBWAY_MONTH_202411.csv")
path_2 = FilePath("C:\Users\H01\Documents\카카오톡 받은 파일\서울시 역사마스터 정보.csv")
py3_8 = Python3Script(x=path, y=path_2)  # -> out, Z, Point
# ---------- py3_8: Python ----------
import locale
locale.setlocale(locale.LC_ALL, 'ko_KR')
import pandas as pd
import rhinoscriptsyntax as rs
import Rhino.Geometry as rg

# 데이터 로드
지하철역 = pd.read_csv(x, encoding="euckr")
역사ID좌표 = pd.read_csv(y, encoding="euckr")

# 필요한 컬럼 추출
역사좌표 = 역사ID좌표[['역사명', '위도', '경도']]

# 승하차합계 및 평균 계산
지하철역['승하차합계'] = 지하철역['승차총승객수'] + 지하철역['하차총승객수']
평균승하차 = 지하철역.groupby('역명')['승하차합계'].mean().reset_index()
평균승하차.columns = ['역사명', '평균승하차']

# 좌표 결합
평균승하차좌표 = pd.merge(역사좌표, 평균승하차, on='역사명', how='left')

# 결측치 처리: 평균승하차 열에서 결측치를 전체 평균값으로 대체
평균값 = 평균승하차['평균승하차'].mean()  # 평균값 계산
평균승하차좌표['평균승하차'].fillna(평균값, inplace=True)  # 결측치 대체



# GPStoUTM 클래스 정의
class GPStoUTM:
    def __init__(self):
        pass

    def LLtoUTM(self, Lat, Long):
        import math
        RADIANS_PER_DEGREE = math.pi / 180.0
        WGS84_A = 6378137.0
        WGS84_E = 0.0818191908
        UTM_K0 = 0.9996
        UTM_FE = 500000.0
        UTM_FN_N = 0.0
        UTM_FN_S = 10000000.0

        LatRad = Lat * RADIANS_PER_DEGREE
        LongRad = Long * RADIANS_PER_DEGREE
        ZoneNumber = int((Long + 180) / 6) + 1
        LongOrigin = (ZoneNumber - 1) * 6 - 180 + 3
        LongOriginRad = LongOrigin * RADIANS_PER_DEGREE

        eccSquared = WGS84_E ** 2
        N = WGS84_A / math.sqrt(1 - eccSquared * math.sin(LatRad) ** 2)
        T = math.tan(LatRad) ** 2
        C = eccSquared / (1 - eccSquared) * math.cos(LatRad) ** 2
        A = math.cos(LatRad) * (LongRad - LongOriginRad)
        M = WGS84_A * ((1 - eccSquared / 4 - 3 * eccSquared ** 2 / 64 - 5 * eccSquared ** 3 / 256) * LatRad - (
                3 * eccSquared / 8 + 3 * eccSquared ** 2 / 32 + 45 * eccSquared ** 3 / 1024) * math.sin(
            2 * LatRad) + (15 * eccSquared ** 2 / 256 + 45 * eccSquared ** 3 / 1024) * math.sin(
            4 * LatRad) - (35 * eccSquared ** 3 / 3072) * math.sin(6 * LatRad))
        x = UTM_FE + UTM_K0 * N * (
                A + (1 - T + C) * A ** 3 / 6 + (5 - 18 * T + T ** 2 + 72 * C - 58 * eccSquared) * A ** 5 / 120)
        y = UTM_FN_N + UTM_K0 * (M + N * math.tan(LatRad) * (
                A ** 2 / 2 + (5 - T + 9 * C + 4 * C ** 2) * A ** 4 / 24 + (
                61 - 58 * T + T ** 2 + 600 * C - 330 * eccSquared) * A ** 6 / 720))

        if Lat < 0:
            y += UTM_FN_S

        return x, y

# GPStoUTM 인스턴스
gps = GPStoUTM()

# Rhino 점 생성 및 Overlay
Point = []
Z = []
for _, row in 평균승하차좌표.iterrows():
    try:
        # 위도, 경도 및 평균승하차 값 가져오기
        lat, lon = row['위도'], row['경도']
        avg_traffic = row['평균승하차']
        
        # 위도/경도를 UTM으로 변환
        x, y = gps.LLtoUTM(lat, lon)
        
        # Z값: 평균승하차량
        Z.append(avg_traffic)
        
        # Point3d 생성
        point = rg.Point3d(x, y, 0)
        Point.append(point)
        
        
    except Exception as e:
        print(f"Error processing row: {row}. Exception: {e}")
# ---------- end py3_8 ----------
merge = Merge()
merge_2 = Merge()
merge_3 = Merge()
sort = SortList(Keys=py3_4.shape_code, ValuesA=py3_4.shape)  # -> Keys, ValuesA
area = Area(Geometry=py3_4.shape)  # -> Area, Centroid
area_2 = Area(Geometry=py3_6.shape)  # -> Area, Centroid
area_3 = Area(Geometry=py3_7.shape)  # -> Area, Centroid
int = Integer(merge_3)
pt = Point(py3_8.Point)
larger = LargerThan(FirstNumber=area_3.Area, SecondNumber=Slider(100, range=0..100))  # -> LargerThan, OrEqualTo
larger_2 = LargerThan(FirstNumber=area.Area, SecondNumber=Slider(100, range=0..100))  # -> LargerThan, OrEqualTo
larger_3 = LargerThan(FirstNumber=area_2.Area, SecondNumber=Slider(100, range=0..100))  # -> LargerThan, OrEqualTo
path_3 = FilePath("C:\Users\H01\Documents\카카오톡 받은 파일\행정안전부_지역별(행정동) 성별 연령별 주민등록 인구수_20241130\KIKmix.20240208.xlsx")
path_4 = FilePath("C:\Users\H01\Documents\카카오톡 받은 파일\행정안전부_지역별(행정동) 성별 연령별 주민등록 인구수_20241130\KIKmix.20240208.xlsx")
cset = CreateSet(List=int)  # -> Set, Map
dong_to_bub = Python3Script(path=path_3)  # -> out, df; inputs path: String
# ---------- dong_to_bub: Python ----------
# requirements: openpyxl
# requirements: openpyxl
import locale
locale.setlocale(locale.LC_ALL, 'en_US.UTF-8')
import openpyxl
import pandas as pd
file_path = path  
df = pd.read_excel(file_path, engine='openpyxl')
df = df[df['시도명'].str.contains('서울특별시')]
df['address'] = df['시도명'] + ' ' + df['시군구명'] + ' ' + df['동리명']
df = df
# ---------- end dong_to_bub ----------
dong_to_bub_2 = Python3Script(path=path_4)  # -> out, df; inputs path: String
# ---------- dong_to_bub_2: Python ----------
# requirements: openpyxl
import locale
locale.setlocale(locale.LC_ALL, 'en_US.UTF-8')
import openpyxl
import pandas as pd
file_path = path  
df = pd.read_excel(file_path, engine='openpyxl')
df = df[df['시도명'].str.contains('서울특별시')]
df['address'] = df['시도명'] + ' ' + df['시군구명'] + ' ' + df['동리명']
df = df
# ---------- end dong_to_bub_2 ----------
cull = CullPattern(List=py3_4.shape_name, CullPattern=larger_2.LargerThan)
cull_2 = CullPattern(List=sort.ValuesA, CullPattern=larger_2.LargerThan)
incurve = PointInCurve(Point=pt, Curve=graft(py3_5.shape))  # -> Relationship, Point
cull_3 = CullPattern(List=py3_6.shape, CullPattern=larger_3.LargerThan)
cull_4 = CullPattern(List=py3_6.shape_code, CullPattern=larger_3.LargerThan)
cull_5 = CullPattern(List=py3_6.shape_name, CullPattern=larger_3.LargerThan)
cull_6 = CullPattern(List=py3_7.shape_name, CullPattern=larger.LargerThan)
cull_7 = CullPattern(List=py3_7.shape, CullPattern=larger.LargerThan)
cull_8 = CullPattern(List=py3_7.shape_code, CullPattern=larger.LargerThan)
path_5 = FilePath("C:\Users\H01\Downloads\공시지가_2024년\공시지가_2024년.csv")
mindex = MemberIndex(Set=int, Member=cset.Set)  # -> Index, Count
py3_9 = Python3Script(path=path_5)  # -> out, a, z, result
# ---------- py3_9: Python ----------
import locale
locale.setlocale(locale.LC_ALL, 'ko_KR')
import pandas as pd
from collections import defaultdict

공시지가 = pd.read_csv(path, encoding="euckr")

공시지가['법정동코드_변경'] = 공시지가['시군구코드'].astype(str)+공시지가['법정동코드'].astype(str)

공시지가_법정동코드 = 공시지가.groupby('법정동코드_변경')['공시지가(원/㎡)'].mean().reset_index()

공시지가_법정동코드.columns = ['법정동코드','공시지가']

a=공시지가_법정동코드

z=공시지가_법정동코드['공시지가'].tolist()

result = 공시지가_법정동코드['법정동코드'].tolist()
# ---------- end py3_9 ----------
path_6 = FilePath("C:\Users\H01\Documents\카카오톡 받은 파일\행정안전부_지역별(행정동) 성별 연령별 주민등록 인구수_20241130\행정안전부_지역별(행정동) 성별 연령별 주민등록 인구수_20241130.csv")
item = ListItem(List=merge, Index=mindex.Index, Wrap=True)
item_2 = ListItem(List=merge_3, Index=mindex.Index, Wrap=True)
item_3 = ListItem(List=merge_2, Index=mindex.Index, Wrap=True)
path_7 = FilePath("C:\Users\H01\Documents\카카오톡 받은 파일\행정안전부_지역별(행정동) 성별 연령별 주민등록 인구수_20241130\서울시 상권분석서비스(소득소비-행정동).csv")
py3_10 = Python3Script(df=dong_to_bub_2.df, file_population=path_6, shape_code=cull_8)  # -> out, result; inputs shape_code: list of String
# ---------- py3_10: Python ----------
import pandas as pd
from collections import defaultdict

df_p = pd.read_csv(file_population, encoding = 'cp949')

dictionary = defaultdict(int)

shape_code = list(map(lambda x : int(x + '00'), shape_code))
result = []

def hang(k) : 
    h = df['행정동코드'][df['법정동코드']==k]
    return h

for i in shape_code : 
    k = list(set(hang(i)))
    pop = 0
    for j in k : 
        ret = df_p['계'][df_p['행정기관코드'] == j].values[0]
        pop += int(ret)
    result.append(pop)

result = result
# ---------- end py3_10 ----------
bnd = Bounds(Numbers=py3_9.z)
dom = ConstructDomain(DomainStart=Slider(10, range=0..1000), DomainEnd=Slider(10000, range=0..10000))
py3_11 = Python3Script(df=dong_to_bub.df, shape_code=cull_4, path=path_7)  # -> out, result; inputs shape_code: list of String
# ---------- py3_11: Python ----------
import pandas as pd
from collections import defaultdict

# 데이터 로드
월평균소득 = pd.read_csv(path, encoding="euckr")
average_income = 월평균소득.groupby('행정동_코드')['월_평균_소득_금액'].mean().reset_index()

shape_code = list(map(lambda x: int(x + '00'), shape_code)) #앞에서 가지고온 모든 서울시 법정동 코드임 
result = []

def hang(k):
    h = df['행정동코드'][df['법정동코드'] == k]
    return h


default_value = average_income['월_평균_소득_금액'].mean()


for i in shape_code:
    k = list(set(hang(i))) #법정동코드 = 행정동1 + 행정동2 + ''''에서 행정동코드만 가지고옴
    pop = 0
    cnt = 0
    for j in k:
        j = str(j)
        j = j[:-2] #뒤에 00을 제거하여 average_income['행정동_코드']의 코드양식과 일치시킴
        ret = average_income['월_평균_소득_금액'][average_income['행정동_코드'] == int(j)] #현재 칼럼의 타입이 float64이므로 정수형으로 변환시켜야함int(j)
        if ret.empty : 
            print(1) # 데이터가 없을 때 확인하기 위해 1을 찍어봄
        else : 
            pop += int(ret)
            cnt += 1
    if cnt == 0 : result.append(default_value)
    else : result.append(pop / cnt)

print("법정동 코드별 월 평균 소득:", result)
# ---------- end py3_11 ----------
cull_9 = CullPattern(List=py3_8.Z, CullPattern=incurve.Relationship)
remap = RemapNumbers(Value=py3_9.z, Source=bnd, Target=dom)  # -> Mapped, Clipped
lng = ListLength(List=item_2)  # -> flatten(Length)
avr = Average(Input=cull_9)  # -> flatten(ArithmeticMean)
item_4 = ListItem(List=item, Index=0, Wrap=True)  # -> flatten(Item)
item_5 = ListItem(List=item_3, Index=0, Wrap=True)
bnd_2 = Bounds(Numbers=py3_10.result)
dom_2 = ConstructDomain(DomainStart=Slider(100, range=0..1000), DomainEnd=Slider(10000, range=0..10000))
bnd_3 = Bounds(Numbers=py3_11.result)
dom_3 = ConstructDomain(DomainStart=Slider(10, range=0..1000), DomainEnd=Slider(10000, range=0..10000))
Z = UnitZ(Factor=remap.Mapped)
bnd_4 = Bounds(Numbers=lng)
dom_4 = ConstructDomain(DomainStart=Slider(2500, range=0..10000), DomainEnd=Slider(10000, range=0..10000))
py3_12 = Python3Script(x=avr)  # -> out, a; inputs x: list of Int32
# ---------- py3_12: Python ----------
ret = []

for i in x : 
    if i == None : 
        ret.append(0)
    else : ret.append(i)

a = ret
# ---------- end py3_12 ----------
remap_2 = RemapNumbers(Value=py3_11.result, Source=bnd_3, Target=dom_3)  # -> Mapped, Clipped
remap_3 = RemapNumbers(Value=py3_10.result, Source=bnd_2, Target=dom_2)  # -> Mapped, Clipped
extr = Extrude(Base=cull_2, Direction=Z)
remap_4 = RemapNumbers(Value=lng, Source=bnd_4, Target=dom_4)  # -> Mapped, Clipped
bnd_5 = Bounds(Numbers=py3_12.a)
dom_5 = ConstructDomain(DomainStart=Slider(100, range=0..1000), DomainEnd=Slider(10000, range=0..10000))
Z_2 = UnitZ(Factor=remap_2.Mapped)
Z_3 = UnitZ(Factor=remap_3.Mapped)
data = Data(remap.Mapped)
data_2 = Data(py3_11.result)
remap_5 = RemapNumbers(Value=py3_12.a, Source=bnd_5, Target=dom_5)  # -> Mapped, Clipped
bnd_6 = Bounds(Numbers=data)
extr_2 = Extrude(Base=cull_3, Direction=Z_2)
extr_3 = Extrude(Base=cull_7, Direction=Z_3)
data_3 = Data(py3_10.result)
bnd_7 = Bounds(Numbers=data_2)
Z_4 = UnitZ(Factor=remap_5.Mapped)
dedomain = DeconstructDomain(Domain=bnd_6)  # -> Start, End
bnd_8 = Bounds(Numbers=data_3)
dedomain_2 = DeconstructDomain(Domain=bnd_7)  # -> Start, End
Z_5 = UnitZ(Factor=remap_4.Mapped)  # -> flatten(UnitVector)
crv = Curve(flatten(item_5))
cap = CapHoles(Brep=extr)
dedomain_3 = DeconstructDomain(Domain=bnd_8)  # -> Start, End
data_4 = Data(remap_4.Mapped)
gradient = Gradient(
    LowerLimit=dedomain.Start,
    UpperLimit=dedomain.End,
    Parameter=data,
    stops=[0.103: RGB(0, 0, 255), 0.22: RGB(0, 170, 255), 0.305: RGB(0, 255, 255), 0.398: RGB(0, 255, 188), 0.504: RGB(0, 255, 106), 0.605: RGB(91, 255, 0), 0.799: RGB(255, 255, 0), 0.898: RGB(255, 170, 0)])
data_5 = Data(py3_12.a)
cap_2 = CapHoles(Brep=extr_2)
gradient_2 = Gradient(
    LowerLimit=dedomain_2.Start,
    UpperLimit=dedomain_2.End,
    Parameter=data_2,
    stops=[0.103: RGB(0, 0, 255), 0.22: RGB(0, 170, 255), 0.305: RGB(0, 255, 255), 0.398: RGB(0, 255, 188), 0.504: RGB(0, 255, 106), 0.605: RGB(91, 255, 0), 0.799: RGB(255, 255, 0), 0.898: RGB(255, 170, 0)])
cap_3 = CapHoles(Brep=extr_3)
extr_4 = Extrude(Base=py3_5.shape, Direction=Z_4)
gradient_3 = Gradient(
    LowerLimit=dedomain_3.Start,
    UpperLimit=dedomain_3.End,
    Parameter=data_3,
    stops=[0.103: RGB(0, 0, 255), 0.22: RGB(0, 170, 255), 0.305: RGB(0, 255, 255), 0.398: RGB(0, 255, 188), 0.504: RGB(0, 255, 106), 0.605: RGB(91, 255, 0), 0.799: RGB(255, 255, 0), 0.898: RGB(255, 170, 0)])
bnd_9 = Bounds(Numbers=data_4)
bnd_10 = Bounds(Numbers=data_5)
dedomain_4 = DeconstructDomain(Domain=bnd_9)  # -> Start, End
dedomain_5 = DeconstructDomain(Domain=bnd_10)  # -> Start, End
gradient_4 = Gradient(
    LowerLimit=dedomain_4.Start,
    UpperLimit=dedomain_4.End,
    Parameter=data_4,
    stops=[0.103: RGB(0, 0, 255), 0.22: RGB(0, 170, 255), 0.305: RGB(0, 255, 255), 0.398: RGB(0, 255, 188), 0.504: RGB(0, 255, 106), 0.605: RGB(91, 255, 0), 0.799: RGB(255, 255, 0), 0.898: RGB(255, 170, 0)])
gradient_5 = Gradient(
    LowerLimit=dedomain_5.Start,
    UpperLimit=dedomain_5.End,
    Parameter=data_5,
    stops=[0.103: RGB(0, 0, 255), 0.22: RGB(0, 170, 255), 0.305: RGB(0, 255, 255), 0.398: RGB(0, 255, 188), 0.504: RGB(0, 255, 106), 0.605: RGB(91, 255, 0), 0.799: RGB(255, 255, 0), 0.898: RGB(255, 170, 0)])
preview = CustomPreview(Geometry=cap, Material=gradient)
extr_5 = Extrude(Base=crv, Direction=Z_5)
cap_4 = CapHoles(Brep=extr_4)
cap_5 = CapHoles(Brep=extr_5)
preview_2 = CustomPreview(Geometry=cap_2, Material=gradient_2)
preview_3 = CustomPreview(Geometry=cap_3, Material=gradient_3)
preview_4 = CustomPreview(Geometry=cap_5, Material=gradient_4)
preview_5 = CustomPreview(Geometry=cap_4, Material=gradient_5)

# ----
# 공시지가
# 지하철 승하차
number_slider = Slider(0.38, range=0..1)
py3_13 = Python3Script(shape=cull_2, shape_name=cull, value=remap.Mapped, weight=number_slider)  # -> out, a; inputs shape: list, shape_name: list, value: list of Double, weight: Double
# ---------- py3_13: Python ----------
from collections import defaultdict

dictionary = defaultdict(float)

for id,i in enumerate(shape_name) :
    dictionary[i] = value[id] * weight


a = dictionary
print(a)
# ---------- end py3_13 ----------

# ----
# 소득
number_slider_2 = Slider(0.38, range=0..1)
py3_14 = Python3Script(shape=py3_5.shape, shape_name=py3_5.shape_name, value=remap_5.Mapped, weight=number_slider_2)  # -> out, a; inputs shape: list, shape_name: list, value: list of Double, weight: Double; same code as py3_13

# ----
# 인구
number_slider_3 = Slider(0.38, range=0..1)
py3_15 = Python3Script(shape=cull_3, shape_name=cull_5, value=remap_2.Mapped, weight=number_slider_3)  # -> out, a; inputs shape: list, shape_name: list, value: list of Double, weight: Double; same code as py3_13

# ----
# KT핫플
number_slider_4 = Slider(0.38, range=0..1)
py3_16 = Python3Script(shape=cull_7, shape_name=cull_6, value=remap_3.Mapped, weight=number_slider_4)  # -> out, a; inputs shape: list, shape_name: list, value: list of Double, weight: Double; same code as py3_13

py3_17 = Python3Script(shape=crv, shape_name=item_4, value=remap_4.Mapped, weight=Slider(0.38, range=0..1))  # -> out, a; inputs shape: list, shape_name: list, value: list of Double, weight: Double; same code as py3_13

py3_18 = Python3Script(shape=py3_4.shape, shape_name=py3_4.shape_name)  # -> out, Dict; inputs shape: list of Curve, shape_name: list
# ---------- py3_18: Python ----------
from collections import defaultdict

dictionary = defaultdict(float)

for i in range(len(shape)) : 
    dictionary[shape_name[i]] = shape[i]

Dict = dictionary
# ---------- end py3_18 ----------
py3_19 = Python3Script(Dict=py3_18.Dict, a=py3_13.a, b=py3_14.a, c=py3_15.a, d=py3_16.a, e=py3_17.a)  # -> out, name, shape, value
# ---------- py3_19: Python ----------
from collections import defaultdict

dictionary = defaultdict(float)

for i in [a, b, c, d, e] : 
    for k, v in i.items() : 
        dictionary[k] += v

ret_shape = []
ret_value = []
ret_name = []

for k, v in dictionary.items() : 
    if v <= 100 : continue
    if Dict[k] == 0 : continue
    ret_shape.append(Dict[k])
    ret_value.append(v)
    ret_name.append(k)

# 세 리스트를 value 기준으로 내림차순 정렬
sorted_data = sorted(zip(ret_value, ret_shape, ret_name), key=lambda x: x[0], reverse=True)

# 정렬된 데이터에서 각 리스트를 추출
ret_value, ret_shape, ret_name = zip(*sorted_data)

# 리스트로 변환 (zip은 튜플로 반환되므로 변환 필요)
value = list(ret_value)
shape = list(ret_shape)
name = list(ret_name)

# 결과 출력 (옵션)
print("Sorted Value:", value)
print("Sorted Shape:", shape)
print("Sorted Name:", name)
# ---------- end py3_19 ----------
data_6 = Data(py3_19.value)
bnd_11 = Bounds(Numbers=data_6)
dedomain_6 = DeconstructDomain(Domain=bnd_11)  # -> Start, End
gradient_6 = Gradient(
    LowerLimit=dedomain_6.Start,
    UpperLimit=dedomain_6.End,
    Parameter=data_6,
    stops=[0.103: RGB(0, 0, 255), 0.22: RGB(0, 170, 255), 0.305: RGB(0, 255, 255), 0.398: RGB(0, 255, 188), 0.504: RGB(0, 255, 106), 0.605: RGB(91, 255, 0), 0.799: RGB(255, 255, 0), 0.898: RGB(255, 170, 0)])
Z_6 = UnitZ(Factor=py3_19.value)
extr_6 = Extrude(Base=py3_19.shape, Direction=Z_6)
cap_6 = CapHoles(Brep=extr_6)
series = Series(Start=0, Step=1, Count=Slider(8, range=0..100))
preview_6 = CustomPreview(Geometry=cap_6, Material=gradient_6)
item_6 = ListItem(List=py3_19.name, Index=series, Wrap=True)
item_7 = ListItem(List=cap_6, Index=series, Wrap=True)
