# Grasshopper definition weighted_overlay_revised.gh (Grasshopper 1.0.8)

path = FilePath("D:\Keon Chae\Workshop\JAH_PythonCircle\251113\solver.py")
py3 = Python3Script(script=path)  # -> out, geometries, centroids, avg_incomes; unedited script template
bnd = Bounds(Numbers=py3.avg_incomes)
dom = ConstructDomain(DomainStart=Slider(100, range=0..100), DomainEnd=Slider(10000, range=0..10000))
panel = Panel(py3.out)
remap = RemapNumbers(Value=py3.avg_incomes, Source=bnd, Target=dom)  # -> Mapped, Clipped
Z = UnitZ(Factor=remap.Mapped)
extr = Extrude()
move = Move(Geometry=py3.centroids, Motion=Z)  # -> Geometry, Transform
capex = CapHolesEx(Brep=extr)  # -> Brep, Caps, Solid
